# Grasshopper definition 01_01_plato.gh (Grasshopper 1.0.7)

pt = Point([Point(-23.65490245, 137.0668966, 0), Point(262.9415258, 307.7789432, 0), Point(343.1120732, 183.8596499, 0), Point(264.5893416, 7.414324097, 0)])
pt_2 = Point(Point(204.8278952, 94.5999985, 0))
ln = Line(StartPoint=pt, EndPoint=pt_2)
item = ListItem(List=pt, Index=Slider(0, range=0..100), Wrap=True)
dist = Distance(PointA=item, PointB=pt_2)
ln_2 = Line(StartPoint=item, EndPoint=pt_2)
sph = Sphere(Base=item, Radius=dist)
