# Grasshopper definition 01_07_BooleanMasks.gh (Grasshopper 1.0.7)
# plug-ins: Pufferfish, Heteroptera, Human

# ---- group: Wave Equation
phi = Slider(6.636, range=0..12)
time_x = Slider(12, range=0..12)
time_interval = Slider(33, range=0..100)
omega = Slider(0.307, range=0..12)
# y(t) = A*Sin(Omega*t+Phi)
# A = Amplitude
# Omega = angular frequency
# Phi = phase (i.e. where t = 0)
A = Slider(1.497, range=0..12)
pi = Pi(Factor=time_x)
range = Range(Domain=pi, Steps=time_interval)
multiplication = Multiplication(A=omega, B=range)
addition = Addition(A=multiplication, B=phi)
sine = Sine(Value=addition)
multiplication_2 = Multiplication(A=A, B=sine)
cosine = Cosine(Value=addition)
multiplication_3 = Multiplication(A=A, B=cosine)
y_values = Panel(cosine)
x_values = Panel(range)
x_values_2 = Panel(range)
y_values_2 = Panel(multiplication_2)
construct_point = ConstructPoint(XCoordinate=x_values_2, YCoordinate=y_values_2, ZCoordinate=0)
construct_point_2 = ConstructPoint(XCoordinate=x_values, YCoordinate=y_values, ZCoordinate=0)
interpolate = Interpolate(Vertices=construct_point, Degree=3, Periodic=False, KnotStyle=1)  # -> Curve, Length, Domain
interpolate_2 = Interpolate(Vertices=construct_point_2, Degree=3, Periodic=False, KnotStyle=1)  # -> Curve, Length, Domain

# ---- group: Rotate Move Copy
yz = YZPlane(Origin=Point(0, 0, 0))
rad = Radians(Degrees=Slider(270, range=0..1000))
yz_2 = YZPlane(Origin=Point(0, 0, 0))
rad_2 = Radians(Degrees=Slider(270, range=0..1000))
rot3d = Rotate3D(Geometry=interpolate.Curve, Angle=rad, Center=Point(0, 0, 0), Axis=yz)  # -> Geometry, Transform
rot3d_2 = Rotate3D(Geometry=interpolate_2.Curve, Angle=rad_2, Center=Point(0, 0, 0), Axis=yz_2)  # -> Geometry, Transform
Y = UnitY(Factor=Slider(31, range=0..100))
move = Move(Geometry=rot3d.Geometry, Motion=Y)  # -> Geometry, Transform
loft = Loft(
    Curves=[rot3d_2.Geometry, move.Geometry],
    Options={Adjust=False, Closed=False, LoftEnds=0, LoftSimp=0, LoftType=0, Rebuild=10, Refit=0.01})

# ---- group: Domain
brec = BoundingRectangle(Geometry=loft, Plane=PlaneXY(0, 0, 0), Axis=0, Slide=0, Union=True)  # -> Bounding, DimensionX, DimensionY
panel = Panel(brec.DimensionX)
panel_2 = Panel(brec.DimensionY)
recgrid = Rectangular(Plane=PlaneXY(0, 0, 0), SizeX=Slider(2, range=0..100), SizeY=Slider(2, range=0..100), ExtentX=panel, ExtentY=panel_2)  # -> Cells, Points
offset = OffsetCurve(Curve=recgrid.Cells, Distance=-0.125, Corners=1)

# ----
pt = Point(Point(28.73605321, 21.67605758, 0))
center = Center(Geometric=recgrid.Cells)  # -> Center, Dimension
dist = Distance(PointA=pt, PointB=center.Center)
division = Division(A=dist, B=Slider(78, range=0..1000))
multiplication_4 = Multiplication(A=division, B=-1)
offset_2 = OffsetCurve(Curve=recgrid.Cells, Distance=multiplication_4, Corners=1)
panel_3 = Panel(division)
panel_4 = Panel(dist)

# ---- group: Project
crv = Curve(offset_2)
project = Project(Curve=crv, Brep=loft, Direction=Vector(0, 0, 1))  # -> flatten(Curve)

# ---- group: Lists
explode = Explode(Curve=project, Recursive=True)  # -> Segments, Vertices
panel_5 = Panel(explode.Segments)
item = ListItem(List=explode.Segments, Index="1", Wrap=True)
item_2 = ListItem(List=explode.Segments, Index="0", Wrap=True)
item_3 = ListItem(List=explode.Segments, Index="2", Wrap=True)
item_4 = ListItem(List=explode.Segments, Index="3", Wrap=True)
crv_2 = Curve(item_3)
crv_3 = Curve(item_2)
crv_4 = Curve(item_4)
crv_5 = Curve(item)
edgesrf = EdgeSurface(CurveA=crv_3, CurveB=crv_5, CurveC=crv_2, CurveD=crv_4)

# ---- group: Boolean Masks
number_slider = Slider(1.5, range=0..10)
area = Area(Geometry=edgesrf)  # -> Area, Centroid
flatten = FlattenTree(Tree=area.Area, Path="{0}")
flatten_2 = FlattenTree(Tree=edgesrf, Path="{0}")
panel_6 = Panel(flatten)
panel_7 = Panel(flatten_2)
smaller = SmallerThan(FirstNumber=flatten, SecondNumber=number_slider)  # -> SmallerThan, OrEqualTo
larger = LargerThan(FirstNumber=flatten, SecondNumber=number_slider)  # -> LargerThan, OrEqualTo
smaller_2 = SmallerThan(FirstNumber=flatten, SecondNumber=number_slider)  # -> SmallerThan, OrEqualTo
panel_8 = Panel(smaller.OrEqualTo)
cull = CullPattern(List=flatten_2, CullPattern=smaller.OrEqualTo)
cull_2 = CullPattern(List=flatten_2, CullPattern=larger.OrEqualTo)

# ---- group: Graphics
preview = CustomPreview(Geometry=cull_2, Material=ColourSwatch(SwatchColor=RGB(255, 255, 255)))
edges = BrepEdges(Brep=cull_2)  # -> Naked, Interior, NonManifold
previewlw = CustomPreviewLineweights(
    Geometry=edges.Naked,
    Shader={diffuse=RGB(255, 105, 180), emission=RGB(76, 32, 54), shine=0.5, specular=RGB(255, 255, 255), transparency=0},
    Thickness=Slider(2, range=0..10),
    Absolute=False)
