# Grasshopper definition 02_01_readingDataIntoGH.gh (Grasshopper 1.0.7)
# plug-ins: LunchBox

path = FilePath("C:\Users\jfmullin\Armstrong World Industries\TURF - Documents\LIBRARY\RHINO\TRAINING\jiminy-cricket\02\Tonnetz.xlsx")

path_2 = FilePath("C:\Users\cforneri\Desktop\Session02_Fifths\Tonnetz.xlsx")
excelread = ExcelReader(ReadExcelData=Toggle(True), WorkbookPath=path_2, WorksheetName="Sheet1")  # -> Exceptions, ExcelData

excelread_2 = ExcelReader(ReadExcelData=Toggle(True), WorkbookPath=path, WorksheetName="Sheet1")  # -> Exceptions, ExcelData
panel = Panel(excelread_2.ExcelData)

# ----
# Get Data From Excel
panel_2 = Panel(excelread.ExcelData)

number_slider = Slider(1, range=0..100)
item = ListItem(List=excelread_2.ExcelData, Index=number_slider, Wrap=True)

# ----
# Splitting Lists
number_slider_2 = Slider(1, range=0..100)
split = SplitList(List=excelread.ExcelData, Index=number_slider_2)  # -> ListA, ListB

split_2 = SplitList(List=excelread_2.ExcelData, Index=number_slider)  # -> ListA, ListB
panel_3 = Panel(item)
simplify = SimplifyTree(Tree=split_2.ListB, Front=False)

# ----
# Keeping things Tidy
simplify_2 = SimplifyTree(Tree=split.ListB, Front=False)
panel_4 = Panel(simplify_2)

viewer = ParamViewer(simplify)

# ----
# Visual Display Of List Structure
viewer_2 = ParamViewer(simplify_2)

# ----
# Exploding  to Seperate Lists
bang = ExplodeTree(Data=simplify_2)  # -> Branch0, Branch1, Branch2, Branch3, Branch4, Branch5, Branch6, Branch7

bang_2 = ExplodeTree(Data=simplify)  # -> Branch0, Branch1, Branch2, Branch3, Branch4, Branch5, Branch6, Branch7
panel_5 = Panel(bang.Branch1)
panel_6 = Panel(bang.Branch6)
panel_7 = Panel(bang.Branch0)
panel_8 = Panel(bang.Branch2)
panel_9 = Panel(bang.Branch4)
panel_10 = Panel(bang.Branch5)
panel_11 = Panel(bang.Branch3)
panel_13 = Panel(bang_2.Branch1)
panel_14 = Panel(bang_2.Branch3)
panel_15 = Panel(bang_2.Branch4)
panel_16 = Panel(bang_2.Branch2)
panel_17 = Panel(bang_2.Branch5)
panel_18 = Panel(bang_2.Branch7)
panel_19 = Panel(bang_2.Branch6)
