# Grasshopper definition 02_03_mappingDataToGeometry.gh (Grasshopper 1.0.7)
# plug-ins: LunchBox

path = FilePath("C:\Users\cforneri\Armstrong World Industries\TURF - Documents\LIBRARY\RHINO\TRAINING\jiminy-cricket\02\Tonnetz.xlsx")
excelread = ExcelReader(ReadExcelData=Toggle(True), WorkbookPath=path, WorksheetName="Sheet1")  # -> Exceptions, ExcelData

# ----
# Get Data From Excel
panel = Panel(excelread.ExcelData)

# ----
# Splitting Lists
number_slider = Slider(1, range=0..100)
split = SplitList(List=excelread.ExcelData, Index=number_slider)  # -> ListA, ListB
panel_2 = Panel(split.ListB)

# ----
# Keeping things Tidy
simplify = SimplifyTree(Tree=split.ListB, Front=False)
panel_3 = Panel(simplify)

# ----
# Visual Display Of List Structure
viewer = ParamViewer(simplify)

# ----
# Transposing Data
flip = FlipMatrix(Data=split.ListB)
panel_4 = Panel(flip)
item = CherryPicker(flip, ListIndex=0, TreePath_path="{0;0}")
item_2 = ListItem(List=flip, Index=Slider(3, range=0..10), Wrap=True)
panel_5 = Panel(item)
panel_6 = Panel(item_2)

# ----
# Exploding  to Seperate Lists
bang = ExplodeTree(Data=simplify)  # -> Branch0, Branch1, Branch2, Branch3, Branch4, Branch5, Branch6, Branch7

# ----
# Sorting lists By Keys
notes = Panel(bang.Branch0)
circle_of_fifths_ordering = Panel(bang.Branch2)
sort = SortList(Keys=circle_of_fifths_ordering, ValuesA=notes)  # -> Keys, ValuesA
sorted_values = Panel(sort.ValuesA)

# ----
# Cherry Picking Specific Items
item_3 = CherryPicker(simplify, ListIndex=8, TreePath_path="{1}")
panel_7 = Panel(item_3)

# ----
# Duplicating List Data
number_slider_2 = Slider(5, range=0..10)
dup = DuplicateData(Data=sorted_values, Number=number_slider_2, Order=True)
sorted_values_2 = Panel(dup)

# ---- group: Build A Citrle and Divide into number of
# Setting up the Visual Display
number_slider_3 = Slider(8, range=0..100)
Z = UnitZ(Factor=1)
pt = Point(Point(0, 0, 0))
lng = ListLength(List=split.ListB)  # -> flatten(Length)
circle = CircleCNR(Center=pt, Normal=Z, Radius=number_slider_3)
flatten = FlattenTree(Tree=lng, Path="{0}")
dcon = DeleteConsecutive(Set=flatten, Wrap=False)  # -> Set, Count
panel_8 = Panel(dcon.Set)
divide = DivideCurve(Curve=circle, Count=dcon.Set, Kinks=False)  # -> Points, Tangents, Parameters

# ----
# Creating Color From Data
panel_9 = Panel(bang.Branch6)
panel_10 = Panel(bang.Branch7)
panel_11 = Panel(bang.Branch5)
rgb = ColourRGB(Alpha=255, Red=panel_11, Green=panel_9, Blue=panel_10)

# ----
# Manipulating Lists - Reverse and Shift
number_slider_4 = Slider(4, range=0..100)
shift = ShiftList(List=divide.Points, Shift=number_slider_4, Wrap=True)  # -> flatten(List)
panel_12 = Panel(shift)
rev = ReverseList(List=shift)
panel_13 = Panel(rev)

# ----
# Mapping Data to Display
tag = TextTag3D(Location=rev, Text=sorted_values, Size=1, Colour=rgb, Justification=7)
