# Grasshopper definition 02_04_associatingDataSetsAndGeometry.gh (Grasshopper 1.0.7)
# plug-ins: LunchBox

path = FilePath("C:\Users\cforneri\Armstrong World Industries\TURF - Documents\LIBRARY\RHINO\TRAINING\jiminy-cricket\02\Tonnetz.xlsx")
excelread = ExcelReader(ReadExcelData=Toggle(True), WorkbookPath=path, WorksheetName="Sheet1")  # -> Exceptions, ExcelData

# ----
# Get Data From Excel
panel = Panel(excelread.ExcelData)

# ----
# Splitting Lists
number_slider = Slider(1, range=0..100)
split = SplitList(List=excelread.ExcelData, Index=number_slider)  # -> ListA, ListB
panel_2 = Panel(split.ListB)

# ----
# Keeping things Tidy
simplify = SimplifyTree(Tree=split.ListB, Front=False)
panel_3 = Panel(simplify)

# ----
# Visual Display Of List Structure
viewer = ParamViewer(simplify)

# ----
# Transposing Data
flip = FlipMatrix(Data=split.ListB)
panel_4 = Panel(flip)
item = CherryPicker(flip, ListIndex=0, TreePath_path="{0;0}")
item_2 = ListItem(List=flip, Index=Slider(3, range=0..10), Wrap=True)
panel_5 = Panel(item)
panel_6 = Panel(item_2)

# ----
# Exploding  to Seperate Lists
bang = ExplodeTree(Data=simplify)  # -> Branch0, Branch1, Branch2, Branch3, Branch4, Branch5, Branch6, Branch7

# ----
# Sorting lists By Keys
notes = Panel(bang.Branch0)
circle_of_fifths_ordering = Panel(bang.Branch2)
sort = SortList(Keys=circle_of_fifths_ordering, ValuesA=notes)  # -> Keys, ValuesA
sorted_values = Panel(sort.ValuesA)

# ----
# Cherry Picking Specific Items
item_3 = CherryPicker(simplify, ListIndex=8, TreePath_path="{1}")
panel_7 = Panel(item_3)

# ----
# Duplicating List Data
number_slider_2 = Slider(5, range=0..10)
dup = DuplicateData(Data=sorted_values, Number=number_slider_2, Order=True)
sorted_values_2 = Panel(dup)

# ----
# Creating Color From Data
panel_8 = Panel(bang.Branch6)
panel_9 = Panel(bang.Branch7)
panel_10 = Panel(bang.Branch5)
rgb = ColourRGB(Alpha=255, Red=panel_10, Green=panel_8, Blue=panel_9)

# ---- group: Build A Citrle and Divide into number of
# Setting up the Visual Display
number_slider_3 = Slider(8, range=0..100)
Z = UnitZ(Factor=1)
pt = Point(Point(0, 0, 0))
lng = ListLength(List=split.ListB)  # -> flatten(Length)
circle = CircleCNR(Center=pt, Normal=Z, Radius=number_slider_3)
flatten = FlattenTree(Tree=lng, Path="{0}")
dcon = DeleteConsecutive(Set=flatten, Wrap=False)  # -> Set, Count
panel_11 = Panel(dcon.Set)
divide = DivideCurve(Curve=circle, Count=dcon.Set, Kinks=False)  # -> Points, Tangents, Parameters

# ----
# Manipulating Lists - Reverse and Shift
number_slider_4 = Slider(4, range=0..100)
shift = ShiftList(List=divide.Points, Shift=number_slider_4, Wrap=True)  # -> flatten(List)
panel_12 = Panel(shift)
rev = ReverseList(List=shift)
panel_13 = Panel(rev)

# ----
# Mapping Data to Display
tag = TextTag3D(Location=rev, Text=sorted_values, Size=1, Colour=rgb, Justification=7)

path_2 = FilePath("C:\Users\cforneri\Desktop\Session02 - Fifths\RightHand_Normalized.txt")
file = ReadFile(File=path_2, PerLineParse=True)

lng_2 = ListLength(List=file)
panel_14 = Panel(lng_2)

# ----
# Get Data From Text
panel_15 = Panel(file)

# ---- group: Scrub Notes Here
number_slider_5 = Slider(0, range=0..100)

# ----
# Set Time Slider ( -1 one for previosu note )
shift_2 = ShiftList(List=panel_15, Shift=1, Wrap=True)
item_4 = ListItem(List=panel_15, Index=number_slider_5, Wrap=True)
item_5 = ListItem(List=shift_2, Index=number_slider_5, Wrap=True)
panel_16 = Panel(item_4)
panel_17 = Panel(item_5)

# ----
# Associate Data Sets
fsim = FindSimilarMember(Data=item_4, Set=sorted_values)  # -> Hit, Index
fsim_2 = FindSimilarMember(Data=item_5, Set=sorted_values)  # -> Hit, Index
panel_18 = Panel(fsim.Index)
panel_19 = Panel(fsim_2.Index)

# ----
# Grab Points Based on Value Index
item_6 = ListItem(List=rev, Index=fsim_2.Index, Wrap=True)
item_7 = ListItem(List=rev, Index=fsim.Index, Wrap=True)

# ----
# Draw Stuff
cir = Circle(Plane=item_6, Radius=1)
cir_2 = Circle(Plane=item_7, Radius=1)
ln = Line(StartPoint=item_7, EndPoint=item_6)
