# Grasshopper definition 01_Domain, Range and Series.gh (Grasshopper 1.0.7)

# ---- group: Domain And Range
dom = ConstructDomain(DomainStart=Slider(0, range=0..100), DomainEnd=Slider(1, range=0..1))
range = Range(Domain=dom, Steps=Slider(29, range=0..100))

# ----
crv = Curve(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)
crv_2 = Curve(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)
panel = Panel(range)
tweencrv = TweenCurve(CurveA=crv, CurveB=crv_2, Factor=range, BlendType=0)
