# Grasshopper definition 02_Grids,And,Sorting.gh (Grasshopper 1.0.7)
# plug-ins: Heteroptera, EleFront, Human

number_slider = Slider(24, range=0..100)

# ---- group: Reverse the Sort
toggle = BooleanToggle(False)

# ---- group: Sort The Tags By Line
line = Line(Line((265.0796197, 191.1377265, 0), (-45.48613644, -11.34101965, 0)))

# ----
recgrid = Rectangular(Plane=PlaneXY(0, 0, 0), SizeX=number_slider, SizeY=Slider(48, range=0..100), ExtentX=10, ExtentY=5)  # -> Cells, Points
center = Center(Geometric=recgrid.Cells)  # -> Center, Dimension

sort_pt = SortPoints(Points=center.Center)  # -> Points, Indices
alongcrv = SortAlongCurve(Points=sort_pt.Points, Curve=line)  # -> Points, Indices
gate = StreamGate(Stream=alongcrv.Points, Gate=toggle)  # -> Target0, Target1
rev = ReverseList(List=gate.Target1)
relay = Relay([gate.Target0, rev])
pt = Point(flatten(relay))

division = Division(A=number_slider, B=2)
circle_diameter = Slider(19.3, range=0..100)
subtraction = Subtraction(A=division, B=circle_diameter)
cir = Circle(Plane=center.Center, Radius=subtraction)  # -> flatten(Circle)
lng = ListLength(List=cir)

# ---- group: Tagging
number_slider_2 = Slider(1, range=0..1)
number_of_cells = Panel(lng)
fonts = FontTable()
item = ListItem(List=fonts, Index=Slider(352, range=0..1000), Wrap=True)
series = Series(Start=number_slider_2, Step=number_slider_2, Count=number_of_cells)
panel = Panel(series)
panel_2 = Panel(item)
list = ValueList({"BottomLeft", "MiddleLeft", "TopLeft", "BottomCenter", "MiddleCenter", "TopCenter", "BottomRight", "MiddleRight", "TopRight"}, selected="MiddleCenter")
concat = Concatenate(FragmentA="A", FragmentB=".", FragmentC=panel)
panel_3 = Panel(concat)
text = DefineTextObject(
    Text=panel_3,
    Plane=pt,
    DimensionStyle="TURF Inch",
    Justification=list,
    Size=Slider(1.3, range=0..100),
    Font=panel_2,
    OutputType="Curve")  # -> simplify(Text)
