# Grasshopper definition 03_Dimensions.gh (Grasshopper 1.0.7)
# plug-ins: Heteroptera, EleFront, Human

number_slider = Slider(24, range=0..100)

# ---- group: Reverse the Sort
toggle = BooleanToggle(False)

# ---- group: Sort The Tags By Line
line = Line(Line((265.0796197, 191.1377265, 0), (-45.48613644, -11.34101965, 0)))

# ----
recgrid = Rectangular(Plane=PlaneXY(0, 0, 0), SizeX=number_slider, SizeY=Slider(48, range=0..100), ExtentX=10, ExtentY=5)  # -> Cells, Points

# ---- group: Dimensions / Single ITEM List managment
item = ListItem(List=flatten(recgrid.Cells), Index=0, Wrap=True)
explode = Explode(Curve=item, Recursive=True)  # -> Segments, Vertices
item_2 = ListItem(List=explode.Segments, Index=Slider(3, range=0..100), Wrap=True)

# ---- group: Dimensions
item_3 = ListItem(List=explode.Segments, Index=Slider(0, range=0..100), Wrap=True)
item_4 = ListItem(List=item_2, Index=Slider(0, range=0..100), Wrap=True)
Y = UnitY(Factor=Slider(-3, range=-10..0))
X = UnitX(Factor=Slider(-3, range=-10..0))
end = EndPoints(Curve=item_3)  # -> Start, End
end_2 = EndPoints(Curve=item_4)  # -> Start, End
move = Move(Geometry=item_3, Motion=Y)  # -> Geometry, Transform
move_2 = Move(Geometry=item_4, Motion=X)  # -> Geometry, Transform
lineardim = LinearDimension(Line=move.Geometry, PointA=end.Start, PointB=end.End, Text="{0:0.00}", Size=1)
lineardim_2 = LinearDimension(Line=move_2.Geometry, PointA=end_2.Start, PointB=end_2.End, Text="{0:0.00}", Size=1)

# ----
center = Center(Geometric=recgrid.Cells)  # -> Center, Dimension
division = Division(A=number_slider, B=2)
circle_diameter = Slider(19.3, range=0..100)
subtraction = Subtraction(A=division, B=circle_diameter)
cir = Circle(Plane=center.Center, Radius=subtraction)  # -> flatten(Circle)
lng = ListLength(List=cir)

sort_pt = SortPoints(Points=center.Center)  # -> Points, Indices
alongcrv = SortAlongCurve(Points=sort_pt.Points, Curve=line)  # -> Points, Indices
gate = StreamGate(Stream=alongcrv.Points, Gate=toggle)  # -> Target0, Target1
rev = ReverseList(List=gate.Target1)
relay = Relay([gate.Target0, rev])
pt = Point(flatten(relay))

# ---- group: Tagging
number_slider_2 = Slider(1, range=0..1)
number_of_cells = Panel(lng)
fonts = FontTable()
item_5 = ListItem(List=fonts, Index=Slider(352, range=0..1000), Wrap=True)
series = Series(Start=number_slider_2, Step=number_slider_2, Count=number_of_cells)
panel = Panel(series)
panel_2 = Panel(item_5)
list = ValueList({"BottomLeft", "MiddleLeft", "TopLeft", "BottomCenter", "MiddleCenter", "TopCenter", "BottomRight", "MiddleRight", "TopRight"}, selected="MiddleCenter")
concat = Concatenate(FragmentA="A", FragmentB=".", FragmentC=panel)
panel_3 = Panel(concat)
text = DefineTextObject(
    Text=panel_3,
    Plane=pt,
    DimensionStyle="TURF Inch",
    Justification=list,
    Size=Slider(1.3, range=0..100),
    Font=panel_2,
    OutputType="Curve")  # -> simplify(Text)
