# Grasshopper definition 06_Fin.gh (Grasshopper 1.0.7)
# plug-ins: Heteroptera, EleFront, Human

number_slider = Slider(24, range=0..100)

# ---- group: Reverse the Sort
toggle = BooleanToggle(False)

# ---- group: Sort The Tags By Line
line = Line(Line((265.0796197, 191.1377265, 0), (-45.48613644, -11.34101965, 0)))

# ----
recgrid = Rectangular(Plane=PlaneXY(0, 0, 0), SizeX=number_slider, SizeY=Slider(48, range=0..100), ExtentX=10, ExtentY=5)  # -> Cells, Points

# ---- group: Dimensions
item = ListItem(List=flatten(recgrid.Cells), Index=0, Wrap=True)
explode = Explode(Curve=item, Recursive=True)  # -> Segments, Vertices
item_2 = ListItem(List=explode.Segments, Index=Slider(3, range=0..100), Wrap=True)

item_3 = ListItem(List=explode.Segments, Index=Slider(0, range=0..100), Wrap=True)
item_4 = ListItem(List=item_2, Index=Slider(0, range=0..100), Wrap=True)
Y = UnitY(Factor=Slider(-3, range=-10..0))
X = UnitX(Factor=Slider(-3, range=-10..0))
end = EndPoints(Curve=item_3)  # -> Start, End
end_2 = EndPoints(Curve=item_4)  # -> Start, End
move = Move(Geometry=item_3, Motion=Y)  # -> Geometry, Transform
move_2 = Move(Geometry=item_4, Motion=X)  # -> Geometry, Transform
lineardim = LinearDimension(Line=move.Geometry, PointA=end.Start, PointB=end.End, Text="{0:0.00}", Size=1)
lineardim_2 = LinearDimension(Line=move_2.Geometry, PointA=end_2.Start, PointB=end_2.End, Text="{0:0.00}", Size=1)

# ----
center = Center(Geometric=recgrid.Cells)  # -> Center, Dimension

sort_pt = SortPoints(Points=center.Center)  # -> Points, Indices
alongcrv = SortAlongCurve(Points=sort_pt.Points, Curve=line)  # -> Points, Indices
gate = StreamGate(Stream=alongcrv.Points, Gate=toggle)  # -> Target0, Target1
rev = ReverseList(List=gate.Target1)
relay = Relay([gate.Target0, rev])
pt = Point(flatten(relay))

division = Division(A=number_slider, B=2)
circle_diameter = Slider(19.3, range=0..100)
subtraction = Subtraction(A=division, B=circle_diameter)
cir = Circle(Plane=center.Center, Radius=subtraction)  # -> flatten(Circle)
lng = ListLength(List=cir)

# ---- group: Tagging
number_slider_2 = Slider(1, range=0..1)
number_of_cells = Panel(lng)
fonts = FontTable()
item_5 = ListItem(List=fonts, Index=Slider(352, range=0..1000), Wrap=True)
series = Series(Start=number_slider_2, Step=number_slider_2, Count=number_of_cells)
panel = Panel(series)
panel_2 = Panel(item_5)
list = ValueList({"BottomLeft", "MiddleLeft", "TopLeft", "BottomCenter", "MiddleCenter", "TopCenter", "BottomRight", "MiddleRight", "TopRight"}, selected="MiddleCenter")
concat = Concatenate(FragmentA="A", FragmentB=".", FragmentC=panel)
panel_3 = Panel(concat)
text = DefineTextObject(
    Text=panel_3,
    Plane=pt,
    DimensionStyle="TURF Inch",
    Justification=list,
    Size=Slider(1.3, range=0..100),
    Font=panel_2,
    OutputType="Curve")  # -> simplify(Text)

# ----
item_6 = ListItem(List=flatten(cir), Index=0, Wrap=True)
Z = UnitZ(Factor=1)

# ---- group: List managment
crv = Curve(item)
number_slider_3 = Slider(2, range=0..10)
explode_2 = Explode(Curve=crv, Recursive=True)  # -> Segments, Vertices
item_7 = ListItem(List=explode_2.Segments, Index=0, Wrap=True)  # -> Item, Item1, Item2, Item3
end_3 = EndPoints(Curve=item_7.Item2)  # -> Start, End
item_8 = ListItem(List=flatten(center.Center), Index=0, Wrap=True)
item_9 = ListItem(List=end_3.Start, Index=0, Wrap=True)  # -> Item, Item1
pt_2 = Point(item_9.Item)
pt_3 = Point(item_8)
rec_2pt = Rectangle2Pt(Plane=PlaneXY(0, 0, 0), PointA=pt_2, PointB=pt_3, Radius=0)  # -> Rectangle, Length
explode_3 = Explode(Curve=rec_2pt.Rectangle, Recursive=True)  # -> Segments, Vertices
item_10 = ListItem(List=explode_3.Segments, Index=0, Wrap=True)  # -> Item, Item1, Item2, Item3
crv_2 = Curve(item_10.Item)
crv_3 = Curve(item_10.Item1)

# ---- group: ReParameterize
crv_4 = Curve(item_10.Item3)
eval = EvaluateCurve(Curve=reparameterize(crv_4), Parameter=Slider(0.1, range=0..1))  # -> Point, Tangent, Angle

# ----
end_4 = EndPoints(Curve=crv_3)  # -> Start, End

# ---- group: Curve Closest Point
pt_4 = Point(end_4.Start)
crv_5 = Curve(item_6)
crv_cp = CurveClosestPoint(Point=pt_4, Curve=crv_5)  # -> Point, Parameter, Distance

# ---- group: Vectors and Amplitude
eval_2 = EvaluateCurve(Curve=crv_5, Parameter=crv_cp.Parameter)  # -> Point, Tangent, Angle
amp = Amplitude(Vector=eval_2.Tangent, Amplitude=Slider(14, range=0..100))
vdis = VectorDisplay(Anchor=eval_2.Point, Vector=amp)

# ---- group: Bezier Span
amp_2 = Amplitude(Vector=eval.Tangent, Amplitude=Slider(6, range=0..100))
bzspan = BezierSpan(StartPoint=eval_2.Point, StartTangent=amp, EndPoint=eval.Point, EndTangent=amp_2)  # -> Curve, Length, Domain
end_5 = EndPoints(Curve=crv_4)  # -> Start, End
ln = Line(StartPoint=end_5.Start, EndPoint=eval.Point)
merge = Merge(Data1=ln, Data2=bzspan.Curve)
join = JoinCurves(Curves=merge, Preserve=False)

# ---- group: Domain And Range
dom = ConstructDomain(DomainStart=Slider(0, range=0..100), DomainEnd=Slider(1, range=0..1))
range = Range(Domain=dom, Steps=Slider(15, range=0..100))

# ---- group: Rebuilding and tweening
number_slider_4 = Slider(2, range=0..10)
number_slider_5 = Slider(10, range=0..100)
reb = RebuildCurve(Curve=crv_3, Degree=number_slider_4, Count=number_slider_5, Tangents=False)  # -> flatten(Curve)
reb_2 = RebuildCurve(Curve=join, Degree=number_slider_4, Count=number_slider_5, Tangents=False)  # -> flatten(Curve)
flip = FlipCurve(Curve=reb)  # -> Curve, Flag
tweencrv = TweenCurve(CurveA=reb_2, CurveB=flip.Curve, Factor=range, BlendType=0)
simplify = SimplifyTree(Tree=tweencrv, Front=False)
panel_4 = Panel(simplify)

# ---- group: Sift and Combine Data
sift = SiftPattern(List=simplify, SiftPattern=[0, 1])  # -> Output0, Output1
Z_2 = UnitZ(Factor=Slider(0.4, range=0..1))
move_3 = Move(Geometry=sift.Output1, Motion=Z_2)  # -> Geometry, Transform
crv_6 = Curve(move_3.Geometry)
crv_7 = Curve(sift.Output0)
combine = CombineData(Input0=crv_7, Input1=crv_6)  # -> Result, Index

# ----
loft = Loft(Curves=combine.Result, Options={Adjust=False, Closed=False, LoftEnds=0, LoftSimp=0, LoftType=0, Rebuild=10, Refit=0.01})
