# Grasshopper definition Attractors_03.gh (Grasshopper 1.0.7)
# plug-ins: Human

number_slider = Slider(15, range=0..20)
md_slider = MDSlider(
    SliderMode=0,
    slider_value=Point(0.5097559487, 0.4759036145, 0.5),
    x_domain=Domain(0, 1),
    y_domain=Domain(0, 1),
    z_domain=Domain(0, 1))
hexgrid = Hexagonal(Plane=PlaneXY(0, 0, 0), Size=Slider(1, range=0..1), ExtentX=number_slider, ExtentY=number_slider)  # -> flatten(Cells), Points
bbox = BoundingBox(Content=hexgrid.Cells, Plane=PlaneXY(0, 0, 0), UnionBox=True)  # -> Box, Box_2
debrep = DeconstructBrep(Brep=bbox.Box)  # -> Faces, Edges, Vertices
evalsrf = EvaluateSurface(Surface=reparameterize(debrep.Faces), Point=md_slider)  # -> Point, Normal, Frame
pt = Point(flatten(hexgrid.Points))
dist = Distance(PointA=evalsrf.Point, PointB=pt)
min = Minimum(A=dist, B=Slider(9.27, range=0..10))
crv = Curve(hexgrid.Cells)
bnd = Bounds(Numbers=min)
dom = ConstructDomain(DomainStart=Slider(0.4, range=0..1), DomainEnd=Slider(0, range=0..1))
dom_2 = ConstructDomain(DomainStart=Slider(0.69, range=0..1), DomainEnd=Slider(0, range=0..1))
remap = RemapNumbers(Value=min, Source=bnd, Target=dom_2)  # -> Mapped, Clipped
remap_2 = RemapNumbers(Value=min, Source=bnd, Target=dom)  # -> Mapped, Clipped
equals = Equality(FirstNumber=remap.Mapped, SecondNumber=0)  # -> Equality, Inequality
dispatch = Dispatch(List=crv, DispatchPattern=equals.Equality)  # -> ListA, ListB
dispatch_2 = Dispatch(List=pt, DispatchPattern=equals.Equality)  # -> ListA, ListB
dispatch_3 = Dispatch(List=remap_2.Mapped, DispatchPattern=equals.Equality)  # -> ListA, ListB
dispatch_4 = Dispatch(List=remap.Mapped, DispatchPattern=equals.Equality)  # -> ListA, ListB
neg = Negative(Value=dispatch_3.ListB)
scale = Scale(Geometry=dispatch.ListB, Center=dispatch_2.ListB, Factor=dispatch_4.ListB)  # -> Geometry, Transform
Z = UnitZ(Factor=neg)
move = Move(Geometry=scale.Geometry, Motion=Z)  # -> Geometry, Transform
merge = Merge(Data1=simplify(graft(move.Geometry)), Data2=simplify(graft(dispatch.ListB)))
boundary = BoundarySurfaces(Edges=dispatch.ListA)
loft = Loft(Curves=merge, Options={Adjust=False, Closed=False, LoftEnds=0, LoftSimp=0, LoftType=0, Rebuild=10, Refit=0.01})  # -> flatten(Loft)
merge_2 = Merge(Data1=boundary, Data2=loft)
join = BrepJoin(Breps=merge_2)  # -> Breps, Closed
edges = BrepEdges(Brep=join.Breps)  # -> Naked, Interior, NonManifold
preview = CustomPreview(Geometry=join.Breps, Shader=ColourSwatch(SwatchColor=RGB(85, 90, 107)))
previewlw = CustomPreviewLineweights(
    Geometry=edges.Interior,
    Shader={diffuse=RGB(255, 105, 180), emission=RGB(76, 32, 54), shine=0.5, specular=RGB(255, 255, 255), transparency=0},
    Absolute=False)
