# Grasshopper definition CFIIIT_Grasshopper Tutorial 02_Attractor Points and Grids.gh (Grasshopper 0.9.56)

panel = Panel("Generate Grid Cells")
xy_plane = XYPlane(Origin=Point(0, 0, 0))
size_of_cell = Slider(16, range=0..100)
square = Square(Plane=xy_plane, Size=size_of_cell, ExtentX=Slider(8, range=0..100), ExtentY=Slider(14, range=0..100))  # -> Cells, Points

# ----
# Centers of cells are calulated. the lsit is flattened from mulitple contaitners.
curve = Curve(square.Cells)
polygon_center = PolygonCenter(Polyline=curve)  # -> CenterV, CenterE
param_viewer = ParamViewer(polygon_center.CenterE)
flatten_tree = FlattenTree(Tree=polygon_center.CenterE, Path="{0}")
param_viewer_2 = ParamViewer(flatten_tree)

division = Division(A=size_of_cell, B="2")
construct_domain = ConstructDomain(DomainStart="1", DomainEnd=division)
list_length = ListLength(List=flatten_tree)
random = Random(Range=construct_domain, Number=list_length, Seed=Slider(26, range=0..100))
xy_plane_2 = XYPlane(Origin=Point(0, 0, 0))
circle_cnr = CircleCNR(Center=flatten_tree, Normal=xy_plane_2, Radius=random)

point = Point(<point referenced from the Rhino model>)
distance = Distance(PointA=point, PointB=flatten_tree)
# The distance from a set point is calulated from our cell points. The distance is then divided by a threshold vlaue to control the sizing of the circles gloabally. Circles grow in size the farther away they are form the origianl point
xy_plane_3 = XYPlane(Origin=Point(0, 0, 0))
threshold = Slider(40, range=0..100)
division_2 = Division(A=distance, B=threshold)
circle_cnr_2 = CircleCNR(Center=flatten_tree, Normal=xy_plane_3, Radius=division_2)

number_slider = Slider(12, range=0..100)
# Radius of Circle is taken form the Dividing the Size of Cell by 2 so the circle does not go beyond the bounds of each cell
xy_plane_4 = XYPlane(Origin=Point(0, 0, 0))
# Radius of Circle is determined Randomly.
# WE develop a range of numbers from 0 - the size of the grid cell. We then generate a list of rnadom values from this domain. The number of vlaues is caluclated from teh number of circles present in our cell array by the list length component
panel_2 = Panel("2")
division_3 = Division(A=size_of_cell, B=panel_2)
circle_cnr_3 = CircleCNR(Center=flatten_tree, Normal=xy_plane_4, Radius=division_3)

# ----
# Surface are extruded to e height based on ditance from the point object
distance_2 = Distance(PointA=point, PointB=flatten_tree)
boundary_surfaces = BoundarySurfaces(Edges=circle_cnr_2)
threshold_2 = Slider(10, range=0..100)
division_4 = Division(A=distance_2, B=threshold_2)
unit_z = UnitZ(Factor=division_4)
extrude = Extrude(Base=boundary_surfaces, Direction=unit_z)

# ----
# Surface are extruded to e height based on ditance from the point object. those height sar ethen randomized acoordingly.
panel_3 = Panel("2")
division_5 = Division(A=size_of_cell, B=panel_3)
distance_3 = Distance(PointA=point, PointB=flatten_tree)
boundary_surfaces_2 = BoundarySurfaces(Edges=circle_cnr_2)
construct_domain_2 = ConstructDomain(DomainStart="1", DomainEnd=division_5)
list_length_2 = ListLength(List=flatten_tree)
threshold_3 = Slider(10, range=0..100)
random_2 = Random(Range=construct_domain_2, Number=list_length_2, Seed=Slider(13, range=0..100))
division_6 = Division(A=distance_3, B=random_2)
unit_z_2 = UnitZ(Factor=division_6)
extrude_2 = Extrude(Base=boundary_surfaces_2, Direction=unit_z_2)

# ----
# Surface is created by flattening the list of cells boundaries and combingin with the circles from last steps
flatten_tree_2 = FlattenTree(Tree=square.Cells, Path="{0}")
boundary_surfaces_3 = BoundarySurfaces(Edges=[flatten_tree_2, circle_cnr_2])
