# Grasshopper definition CFIIT_Grasshopper Tutorial 01_Introduction.gh (Grasshopper 0.9.64)

time_x = Slider(11, range=0..12)
time_interval = Slider(40, range=0..100)
A = Slider(2.996, range=0..12)
omega = Slider(0.281, range=0..12)
phi = Slider(7.143, range=0..12)
pi = Pi(Factor=time_x)
range = Range(Domain=pi, Steps=time_interval)
evaluate = Evaluate(Expression="A*Tan((Omega*t)+Phi)", A=A, Omega=omega, Phi=phi, t=range)

# ----
# y(t) = A*Sin(Omega*t+Phi)
# A = Amplitude
# Omega = angular frequency
# Phi = phase (i.e. where t = 0)
A_2 = Slider(2.996, range=0..12)
omega_2 = Slider(0.281, range=0..12)
phi_2 = Slider(7.143, range=0..12)
time_x_2 = Slider(11, range=0..12)
time_interval_2 = Slider(40, range=0..100)
pi_2 = Pi(Factor=time_x_2)
range_2 = Range(Domain=pi_2, Steps=time_interval_2)
multiplication = Multiplication(A=omega_2, B=range_2)
addition = Addition(A=multiplication, B=phi_2)
sine = Sine(Value=addition)
multiplication_2 = Multiplication(A=A_2, B=sine)
cosine = Cosine(Value=addition)
multiplication_3 = Multiplication(A=A_2, B=cosine)
y_values = Panel(cosine)
x_values = Panel(range_2)
y_values_2 = Panel(multiplication_2)
x_values_2 = Panel(range_2)
construct_point = ConstructPoint(XCoordinate=x_values_2, YCoordinate=y_values_2, ZCoordinate=0)
construct_point_2 = ConstructPoint(XCoordinate=x_values, YCoordinate=y_values, ZCoordinate=0)
interpolate = Interpolate(Vertices=construct_point, Degree=3, Periodic=False, KnotStyle=1)  # -> Curve, Length, Domain
interpolate_2 = Interpolate(Vertices=construct_point_2, Degree=3, Periodic=False, KnotStyle=1)  # -> Curve, Length, Domain

X = Panel(range)
Y = Panel(evaluate)
construct_point_3 = ConstructPoint(XCoordinate=X, YCoordinate=Y, ZCoordinate=0)
interpolate_3 = Interpolate(Vertices=construct_point_3, Degree=3, Periodic=False, KnotStyle=1)  # -> Curve, Length, Domain

time_x_3 = Slider(11, range=0..12)
time_interval_3 = Slider(40, range=0..100)
A_3 = Slider(2.996, range=0..12)
omega_3 = Slider(0.281, range=0..12)
phi_3 = Slider(7.143, range=0..12)
pi_3 = Pi(Factor=time_x_3)
range_3 = Range(Domain=pi_3, Steps=time_interval_3)
evaluate_2 = Evaluate(Expression="A*Sin((Omega*t)+Phi)", A=A_3, Omega=omega_3, Phi=phi_3, t=range_3)

time_x_4 = Slider(11, range=0..12)
time_interval_4 = Slider(40, range=0..100)
A_4 = Slider(2.996, range=0..12)
omega_4 = Slider(0.281, range=0..12)
phi_4 = Slider(7.143, range=0..12)
pi_4 = Pi(Factor=time_x_4)
range_4 = Range(Domain=pi_4, Steps=time_interval_4)
evaluate_3 = Evaluate(Expression="A*Cos((Omega*t)+Phi)", A=A_4, Omega=omega_4, Phi=phi_4, t=range_4)

X_2 = Panel(range_3)
Y_2 = Panel(evaluate_2)
X_3 = Panel(range_4)
Y_3 = Panel(evaluate_3)
construct_point_4 = ConstructPoint(XCoordinate=X_2, YCoordinate=Y_2, ZCoordinate=0)
construct_point_5 = ConstructPoint(XCoordinate=X_3, YCoordinate=Y_3, ZCoordinate=0)

interpolate_4 = Interpolate(Vertices=construct_point_4, Degree=3, Periodic=False, KnotStyle=1)  # -> Curve, Length, Domain
interpolate_5 = Interpolate(Vertices=construct_point_5, Degree=3, Periodic=False, KnotStyle=1)  # -> Curve, Length, Domain
height = Slider(22, range=0..100)
unit_z = UnitZ(Factor=height)
move = Move(Geometry=interpolate_5.Curve, Motion=unit_z)  # -> Geometry, Transform
loft = Loft(
    Curves=[interpolate_4.Curve, move.Geometry],
    Options={Adjust=False, Closed=False, LoftEnds=0, LoftSimp=0, LoftType=0, Rebuild=10, Refit=0.01})

surface = Surface(<surface referenced from the Rhino model>)

height_2 = Slider(4, range=0..100)
height_3 = Slider(15, range=0..100)
isocurve_density = DivideDomain²(Domain=loft, UCount=height_2, VCount=height_3)
isotrim = Isotrim(Surface=loft, Domain=isocurve_density)
deconstruct_brep = DeconstructBrep(Brep=isotrim)  # -> Faces, Edges, Vertices
panel = Panel(deconstruct_brep.Vertices)

height_4 = Slider(5, range=0..100)
height_5 = Slider(15, range=0..100)
isocurve_density_2 = DivideDomain²(Domain=surface, UCount=height_4, VCount=height_5)
isotrim_2 = Isotrim(Surface=surface, Domain=isocurve_density_2)
deconstruct_brep_2 = DeconstructBrep(Brep=isotrim_2)  # -> Faces, Edges, Vertices
panel_2 = Panel(deconstruct_brep_2.Vertices)

b_right_pt = ListItem(List=deconstruct_brep.Vertices, Index="3", Wrap=True)
t_right_pt = ListItem(List=deconstruct_brep.Vertices, Index="2", Wrap=True)
b_left_pt = ListItem(List=deconstruct_brep.Vertices, Index="0", Wrap=True)
t_left_pt = ListItem(List=deconstruct_brep.Vertices, Index="1", Wrap=True)
verticals = Line(StartPoint=t_right_pt, EndPoint=b_right_pt)
verticals_2 = Line(StartPoint=b_left_pt, EndPoint=t_left_pt)
horizontals = Line(StartPoint=b_left_pt, EndPoint=b_right_pt)
horizontals_2 = Line(StartPoint=t_left_pt, EndPoint=t_right_pt)
diagonal_left = Line(StartPoint=t_left_pt, EndPoint=b_right_pt)
diagonal_right = Line(StartPoint=b_left_pt, EndPoint=t_right_pt)

b_right_pt_2 = ListItem(List=deconstruct_brep_2.Vertices, Index="3", Wrap=True)
t_right_pt_2 = ListItem(List=deconstruct_brep_2.Vertices, Index="2", Wrap=True)
b_left_pt_2 = ListItem(List=deconstruct_brep_2.Vertices, Index="0", Wrap=True)
t_left_pt_2 = ListItem(List=deconstruct_brep_2.Vertices, Index="1", Wrap=True)
verticals_3 = Line(StartPoint=t_right_pt_2, EndPoint=b_right_pt_2)
verticals_4 = Line(StartPoint=b_left_pt_2, EndPoint=t_left_pt_2)
horizontals_3 = Line(StartPoint=b_left_pt_2, EndPoint=b_right_pt_2)
horizontals_4 = Line(StartPoint=t_left_pt_2, EndPoint=t_right_pt_2)
diagonal_left_2 = Line(StartPoint=t_left_pt_2, EndPoint=b_right_pt_2)
diagonal_right_2 = Line(StartPoint=b_left_pt_2, EndPoint=t_right_pt_2)
