# Grasshopper definition CFIIT_Grasshopper Tutorial 03_Dividing Surfaces.gh (Grasshopper 0.9.56)

t_1 = Slider(10, range=0..10)
t_n = Slider(87, range=0..100)
omega = Slider(0.36, range=0..10)
phi = Slider(4.99, range=0..10)
# y(t) = A*Sin(Omega*t+Phi)
# A = Amplitude
# Omega = angular frequency
# Phi = phase (i.e. where t = 0)
A = Slider(3.49, range=0..10)

pi = Pi(Factor=t_1)
panel = Panel(pi)
range = Range(Domain=panel, Steps=t_n)
panel_2 = Panel(range)
multiplication = Multiplication(A=omega, B=range)
panel_3 = Panel(multiplication)
addition = Addition(A=phi, B=multiplication)
panel_4 = Panel(addition)

tangent = Tangent(Value=addition)
cosine = Cosine(Value=addition)

sine = Sine(Value=addition)
panel_5 = Panel(sine)
multiplication_2 = Multiplication(A=A, B=panel_5)
panel_6 = Panel(multiplication_2)

panel_7 = Panel(tangent)
multiplication_3 = Multiplication(A=A, B=panel_7)
panel_8 = Panel(multiplication_3)

panel_9 = Panel(cosine)
multiplication_4 = Multiplication(A=A, B=panel_9)
panel_10 = Panel(multiplication_4)

construct_point = ConstructPoint(XCoordinate=range, YCoordinate=panel_9, ZCoordinate=0)
construct_point_2 = ConstructPoint(XCoordinate=range, YCoordinate=panel_7, ZCoordinate=0)
construct_point_3 = ConstructPoint(XCoordinate=range, YCoordinate=panel_6, ZCoordinate=0)
interpolate = Interpolate(Vertices=construct_point, Degree=3, Periodic=False, KnotStyle=1)  # -> Curve, Length, Domain
interpolate_2 = Interpolate(Vertices=construct_point_3, Degree=3, Periodic=False, KnotStyle=1)  # -> Curve, Length, Domain
interpolate_3 = Interpolate(Vertices=construct_point_2, Degree=3, Periodic=False, KnotStyle=1)  # -> Curve, Length, Domain
height_of_surface = Slider(19, range=0..1200)
unit_z = UnitZ(Factor=height_of_surface)
move = Move(Geometry=interpolate.Curve, Motion=unit_z)  # -> Geometry, Transform
loft = Loft(
    Curves=[move.Geometry, interpolate_2.Curve],
    Options={Adjust=False, Closed=False, Rebuild=10, Refit=0.01, LoftType=0, LoftEnds=0, LoftSimp=0})

u_count = Slider(3, range=0..1200)
v_count = Slider(10, range=0..1200)
divide_domain² = DivideDomain²(Domain=loft, UCount=u_count, VCount=v_count)
isotrim = Isotrim(Surface=loft, Domain=divide_domain²)
deconstruct_brep = DeconstructBrep(Brep=isotrim)  # -> Faces, Edges, Vertices
list_item = ListItem(List=deconstruct_brep.Vertices, Index="1", Wrap=True)
list_item_2 = ListItem(List=deconstruct_brep.Vertices, Index="0", Wrap=True)
list_item_3 = ListItem(List=deconstruct_brep.Vertices, Index="3", Wrap=True)
list_item_4 = ListItem(List=deconstruct_brep.Vertices, Index="2", Wrap=True)
vertical_line = Line(StartPoint=list_item_2, EndPoint=list_item)
vertical_line_end = Line(StartPoint=list_item_4, EndPoint=list_item_3)
diagonal_left = Line(StartPoint=list_item, EndPoint=list_item_3)
diagonal_left_2 = Line(StartPoint=list_item_2, EndPoint=list_item_4)
horizontal_lines = Line(StartPoint=list_item, EndPoint=list_item_4)

number_slider = Slider(0.624, range=0..1)
horizontal_lines_2 = Line(StartPoint=list_item_2, EndPoint=list_item_3)
pipe = Pipe(
    Curve=[vertical_line_end, vertical_line, diagonal_left, horizontal_lines, diagonal_left_2, horizontal_lines_2],
    Radius=Slider(0.122, range=0..1),
    Caps=0)
rectangle = Rectangle(Plane=PlaneXY(0, 0, 0), XSize=number_slider, YSize=number_slider, Radius=Slider(0.122, range=0..1))  # -> Rectangle, Length
sweep1 = Sweep1(Rail=horizontal_lines_2, Sections=rectangle.Rectangle, Miter=1)
line = Line([vertical_line_end, horizontal_lines_2, vertical_line, diagonal_left, horizontal_lines, diagonal_left_2])
