# Grasshopper definition CFIIT_Grasshopper Tutorial 03_Image Sampling.gh (Grasshopper 0.9.56)

x_size = Slider(1288, range=0..3000)
y_size = Slider(1555, range=0..3000)
xy_plane = XYPlane(Origin=Point(0, 0, 0))
rectangle = Rectangle(Plane=xy_plane, XSize=x_size, YSize=y_size, Radius=0)  # -> Rectangle, Length
x_size_2 = Slider(203, range=0..3000)
y_size_2 = Slider(300, range=0..3000)
boundary_surfaces = BoundarySurfaces(Edges=rectangle.Rectangle)
divide_surface = DivideSurface(Surface=boundary_surfaces, UCount=x_size_2, VCount=y_size_2)  # -> Points, Normals, Parameters
multiplication = Multiplication(A=x_size_2, B="2")
multiplication_2 = Multiplication(A=y_size_2, B="2")
image_sampler = ImageSampler(
    divide_surface.Points,
    FilePath="C:\Users\Craig Forneris\Desktop\GH Workshop\Forneris_Headshot_Inverted.jpg",
    Interpolate=False,
    Wrap=0,
    Umin=1,
    Umax=1288,
    Vmin=1,
    Vmax=1555,
    Filter="Value")
panel = Panel(multiplication)
panel_2 = Panel(multiplication_2)
division = Division(A=x_size, B=panel)
division_2 = Division(A=y_size, B=panel_2)
panel_3 = Panel(image_sampler)
panel_4 = Panel(division)
panel_5 = Panel(division_2)
x_size_3 = Slider(73, range=0..3000)
minimum = Minimum(A=panel_4, B=panel_5)
multiplication_3 = Multiplication(A=panel_3, B=minimum)
circle_cnr = CircleCNR(Center=divide_surface.Points, Normal=Vector(0, 0, 1), Radius=multiplication_3)
int = Integer(1)
larger = LargerThan(FirstNumber=circle_cnr, SecondNumber=int)  # -> LargerThan, OrEqualTo
cull = CullPattern(List=circle_cnr, CullPattern=larger.LargerThan)  # -> flatten(List)
