# Grasshopper definition CirclePacking-01.gh (Grasshopper 1.0.7)
# plug-ins: Kangaroo2 Components

radius = Slider(2.81, range=0..5)
reset = Button()
no_of_circles = Panel("5")
crv = Curve(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)
neg = Negative(Value=radius)
offset = Offset(Curve=crv, Distance=neg, Plane=PlaneXY(0, 0, 0), Corners=1)
boundary = BoundarySurfaces(Edges=offset)
R = Radius(radius)
popgeo = PopulateGeometry(Geometry=boundary, Count=no_of_circles, Seed=Slider(207, range=0..1000))
sc = SphereCollide(Points=popgeo, Radius=R, Strength=1)
onmesh = OnMesh(Points=popgeo, Mesh=boundary, Strength=1)
solver = Solver(GoalObjects=[onmesh, sc], Reset=reset, Threshold=1e-15, Tolerance=0.01, On=True)  # -> I, V, O
cir = Circle(Plane=solver.V, Radius=R)
