# Grasshopper definition CirclePacking-02.gh (Grasshopper 1.0.7)
# plug-ins: Kangaroo2 Components

number_slider = Slider(1.43, range=0..10)
N = Slider(709, range=0..1000)
seed = Slider(345, range=0..1000)
settings_custom = SettingsCustom(
    StitchSeams=True,
    SimplePlanes=False,
    Refine=True,
    MinCount=16,
    MaxCount=400,
    AspectRatio=20,
    MaxDistance=0,
    MaxAngle=20,
    MinEdge=number_slider,
    MaxEdge=number_slider)
surface = Surface(reparameterize(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))
rad = Slider(1.33, range=0.25..5.5)
populate_geometry = PopulateGeometry(Geometry=surface, Count=N, Seed=seed)
mesh_brep = MeshBrep(Brep=surface, Settings=settings_custom)
spherecollide = SphereCollide(Points=populate_geometry, Radius=rad, Strength=1)
onmesh = OnMesh(Points=populate_geometry, Mesh=mesh_brep, Strength=1)
solver = Solver(GoalObjects=[onmesh, spherecollide], Reset=Button(), Threshold=1e-15, Tolerance=0.01, On=True)  # -> I, V, O
point = Point(solver.V)
surface_closest_point = SurfaceClosestPoint(Point=point, Surface=simplify(surface))  # -> Point, UVPoint, Distance
evaluate_surface = EvaluateSurface(Surface=surface, Point=surface_closest_point.UVPoint)  # -> Point, Normal, UDirection, VDirection, Frame
circle = Circle(Plane=evaluate_surface.Frame, Radius=rad)
