# Grasshopper definition DEmo_ReinsertEmptyBranches.gh (Grasshopper 1.0.7)
# plug-ins: treesloth01

# Reinsert Empty Branches
brep = Brep(Tree({0;0}: [], {0;1}: [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], {0;2}: [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], {0;3}: [], {0;4}: [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]))
Z = UnitZ(Factor=1)
contour = Contour(Shape=brep, Point=Point(0, 0, 0), Direction=Vector(0, 0, 1), Distance=Z)
pshift = ShiftPaths(Data=contour, Offset=-2)

null = CreateNullValue()
short = ShortestList(ListA=null, ListB=brep, TrimMode=2)  # -> ListA, ListB
clean = CleanTree(RemoveNulls=True, RemoveInvalid=True, RemoveEmpty=False, Tree=short.ListA)  # -> simplify(Tree)

number_slider = Slider(0, range=0..100)
box = EvaluateBox(Box=pshift, UParameter=number_slider, VParameter=number_slider, WParameter=0.5)  # -> Plane, Point, Include
box_2 = EvaluateBox(Box=brep, UParameter=0.5, VParameter=0.5, WParameter=0.5)  # -> Plane, Point, Include
merge = Merge(Data1=box.Point, Data2=clean)
data = Data(simplify(box.Point))
data_2 = Data(simplify(box_2.Point))
add_unmatched = AddUnmatched(Data0=data_2, Data1=data, nullPath=False)  # -> Data0, Data1
ln = Line(StartPoint=box_2.Point, EndPoint=box.Point)
ln_2 = Line(StartPoint=box_2.Point, EndPoint=merge)
ln_3 = Line(StartPoint=add_unmatched.Data0, EndPoint=add_unmatched.Data1)

# ==== cluster CreateNullValue: Creates a null value
box = Box("object")
box_2 = ClusterOutput(box)
