# Grasshopper definition DataDrvenDesign_GameOFLife.gh (Grasshopper 1.0.7)
# plug-ins: Anemone

# ---- group: pattern of the game
number_slider = Slider(43.5, range=0..100)
number_slider_2 = Slider(33.89, range=0..100)
number_slider_3 = Slider(9, range=0..100)
number_slider_4 = Slider(9, range=0..100)
pt = ConstructPoint(XCoordinate=number_slider_2, YCoordinate=number_slider_2, ZCoordinate=0)
pt_2 = ConstructPoint(XCoordinate=Slider(39.83, range=0..100), YCoordinate=Slider(45.5, range=0..100), ZCoordinate=0)
pt_3 = ConstructPoint(XCoordinate=Slider(9.5, range=0..100), YCoordinate=Slider(35.5, range=0..100), ZCoordinate=0)
rectangle = Rectangle(Plane=pt, XSize=Slider(31, range=0..100), YSize=Slider(11, range=0..100), Radius=0)  # -> Rectangle, Length
rectangle_2 = Rectangle(Plane=pt_2, XSize=number_slider_3, YSize=number_slider_3, Radius=0)  # -> Rectangle, Length
rectangle_3 = Rectangle(Plane=pt_3, XSize=number_slider_4, YSize=number_slider_4, Radius=0)  # -> Rectangle, Length

# ----
number_slider_5 = Slider(10, range=0..10)
series = Series(Start=0, Step=number_slider_5, Count=Slider(15, range=0..100))
pt_4 = ConstructPoint(XCoordinate=graft(series), YCoordinate=series, ZCoordinate=0)
incurves = PointInCurves(Point=pt_4, Curves=[rectangle.Rectangle, rectangle_3.Rectangle, rectangle_2.Rectangle])  # -> Relationship, Index, Point
multiplication = Multiplication(A=number_slider_5, B=Slider(0.3, range=0..1))
circle = CircleCNR(Center=pt_4, Normal=Vector(0, 0, 1), Radius=multiplication)
division = Division(A=incurves.Relationship, B="2")
int = Integer(division)
cloud = CloudDisplay(Points=circle, Colours=ColourSwatch(SwatchColor=RGB(15, 255, 143)), Size=Slider(4, range=0..10), SpriteType=0)
num = Number(int)
loop_start = LoopStart(N=Slider(10, range=0..10), T=Button(), grid=pt_4, _0_or_1=num)  # -> port, Counter, Data, Data_2
num_2 = Number(simplify(loop_start.Data_2))
tstat = TreeStatistics(Tree=num_2)  # -> Paths, Length, Count
shift = ShiftList(List=tstat.Paths, Shift=1, Wrap=True)
shift_2 = ShiftList(List=tstat.Paths, Shift="-1", Wrap=True)
branch = TreeBranch(Tree=simplify(num_2), Path=shift, MaintainPaths=False)
branch_2 = TreeBranch(Tree=simplify(num_2), Path=shift_2, MaintainPaths=False)
num_3 = Number(graft(branch))
shift_3 = ShiftList(List=branch, Shift="-1", Wrap=True)  # -> graft(List)
shift_4 = ShiftList(List=branch_2, Shift=1, Wrap=True)  # -> graft(List)
shift_5 = ShiftList(List=branch_2, Shift="-1", Wrap=True)  # -> graft(List)
shift_6 = ShiftList(List=branch, Shift=1, Wrap=True)  # -> graft(List)
shift_7 = ShiftList(List=num_2, Shift="-1", Wrap=True)  # -> graft(List)
num_4 = Number(graft(branch_2))
shift_8 = ShiftList(List=num_2, Shift=1, Wrap=True)  # -> graft(List)
merge = Merge(
    Data1=simplify(shift_8),
    Data2=simplify(shift_7),
    Data3=simplify(num_3),
    Data4=simplify(shift_6),
    Data5=simplify(shift_3),
    Data6=simplify(num_4),
    Data7=simplify(shift_4),
    Data8=simplify(shift_5))
ma = MassAddition(Input=merge)  # -> Result, PartialResults
trim = TrimTree(Tree=ma.Result, Depth=1)
num_5 = Number(num_2)

# ---- group: death
smaller = SmallerThan(FirstNumber=trim, SecondNumber=Slider(2, range=0..10))  # -> SmallerThan, OrEqualTo
larger = LargerThan(FirstNumber=trim, SecondNumber=Slider(3, range=0..10))  # -> LargerThan, OrEqualTo
or = GateOr(A=smaller.SmallerThan, B=larger.LargerThan)

# ---- group: birth
smaller_2 = SmallerThan(FirstNumber=trim, SecondNumber=Slider(3, range=0..10))  # -> SmallerThan, OrEqualTo
larger_2 = LargerThan(FirstNumber=trim, SecondNumber=Slider(2, range=0..10))  # -> LargerThan, OrEqualTo
and = GateAnd(A=larger_2.OrEqualTo, B=smaller_2.OrEqualTo)

# ----
lng = ListLength(List=num_5)
lng_2 = ListLength(List=num_5)
repeat = RepeatData(Data="0", Length=lng)
repeat_2 = RepeatData(Data="1", Length=lng_2)
p_n_c = PickNChoose(Pattern=or, Stream0=num_5, Stream1=repeat)
p_n_c_2 = PickNChoose(Pattern=and, Stream0=p_n_c, Stream1=repeat_2)
cull = CullPattern(List=loop_start.Data, CullPattern=p_n_c_2)
loop_end = LoopEnd(
    port=loop_start.port,
    Exit=False,
    Data=loop_start.Data,
    _0Or1=p_n_c_2,
    TimeOutVal=0,
    pausedState=False,
    state="Constant output")  # -> D0, D1
cloud_2 = CloudDisplay(Points=cull, Colours=RGB(255, 20, 147), Size=Slider(8, range=0..10), SpriteType=0)
