# Grasshopper definition DemO_WavyTile.gh (Grasshopper 1.0.7)
# plug-ins: Bifocals, Human

md_slider = MDSlider(
    SliderMode=0,
    slider_value=Point(0.2490818506, 0.1935911061, 0.5),
    x_domain=Domain(0, 1),
    y_domain=Domain(0, 1),
    z_domain=Domain(0, 1))
xz_plane = XZPlane(Origin=Point(0, 0, 0))
number_slider = Slider(13, range=3..16)
md_slider_2 = MDSlider(
    SliderMode=0,
    slider_value=Point(0.6732179257, 0.891928111, 0.5),
    x_domain=Domain(0, 1),
    y_domain=Domain(0, 1),
    z_domain=Domain(0, 1))
plane_surface = PlaneSurface(Plane=xz_plane, XSize=Slider(49.7, range=0..100), YSize=Slider(72.6, range=0..100))
divide_domain² = DivideDomain²(Domain=plane_surface, UCount=Slider(1, range=0..1), VCount=number_slider)
evaluate_surface = EvaluateSurface(Surface=reparameterize(plane_surface), Point=[md_slider, md_slider_2])  # -> Point, Normal, UDirection, VDirection, Frame
isotrim = Isotrim(Surface=plane_surface, Domain=divide_domain²)  # -> reparameterize(Surface)
range = Range(Domain=Domain(0, 1), Steps=Slider(65, range=0..100))
construct_point = ConstructPoint(XCoordinate=range, YCoordinate=0, ZCoordinate=0)  # -> graft(Point)
iso_curve = IsoCurve(Surface=isotrim, UVPoint=construct_point)  # -> UIsocurve, flatten(VIsocurve)
curve = Curve(iso_curve.VIsocurve)
polyline = PolyLine(Vertices=evaluate_surface.Point, Closed=False)
point_on_curve = PointOnCurve(curve, parameter=1)
unit_x = UnitX(Factor=1)
curve_closest_point = CurveClosestPoint(Point=point_on_curve, Curve=polyline)  # -> Point, Parameter, Distance
remap = Remap(data=curve_closest_point.Distance, min=0, max=1)
graph_mapper = GraphMapper(remap, x0=0, x1=1, y0=0, y1=1, container_name="Sine", Equation_px=[0, 0.3788337111], Equation_py=[0, 1])
graph_mapper_2 = GraphMapper(graph_mapper, x0=0, x1=1, y0=0, y1=1, container_name="Bezier", cpx=[0, 0.7642928362, 0.01310221385, 1], cpy=[0, 0, 1, 1])
remap_2 = Remap(data=graph_mapper_2, min=Slider(61, range=0..100), max=Slider(0, range=0..100))
rotate_3d = Rotate3D(Geometry=curve, Angle=expr("-x", degrees(remap_2)), Center=point_on_curve, Axis=unit_x)  # -> Geometry, Transform
partition_list = PartitionList(List=rotate_3d.Geometry, Size=number_slider)
flip_matrix = FlipMatrix(Data=partition_list)
loft = Loft(Curves=flip_matrix, Options={Adjust=False, Closed=False, LoftEnds=0, LoftSimp=0, LoftType=0, Rebuild=10, Refit=0.01})
edges = BrepEdges(Brep=loft)  # -> Naked, Interior, NonManifold
preview = CustomPreview(
    Geometry=loft,
    Material={diffuse=RGB(221, 160, 221), emission=RGB(66, 48, 66), shine=0.5, specular=RGB(255, 255, 255), transparency=0})
previewlw = CustomPreviewLineweights(Geometry=edges.Naked, Shader=ColourSwatch(SwatchColor=RGB(0, 0, 0)), Thickness=Slider(0, range=0..100), Absolute=False)

# ==== cluster Remap: Remaps numbers
data = ClusterInput()
min = ClusterInput()
max = ClusterInput()
bnd = Bounds(Numbers=data)
dom = ConstructDomain(DomainStart=min, DomainEnd=max)
remap = RemapNumbers(Value=data, Source=bnd, Target=dom)  # -> Mapped, Clipped
R = ClusterOutput(remap.Mapped)
