# Grasshopper definition Demo-subdivision.gh (Grasshopper 1.0.7)
# plug-ins: Anemone, Weaverbird

# ----
# Examples
# Triangle input
crv = Curve(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)

# ----
# Mesh input
mesh = Mesh(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)
wbtriangles = WeaverbirdsSplitTrianglesSubdivision(MeshCurves=mesh, Level=1)
m_explode = MeshExplode(M=wbtriangles, N=True)  # -> out, A; inputs M: Mesh
# ---------- m_explode: VB ----------
    Component.Params.Input(0).Name = "Mesh"
    Component.Params.Input(0).Description = "Open or closed mesh"
    Component.Params.Input(1).Name = "Modify Normals"
    Component.Params.Input(1).Description = "An optional boolean that specifies whether vertex normals will be maintained if false or recalculated with the new face"

    Component.Params.Output(1).Name = "Mesh"
    Component.Params.Output(1).Description = "If successful, a list of valid meshes"

    If m IsNot Nothing Then
      Dim i As Integer

      Dim clrB As Boolean
      Dim mshs As New list(Of mesh)
      Dim mf As Rhino.Geometry.Collections.MeshFaceList = Nothing
      Dim mv As Rhino.Geometry.Collections.MeshVertexList = Nothing
      Dim mn As Rhino.Geometry.Collections.MeshVertexNormalList = Nothing
      Dim mc As Rhino.Geometry.Collections.MeshVertexColorList = Nothing

      If m.VertexColors.count() > 0 Then clrB = True Else m.VertexColors.CreateMonotoneMesh(color.White)
      If m.Normals.Count() < 1 Then m.Normals.ComputeNormals()
      mf = m.Faces
      mv = m.Vertices
      mn = m.Normals
      mc = m.VertexColors

      For i = 0 To mf.Count() - 1 Step 1
        Dim pts As New list(Of point3d)
        Dim fc As New meshFace
        Dim clr As New list(Of Color)
        Dim vec As New list(Of Vector3f)
        Dim msh As New mesh

        pts.add(New point3d(mv(mf(i).A)))
        pts.add(New point3d(mv(mf(i).B)))
        pts.add(New point3d(mv(mf(i).C)))
        If mf(i).IsQuad Then pts.add(New point3d(mv(mf(i).D)))

        clr.add(mc(mf(i).A))
        clr.add(mc(mf(i).B))
        clr.add(mc(mf(i).C))
        If mf(i).IsQuad Then clr.add(mc(mf(i).D))

        If N Then
          vec.add(mn(mf(i).A))
          vec.add(mn(mf(i).B))
          vec.add(mn(mf(i).C))
          If mf(i).IsQuad Then vec.add(mn(mf(i).D))
        End If

        If mf(i).IsQuad Then fc = New meshFace(0, 1, 2, 3) Else fc = New meshface(0, 1, 2)

        msh.Vertices.AddVertices(pts.toarray())
        msh.Faces.AddFace(fc)
        If clrB Then msh.VertexColors.AppendColors(clr.toarray())
        If N Then msh.Normals.AddRange(vec.toarray()) Else msh.Normals.ComputeNormals()
        mshs.add(msh)
      Next

      A = mshs
    End If
# ---------- end m_explode ----------
medges = MeshEdges(Mesh=m_explode.A)  # -> simplify(NakedEdges), InteriorEdges, NonManifoldEdges
join = JoinCurves(Curves=medges.NakedEdges, Preserve=False)

# ----
# Surface input
srf = Surface(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)
mesh_uv = MeshSurface(Surface=srf, UCount=5, VCount=5, Overhang=True, Equalize=False)
wbtriangles_2 = WeaverbirdsSplitTrianglesSubdivision(MeshCurves=mesh_uv, Level=1)
m_explode_2 = MeshExplode(M=wbtriangles_2, N=True)  # -> out, A; inputs M: Mesh; same code as m_explode
medges_2 = MeshEdges(Mesh=m_explode_2.A)  # -> simplify(NakedEdges), InteriorEdges, NonManifoldEdges
join_2 = JoinCurves(Curves=medges_2.NakedEdges, Preserve=False)

Z = UnitZ(Factor=Slider(4, range=0..5))

# ----
# L O O P
fastloopstart = FastLoopStart(Iterations=Slider(1, range=0..3), Data=crv)  # -> port, Counter, Data

data = Data(simplify(fastloopstart.Data))
explode = Explode(Curve=data, Recursive=True)  # -> simplify(Segments), simplify(Vertices)
area = Area(Geometry=data)  # -> Area, simplify(graft(Centroid))
move = Move(Geometry=area.Centroid, Motion=Z)  # -> Geometry, Transform
ln = Line(StartPoint=move.Geometry, EndPoint=explode.Vertices)  # -> simplify(Line)
item = ListItem(List=simplify(explode.Segments), Index=0, Wrap=True)  # -> simplify(Item), simplify(Item1), simplify(Item2)
item_2 = ListItem(List=simplify(ln), Index=0, Wrap=True)  # -> Item, Item1, Item2
join_3 = JoinCurves(Curves=simplify([item.Item1, item_2.Item1, item_2.Item2]), Preserve=False)  # -> flatten(Curves)
join_4 = JoinCurves(Curves=simplify([item.Item2, item_2.Item2, item_2.Item]), Preserve=False)  # -> flatten(Curves)
join_5 = JoinCurves(Curves=simplify([item.Item, item_2.Item, item_2.Item1]), Preserve=False)  # -> flatten(Curves)
data_2 = Data([join_5, join_3, join_4])

fastloopend = FastLoopEnd(port=fastloopstart.port, Exit=False, Data=data_2, RecordData=False, TimeOutVal=0)

boundary = BoundarySurfaces(Edges=fastloopend)
preview = CustomPreview(Geometry=boundary, Material=ColourSwatch(SwatchColor=RGB(168, 49, 49)))
