# Grasshopper definition Demo_Controlled_Motion.gh (Grasshopper 1.0.7)
# plug-ins: MeshEdit Components

number_slider = Slider(10, range=0..20)
pt = ConstructPoint(XCoordinate=0, YCoordinate=0, ZCoordinate=0)
multiplication = Multiplication(A=number_slider, B=2)
box = CenterBox(Base=pt, X=number_slider, Y=number_slider, Z=number_slider)
sph = Sphere(Base=pt, Radius=multiplication)
smesh = SimpleMesh(Brep=box)
popgeo = PopulateGeometry(Geometry=sph, Count=Slider(500, range=0..1000), Seed=1)
meshnormalize = MeshNormalize(mesh=smesh)  # -> out, A; inputs mesh: Mesh
# ---------- meshnormalize: C# ----------
    if(mesh != null){
      mesh.Normals.ComputeNormals();

      A = mesh;
    }
# ---------- end meshnormalize ----------
vec2pt = Vector2Pt(PointA=pt, PointB=popgeo, Unitize=False)  # -> Vector, Length
unit = UnitVector(Vector=vec2pt.Vector)
orient = OrientDirection(Geometry=meshnormalize.A, PointA=Point(0, 0, 0), DirectionA=Vector(0, 0, 1), PointB=Point(0, 0, 0), DirectionB=unit)  # -> Geometry, Transform
pl = PlaneNormal(Origin=pt, ZAxis=vec2pt.Vector)
deplane = DeconstructPlane(Plane=pl)  # -> Origin, XAxis, YAxis, ZAxis
amp = Amplitude(Vector=vec2pt.Vector, Amplitude=Slider(168.2, range=0..200))
move = Move(Geometry=orient.Geometry, Motion=amp)  # -> Geometry, Transform
graft = GraftTree(Tree=move.Geometry, IncludeEmptyLists=True, IncludeNullItems=True)
lng = ListLength(List=graft)
dup = DuplicateData(Data=Slider(50, range=0..50), Number=lng, Order=True)  # -> simplify(Data)
graft_2 = GraftTree(Tree=vec2pt.Vector, IncludeEmptyLists=True, IncludeNullItems=True)
series = Series(Start=0, Step=dup, Count=Slider(50, range=0..100))
amp_2 = Amplitude(Vector=graft_2, Amplitude=series)
bnd = Bounds(Numbers=series)
remap = RemapNumbers(Value=series, Source=bnd, Target=Domain(0, 1))  # -> Mapped, Clipped
move_2 = Move(Geometry=graft, Motion=amp_2)  # -> Geometry, Transform
graph = GraphMapper(remap.Mapped, x0=0, x1=1, y0=0, y1=1, container_name="Sine", Equation_px=[0, 0.502904892], Equation_py=[0, 0.3931733966])
area = MeshArea(Mesh=move_2.Geometry)  # -> Area, simplify(Centroid)
series_2 = Series(Start=0, Step=dup, Count=Slider(10, range=0..100))
dom = ConstructDomain(DomainStart=Slider(500, range=0..500), DomainEnd=Slider(0, range=-200..0))
rad = Radians(Degrees=series_2)
dom_2 = ConstructDomain(DomainStart=Slider(1, range=0..1), DomainEnd=Slider(3.5, range=0..10))
bnd_2 = Bounds(Numbers=graph)
remap_2 = RemapNumbers(Value=graph, Source=bnd_2, Target=dom_2)  # -> Mapped, Clipped
remap_3 = RemapNumbers(Value=graph, Source=bnd_2, Target=dom)  # -> simplify(Mapped), Clipped
vec = Vector(graft(deplane.XAxis))
scale = Scale(Geometry=move_2.Geometry, Center=area.Centroid, Factor=remap_2.Mapped)  # -> Geometry, Transform
amp_3 = Amplitude(Vector=vec, Amplitude=remap_3.Mapped)
move_3 = Move(Geometry=scale.Geometry, Motion=amp_3)  # -> Geometry, Transform
rot3d = Rotate3D(Geometry=move_3.Geometry, Angle=rad, Center=area.Centroid, Axis=simplify(graft(vec2pt.Vector)))  # -> simplify(Geometry), Transform
gradient = Gradient(
    LowerLimit=0,
    UpperLimit=1,
    Parameter=remap.Mapped,
    stops=[0: RGB(219, 41, 148), 0: RGB(212, 188, 43), 0: RGB(62, 34, 182), 0: RGB(226, 227, 113), 0: RGB(189, 92, 171), 0.0432: RGB(232, 211, 16), 0.347: RGB(220, 0, 40), 0.697: RGB(255, 89, 0), 1: RGB(253, 255, 135)])
preview = CustomPreview(Geometry=rot3d.Geometry, Shader=gradient)
