# Grasshopper definition Demo_GraphMapperSurface.gh (Grasshopper 1.0.7)
# plug-ins: MeshEdit Components, Weaverbird

number_slider = Slider(50, range=0..100)
number_slider_2 = Slider(59, range=0..100)
dom = ConstructDomain(DomainStart=0, DomainEnd=1)
range = Range(Domain=dom, Steps=number_slider_2)
range_2 = Range(Domain=number_slider, Steps=number_slider_2)
division = Division(A=number_slider, B=Slider(2.1459, range=2..5))
graph = GraphMapper(
    range,
    x0=0,
    x1=1,
    y0=0,
    y1=1,
    container_name="Sine Summation",
    Equation0_px=[0.1279961616, 0.411244601],
    Equation0_py=[0.2832523584, 0.3950713873],
    Equation1_px=[0.6027716994, 0.9],
    Equation1_py=[0.2805013061, 0.5])
crossref = CrossReference(ListA=range_2, ListB=range_2, CrossMode=1)  # -> ListA, ListB
addition = Addition(A=number_slider_2, B=1)
graph_2 = GraphMapper(
    range,
    x0=0,
    x1=1,
    y0=0,
    y1=1,
    container_name="Sine Summation",
    Equation0_px=[0.1350329965, 0.5080587864],
    Equation0_py=[0.4487999678, 0.2939532399],
    Equation1_px=[0.5311565399, 0.8920806646],
    Equation1_py=[0.1360353231, 0.07109135389])
crossref_2 = CrossReference(CrossMode=1)  # -> ListA, ListB
crossref_3 = CrossReference(ListA=graph, ListB=graph_2, CrossMode=1)  # -> ListA, ListB
number_slider_3 = Slider(11, range=0..1000)
multiplication = Multiplication(A=crossref_3.ListA, B=crossref_3.ListB)
multiplication_2 = Multiplication(A=multiplication, B=division)
pt = ConstructPoint(XCoordinate=crossref.ListA, YCoordinate=crossref.ListB, ZCoordinate=multiplication_2)
srfgrid = SurfaceFromPoints(Points=pt, UCount=addition, Interpolate=False)
frompoints = MeshFromPoints(Points=pt, UDirection=addition, VDirection=addition)
wbedges = WeaverbirdsMeshEdges(MeshOrPolylines=frompoints)
