# Grasshopper definition Demo_Inside.gh (Grasshopper 0.9.76)

pt = Point([Point(0, 0, 0), Point(0, 1, 0), Point(0, 2, 0), Point(0, 3, 0), Point(0, 4, 0), Point(0, 5, 0)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])
crv = Curve(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)
rectangle = Rectangle(Plane=pt, XSize=Slider(0.679, range=0..1), YSize=Slider(0.25, range=0..1), Radius=0)  # -> Rectangle, Length

# ---- group: Test if center is inside
pcen = PolygonCenter(Polyline=rectangle.Rectangle)  # -> CenterV, CenterE, CenterA
incurve = PointInCurve(Point=pcen.CenterV, Curve=crv)  # -> Relationship, Point
equals = Equality(FirstNumber=incurve.Relationship, SecondNumber="2")  # -> Equality, Inequality
cull = CullPattern(List=rectangle.Rectangle, CullPattern=equals.Equality)

# ---- group: Then test if intersects boundary
ccx = CurveCurve(CurveA=crv, CurveB=cull)  # -> Points, ParamsA, ParamsB
tstat = TreeStatistics(Tree=ccx.Points)  # -> Paths, Length, Count
equals_2 = Equality(FirstNumber=tstat.Length, SecondNumber="0")  # -> Equality, Inequality
cull_2 = CullPattern(List=cull, CullPattern=equals_2.Equality)
