# Grasshopper definition Demo_Isopotentiallinescreator.gh (Grasshopper 1.0.7)

panel = Panel("                                  Negative charge")
# Part_2: Into this part is possible to define what kind of magnetic charge influence the field
panel_2 = Panel("                                  Positive charge")
toggle = BooleanToggle(False)
# Edit_2
# You can change the charge sign by double click on the toggle: True stays for Positive (charge) and False stays for Negative (charge)
toggle_2 = BooleanToggle(True)
# Part_1: Into this part the field is turned into a point grid
# Edit_1
# You can use this controller to refine the point grid
density = Slider(21, range=2..30)
weave = Weave(Pattern=toggle_2, Stream0=panel, Stream1=panel_2, NullGaps=False)
weave_2 = Weave(Pattern=toggle, Stream0=panel, Stream1=panel_2, NullGaps=False)
charge_type_2 = Point([Point(6.152511292, 17.26507515, 0), Point(16.54867651, 17.16111349, 0), Point(16.44471486, 6.660986625, 0), Point(6.776281205, 6.972871582, 0)])
# Input_2
# Points that represent charges
charge_type_1 = Point([Point(0, 24, 0), Point(24, 24, 0), Point(24, 0, 0), Point(0, 0, 0)])
# Input_1
# Surface that defines a field
srf = Surface(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)
sdivide = DivideSurface(Surface=srf, UCount=density, VCount=density)  # -> Points, Normals, Parameters
tag = TextTag(Location=charge_type_1, Text=weave)
tag_2 = TextTag(Location=charge_type_2, Text=weave_2)
graft = GraftTree(Data=sdivide.Points, Strip=False)
# Edit_3
# You can amplify the intensity of each tipe of charge
gate = StreamGate(Stream=graft, Gate=toggle_2)  # -> Target0, Target1
gate_2 = StreamGate(Stream=charge_type_1, Gate=toggle_2)  # -> Target0, Target1
gate_3 = StreamGate(Stream=graft, Gate=toggle)  # -> Target0, Target1
gate_4 = StreamGate(Stream=charge_type_2, Gate=toggle)  # -> Target0, Target1
intensity_amplifier_1 = Slider(1, range=1..20)
# Part_3: Into this part GH evaluates the attractors' influence on each point and proivde to assign singular magnetic-like displacements
intensity_amplifier_2 = Slider(1, range=1..20)
f_x = F1(Function="x+1", X=density)
vec2pt = Vector2Pt(PointA=[gate.Target1, gate_2.Target0], PointB=[gate_2.Target1, gate.Target0], Unitize=False)  # -> Vector, Length
vec2pt_2 = Vector2Pt(PointA=[gate_3.Target1, gate_4.Target0], PointB=[gate_4.Target1, gate_3.Target0], Unitize=False)  # -> Vector, Length
div = Division(FirstNumber=intensity_amplifier_1, SecondNumber=vec2pt.Length)
div_2 = Division(FirstNumber=intensity_amplifier_2, SecondNumber=vec2pt_2.Length)
amp = Amplitude(Vector=vec2pt.Vector, Amplitude=div)
amp_2 = Amplitude(Vector=vec2pt_2.Vector, Amplitude=div_2)
massadd = MassAddition(Vectors=amp, Unitize=True)
massadd_2 = MassAddition(Vectors=amp_2, Unitize=True)
# Edit_4
# You can amplify the intensity of the final vectors' list
general_amplifier = Slider(1, range=1..20)
vadd = Addition(VectorA=massadd, VectorB=massadd_2, Unitize=False)  # -> Vector, Length
flatten = FlattenTree(Tree=vadd.Length, Path="{0}")
mult = Multiplication(FirstNumber=flatten, SecondNumber=general_amplifier)
Z = UnitZ(Factor=1)
vmul = Multiply(Vector=Z, Factor=mult)  # -> Vector, Length
# Edit_5
# You can use this controller to define the density of isopotential curves
slider = Slider(36, range=1..200)
graft_2 = GraftTree(Data=vmul.Vector, Strip=False)
# Part_4: Into this part thedefinition avails the point grid in order to generate isopotential-like curves, which represent a new way to conceive the field introduced as input
move = Move(Geometry=graft, Translation=graft_2)
flatten_2 = FlattenTree(Tree=move, Path="{0}")
srfgrid = SurfaceFromPoints(Points=flatten_2, UCount=f_x, Interpolate=False)
box_corners = BoxCorners(Box=srfgrid)  # -> CornerA, CornerB, CornerC, CornerD, CornerE, CornerF, CornerG, CornerH
pcomp = Deconstruct(Point=box_corners.CornerA)  # -> XComponent, YComponent, ZComponent
pcomp_2 = Deconstruct(Point=box_corners.CornerH)  # -> XComponent, YComponent, ZComponent
dom = ConstructDomain(DomainStart=pcomp.ZComponent, DomainEnd=pcomp_2.ZComponent)
range = Range(Domain=dom, Steps=slider)
pt = ConstructPoint(XCoordinate=0, YCoordinate=0, ZCoordinate=range)
xy = XYPlane(Origin=pt)
sec = BrepPlane(Brep=srfgrid, Plane=xy)  # -> Curves, Points
