# Grasshopper definition Demo_MazeOnSurface.gh (Grasshopper 1.0.7)

number_slider = Slider(76, range=0..100)

# ---- group: GET A PNG AND LIVE TRACE FROM ILLUSTRATOR MAKE SURFACE THEN PLUG HERE
srf = Surface(<surface referenced from the Rhino model>)

# ----
boundary = BoundarySurfaces(Edges=srf)
divide = DivideDomain²(Domain=boundary, UCount=number_slider, VCount=number_slider)
subsrf = Isotrim(Surface=boundary, Domain=divide)
debrep = DeconstructBrep(Brep=subsrf)  # -> Faces, Edges, Vertices
sdivide = DivideSurface(Surface=subsrf, UCount=1, VCount=1)  # -> Points, Normals, Parameters
geo = Geometry(debrep.Vertices)
geo_2 = Geometry(debrep.Faces)
geo_3 = Geometry(simplify(debrep.Edges))
c_script = CSharpScript(edges=geo_3, rows=number_slider, columns=number_slider)  # -> out, A; inputs edges: tree of Curve, rows: Int32, columns: Int32
# ---------- c_script: C# ----------
    var listExport = new List<Curve>();
    var grid = new Grid(rows, columns);
    grid.Generate();


    Print((edges.BranchCount).ToString());
    int counter = 0;
    for (int x = 0; x < rows; x++){
      for (int y = 0; y < columns; y++){


        //Print(" " + x.ToString() + "," + y.ToString() + "  " + ((Grid.Directions) (grid.Cells[y, x])).ToString());
        //var n = ((Grid.Directions) (grid.Cells[x, y])).HasFlag(Grid.Directions.N) ? "N" : "-";

        var s = ((Grid.Directions) (grid.Cells[x, y])).HasFlag(Grid.Directions.S) ? "S" : "-";
        if( s == "-" && x != (rows - 1) ){
          GH_Path pth = new GH_Path(counter);
          //Print(pth.ToString());
          //Print( (edges.Branch(1)).ToString());
          listExport.Add(edges.Branch(counter)[1]);
        }

        var e = ((Grid.Directions) (grid.Cells[x, y])).HasFlag(Grid.Directions.E) ? "E" : "-";
        if( e == "-" && y != (rows - 1) ){
          GH_Path pth = new GH_Path(counter);
          //Print(pth.ToString());
          //Print( (edges.Branch(1)[1]).ToString());
          listExport.Add(edges.Branch(counter)[2]);
        }


        Print(" " + x.ToString() + "," + y.ToString() + "  " + s + e);
        counter++;
        Print(counter.ToString());
      }
    }

    A = listExport;
# ---------- c_script: C# additional code ----------
  public class Grid
  {

    public enum Directions
    {
      N = 1,
      S = 2,
      E = 4,
      W = 8
    };


    private const int _rowDimension = 0;
    private const int _columnDimension = 1;

    public int MinSize { get; private set; }
    public int MaxSize { get; private set; }
    public int[,] Cells { get; private set; }

    public Grid() : this(3, 3)
    {

    }

    public Grid(int rows, int columns)
    {
      MinSize = 3;
      MaxSize = 10;
      Cells = Initialise(rows, columns);
    }

    public int[,] Initialise(int rows, int columns)
    {
      /*
      if (rows < MinSize)
        rows = MinSize;

      if (columns < MinSize)
        columns = MinSize;

      if (rows > MaxSize)
        rows = MaxSize;

      if (columns > MaxSize)
        columns = MaxSize;
      */

      var cells = new int[rows, columns];

      for (int i = 0; i < rows; i++)
      {
        for (int j = 0; j < columns; j++)
        {
          cells[i, j] = 0;
        }
      }

      return cells;
    }

    private Dictionary<Directions, int> DirectionX = new Dictionary<Directions, int>
      {
        { Directions.N, 0 },
        { Directions.S, 0 },
        { Directions.E, 1 },
        { Directions.W, -1 }
        };

    private Dictionary<Directions, int> DirectionY = new Dictionary<Directions, int>
      {
        { Directions.N, -1 },
        { Directions.S, 1 },
        { Directions.E, 0 },
        { Directions.W, 0 }
        };

    private Dictionary<Directions, Directions> Opposite = new Dictionary<Directions, Directions>
      {
        { Directions.N, Directions.S },
        { Directions.S, Directions.N },
        { Directions.E, Directions.W },
        { Directions.W, Directions.E }
        };

    public int[,] Generate()
    {
      var cells = Cells;
      CarvePassagesFrom(0, 0, ref cells);
      return cells;
    }

    public void CarvePassagesFrom(int currentX, int currentY, ref int[,] grid)
    {
      var directions = new List<Directions>
        {
          Directions.N,
          Directions.S,
          Directions.E,
          Directions.W
          }
        .OrderBy(x => Guid.NewGuid());

      foreach (var direction in directions)
      {
        var nextX = currentX + DirectionX[direction];
        var nextY = currentY + DirectionY[direction];

        if (IsOutOfBounds(nextX, nextY, grid))
          continue;

        if (grid[nextY, nextX] != 0) // has been visited
          continue;

        grid[currentY, currentX] |= (int) direction;
        grid[nextY, nextX] |= (int) Opposite[direction];

        CarvePassagesFrom(nextX, nextY, ref grid);
      }
    }

    private bool IsOutOfBounds(int x, int y, int[,] grid)
    {
      if (x < 0 || x > grid.GetLength(_rowDimension) - 1)
        return true;

      if (y < 0 || y > grid.GetLength(_columnDimension) - 1)
        return true;

      return false;
    }

    public void consolePrint(int[,] grid)
    {
      var rows = grid.GetLength(_rowDimension);
      var columns = grid.GetLength(_columnDimension);

      // Top line
      Console.Write(" ");
      for (int i = 0; i < columns; i++)
        Console.Write(" _");
      Console.WriteLine();

      for (int y = 0; y < rows; y++)
      {
        Console.Write(" |");

        for (int x = 0; x < columns; x++)
        {
          var directions = (Directions) grid[y, x];

          var s = directions.HasFlag(Directions.S) ? " " : "_";

          Console.Write(s);

          s = directions.HasFlag(Directions.E) ? " " : "|";

          Console.Write(s);
        }

        Console.WriteLine();
      }
    }
  }
# ---------- end c_script ----------
panel = Panel(geo_3)
area = Area(Geometry=geo_2)  # -> Area, Centroid
viewer = ParamViewer(geo_3)
crv = Curve(c_script.A)
join = JoinCurves(Curves=crv, Preserve=False)  # -> flatten(Curves)
split = SplitWithBreps(Curve=crv, Brep=boundary)  # -> Curve, Points
panel_2 = Panel(c_script.out)
item = ListItem(List=split.Curve, Index=0, Wrap=True)
