# Grasshopper definition Demo_Moire Circle.gh (Grasshopper 1.0.7)
# plug-ins: Kangaroo Components

number_slider = Slider(100, range=0..100)
number_slider_2 = Slider(2, range=0..10)
pt = ConstructPoint(XCoordinate=0, YCoordinate=0, ZCoordinate=0)
Y = UnitY(Factor=1)
line = LineSDL(Start=pt, Direction=Y, Length=number_slider)
X = UnitX(Factor=number_slider_2)
extr = Extrude(Base=line, Direction=X)
eval = EvaluateLength(Curve=line, Length="0.5", Normalized=True)  # -> Point, Tangent, Parameter
number_slider_3 = Slider(80, range=0..1000)
timer = Timer(Interval=100, TimerInterval=100, Target=counter)  # disabled
num = Number(number_slider)
counter = Counter(Reset=Toggle(False))
division = Division(A=num, B="2")
multiplication = Multiplication(A=number_slider_2, B=2)
cir = Circle(Plane=eval.Point, Radius=division)
X_2 = UnitX(Factor=division)
multiplication_2 = Multiplication(A=counter, B=Slider(0.1, range=0..1))
series = Series(Start=0, Step=num, Count=Slider(5, range=0..10))
rev = ReverseList(List=series)
mod = Modulus(A=multiplication_2, B=multiplication)
move = Move(Geometry=cir, Motion=X_2)  # -> Geometry, Transform
random = Random(Range="99999", Number="2", Seed=number_slider_3)
item = ListItem(List=rev, Index=0, Wrap=True)
neg = Negative(Value="1")
X_3 = UnitX(Factor=mod)
addition = Addition(A=item, B=num)
X_4 = UnitX(Factor=series)
dom = ConstructDomain(DomainStart=neg, DomainEnd="1")
division_2 = Division(A=addition, B=multiplication)
series_2 = Series(Start=0, Step=multiplication, Count=division_2)
X_5 = UnitX(Factor=series_2)
move_2 = Move(Geometry=extr, Motion=X_5)  # -> Geometry, Transform
swatch = ColourSwatch(SwatchColor=RGB(0, 0, 0))
move_3 = Move(Geometry=move_2.Geometry, Motion=X_3)  # -> Geometry, Transform
move_4 = Move(Geometry=move.Geometry, Motion=X_4)  # -> simplify(Geometry), Transform
area = Area(Geometry=move_4.Geometry)  # -> Area, Centroid
preview = CustomPreview(Geometry=move_3.Geometry, Shader=swatch)
boundary = BoundarySurfaces(Edges=move_4.Geometry)
lng = ListLength(List=boundary)
random_2 = Random(Range=dom, Number=lng, Seed=random)  # -> simplify(Random)
bang = ExplodeTree(Data=random_2)  # -> Branch0, Branch1
scale = Scale(Geometry=move_4.Geometry, Center=area.Centroid, Factor="1/1.5")  # -> Geometry, Transform
vec = VectorXYZ(XComponent=bang.Branch0, YComponent=bang.Branch1, ZComponent=0)  # -> Vector, Length
box_corners = BoxCorners(Box=boundary)  # -> CornerA, CornerB, CornerC, CornerD, CornerE, CornerF, CornerG, CornerH
num_2 = Number(number_slider_2)
graft = GraftTree(Tree=scale.Geometry, IncludeEmptyLists=True, IncludeNullItems=True)  # -> simplify(Tree)
contour = Contour(Shape=boundary, Point=box_corners.CornerA, Direction=vec.Vector, Distance=num_2)  # -> simplify(Contours)
pshift = ShiftPaths(Data=contour, Offset=-1)
random_3 = Random(Range=Domain(0, 1), Number=lng, Seed=number_slider_3)
eval_2 = EvaluateLength(Curve=pshift, Length=random_3, Normalized=True)  # -> simplify(Point), Tangent, Parameter
lng_2 = ListLength(List=eval_2.Point)  # -> expr("x-1", Length)
rad = Radians(Degrees=Slider(45, range=0..100))
range = Range(Domain=rad, Steps=lng_2)
rotate = Rotate(Geometry=pshift, Angle=range, Plane=eval_2.Point)  # -> Geometry, Transform
eval_3 = EvaluateLength(Curve=rotate.Geometry, Length="0.5", Normalized=True)  # -> Point, Tangent, Parameter
scale_2 = Scale(Geometry=rotate.Geometry, Center=eval_3.Point, Factor=Slider(10, range=0..10))  # -> Geometry, Transform
trim = TrimWithRegion(Curve=scale_2.Geometry, Region=graft)  # -> Inside, Outside
pshift_2 = ShiftPaths(Data=trim.Inside, Offset=-1)
partition = PartitionList(List=pshift_2, Size=2)
loft = Loft(Curves=partition, Options={Adjust=False, Closed=False, LoftEnds=0, LoftSimp=0, LoftType=0, Rebuild=10, Refit=0.01})
preview_2 = CustomPreview(Geometry=loft, Shader=swatch)
