# Grasshopper definition Demo_Monalisa Spiral.gh (Grasshopper 1.0.7)

slider = Slider(100, range=1..200)
pixel_resolution_pts = Slider(30000, range=0..100000)
expression = Expression(x=slider, Expression="sqrt(0.5)/x")
division = Division(A=expression, B=10)
series = Series(Start=division, Step=division, Count=expr("x*10", slider))
series_2 = Series(Start=0, Step=expr("pi/5", 0.6283185307), Count=expr("x*10+1", slider))
pt = PointCylindrical(BasePlane="{0.5,0.5,0}", Angle=series_2, Radius=series, Elevation=0)
intcrv = Interpolate(Vertices=pt, Degree=3, Periodic=False, KnotStyle=1)  # -> Curve, Length, Domain
dom = Domain(DomainStart=Slider(0.0002, range=0..0.001), DomainEnd=expr("x*0.9", expression))

plane = PlaneSrf(Plane="{0.5,0.5,-0.01}", XSize=Domain(-0.5, 0.5), YSize=Domain(-0.5, 0.5))
preview = CustomPreview(
    Geometry=plane,
    Shader={diffuse=RGB(0, 0, 0), emission=RGB(0, 0, 0), shine=0.5, specular=RGB(255, 255, 255), transparency=0})

pframes = PerpFrames(Curve=intcrv.Curve, Count=pixel_resolution_pts, Align=True)  # -> Frames, Parameters
pcomp = PlaneComponents(Plane=pframes.Frames)  # -> Origin, XAxis, YAxis, ZAxis
image = ImageSampler(pcomp.Origin, Filter="Value", Interpolate=False, Umax=1, Umin=0, Vmax=1, Vmin=0, Wrap=0)
remap = RemapNumbers(Value=image, Source=Domain(0, 1), Target=dom)  # -> Mapped, Clipped
amp = Amplitude(Vector=pcomp.XAxis, Amplitude=remap.Mapped)
move = Move(Geometry=pcomp.Origin, Motion=expr("-x/2", amp))  # -> Geometry, Transform
move_2 = Move(Geometry=pcomp.Origin, Motion=expr("x/2", amp))  # -> Geometry, Transform
shift = ShiftList(List=move.Geometry, Shift=1, Wrap=False)  # -> graft(List)
shift_2 = ShiftList(List=move_2.Geometry, Shift=1, Wrap=False)  # -> graft(List)
merge = Merge(
    Data1=simplify(graft(move.Geometry)),
    Data2=simplify(graft(move_2.Geometry)),
    Data3=simplify(shift),
    Data4=simplify(shift_2))
tstat = TreeStatistics(Tree=merge)  # -> Paths, Length, Count
expression_2 = Expression(x=tstat.Length, Expression="if(x<4,False, True)")
dispatch = Dispatch(List=tstat.Paths, DispatchPattern=expression_2)  # -> ListA, ListB
quad = MeshQuad(CornerA=0, CornerB=1, CornerC=3, CornerD=2)
branch = TreeBranch(Tree=merge, Path=dispatch.ListA, MaintainPaths=True)
mesh = Mesh(Vertices=branch, Faces=quad)
mjoin = MeshJoin(Meshes=flatten(mesh))
preview_2 = CustomPreview(Geometry=mjoin, Shader=ColourSwatch(SwatchColor=RGB(255, 255, 255)))
