# Grasshopper definition Demo_Motion.gh (Grasshopper 1.0.7)

# ----
# Engine
speed = Slider(0.0363, range=0..3)
rec = DataRecorder(speed, DataLimit=-10, RecordData=True)
ma = MassAddition(Input=rec)  # -> Result, PartialResults

# ----
# Doubleclick to
# pause/run simulation
timer = Timer(Interval=20, TimerInterval=20, Target=rec)

# ----
# Primaryorbit
yz = YZPlane(Origin=Point(0, 0, 0))
cir = Circle(Plane=yz, Radius=1)

num = Number(ma.Result)

# ----
# Generating master plane
panel = Panel("100")
eval = EvaluateCurve(Curve=cir, Parameter=panel)  # -> Point, Tangent, Angle
pl = PlaneNormal(Origin=eval.Point, ZAxis=eval.Tangent)

eval_2 = EvaluateCurve(Curve=cir, Parameter=num)  # -> Point, Tangent, Angle
pl_2 = PlaneNormal(Origin=eval_2.Point, ZAxis=eval_2.Tangent)

# ----
# Secondary orbit
number_slider = Slider(9, range=0..10)
align = AlignPlanes(Planes=pl_2, Master=pl)
cir_2 = Circle(Plane=align, Radius=number_slider)

eval_3 = EvaluateCurve(Curve=reparameterize(cir_2), Parameter=num)  # -> Point, Tangent, Angle

# ----
# Press to remove
# recorded data
rec_2 = DataRecorder(eval_3.Point, DataLimit=-10, RecordData=True)

# ----
# Slice from latestadded item
number_slider_2 = Slider(-42, range=-100..0)
dom = ConstructDomain(DomainStart="-1", DomainEnd=number_slider_2)
abs = Absolute(Value=number_slider_2)
range = Range(Domain=dom, Steps=abs)
item = ListItem(List=rec_2, Index=range, Wrap=True)

# ----
# Creating line between shifted
# pattern and orginal pattern
number_slider_3 = Slider(7, range=0..100)
shift = ShiftList(List=item, Shift=number_slider_3, Wrap=True)
ln = Line(StartPoint=item, EndPoint=shift)

crv = Curve(ln)
