# Grasshopper definition Demo_MovePointAlongCurve.gh (Grasshopper 1.0.7)

crv = Curve(<curve referenced from the Rhino model>)
midpt = CurveMiddle(Curve=crv)

# ---- group: Point On Curve
pt = Point(midpt)

# ----
length = Slider(144, range=0..10000)
length_2 = Slider(4765, range=0..10000)
len = Length(Curve=crv)
crv_cp = CurveClosestPoint(Point=pt, Curve=crv)  # -> Point, Parameter, Distance
panel = Panel(len)
lenp = LengthParameter(Curve=crv, Parameter=crv_cp.Parameter)  # -> Length, Length_2
multiplication = Multiplication(A=length, B=-1)
panel_2 = Panel([lenp.Length, lenp.Length_2])
addition = Addition(A=lenp.Length, B=length)
addition_2 = Addition(A=lenp.Length, B=multiplication)
toggle = BooleanToggle(False)
number_slider = Slider(2, range=0..100)
eval = EvaluateLength(Curve=crv, Length=addition_2, Normalized=toggle)  # -> Point, Tangent, Parameter
eval_2 = EvaluateLength(Curve=crv, Length=addition, Normalized=toggle)  # -> Point, Tangent, Parameter

shatter = Shatter(Curve=crv, Parameters=eval_2.Parameter)
len_2 = Length(Curve=shatter)

shatter_2 = Shatter(Curve=crv, Parameters=eval.Parameter)
len_3 = Length(Curve=shatter_2)

swatch = ColourSwatch(SwatchColor=RGB(255, 255, 255))
dots = DotDisplay(Point=eval_2.Point, Colour=swatch, Size=number_slider)
dots_2 = DotDisplay(Point=eval.Point, Colour=swatch, Size=number_slider)

right_point = Point(eval_2.Point)
left_point = Point(eval.Point)
