# Grasshopper definition Demo_MultipleAttractors.ghx (Grasshopper 1.0.7)

slider = Slider(1.387, range=0..10)
recgrid = Rectangular(Plane=PlaneXY(0, 0, 0), SizeX=slider, SizeY=slider, ExtentX=Slider(56, range=0..100), ExtentY=Slider(36, range=0..100))  # -> Cells, Points
graft = GraftTree(Data=flatten(recgrid.Points), Strip=False)
pt = Point([Point(13.72338745, 28.31636654, 0), Point(55.65059877, 31.07070889, 0), Point(57.79286504, 20.97145361, 0), Point(34.22793605, 11.17823637, 0)])
dist = Distance(PointA=graft, PointB=pt)
graph = GraphMapper(dist, x0=0, x1=20, y0=0, y1=1, container_name="Gaussian", factor=0.7246376872, mean=0, sdev=0.297101438)
ma = MassAddition(Input=graph)  # -> Result, PartialResult
circle = CircleCNR(Center=graft, Normal=Vector(0, 0, 1), Radius=ma.Result)
