# Grasshopper definition Demo_Points Sort On Curve.gh (Grasshopper 1.0.7)

# ----
# Sort Points on Curve
crv = Curve(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)
number_slider = Slider(2.6, range=0..10)

random = Random(Range=Domain(0, 1), Number=Slider(9, range=0..100), Seed=2)
panel = Panel(random)
eval = EvaluateLength(Curve=crv, Length=random, Normalized=True)  # -> Point, Tangent, Parameter
crv_2 = Curve(reparameterize(crv))
pt = Point(eval.Point)
crv_cp = CurveClosestPoint(Point=pt, Curve=crv_2)  # -> Point, Parameter, Distance
sort = SortList(Keys=crv_cp.Parameter, ValuesA=pt)  # -> Keys, ValuesA
unsorted = PointList(Points=pt, Size=number_slider)
sorted = PointList(Points=sort.ValuesA, Size=number_slider)
