# Grasshopper definition Demo_PythonFolding.gh (Grasshopper 1.0.7)

triangle_edge = Slider(53, range=0..70)
# Python Script (folding)
python = GhPythonScript(angle=Slider(10, range=0..70), Triangle_Edge=triangle_edge)  # -> out, a
# ---------- python: Python ----------
import ghpythonlib.components as gh
import Rhino.Geometry as rg
import rhinoscriptsyntax as rs
import math as m

#==============generating lines and points=======
curve1start= gh.ConstructPoint(0, 0, 1.452047)
curve1end = gh.ConstructPoint(-7.062072, 0, 0)
curve1= gh.Line(curve1start , curve1end)
curve2start = curve1start
curve2end = gh.ConstructPoint(-7.062072, -12.231867, 0)
curve2 = gh.Line(curve2start , curve2end)
curve3start = curve1end
curve3end = curve2end
curve3= gh.Line(curve3start , curve3end)
#================================================generating sphere
point = gh.EndPoints(gh.Rotate3D(curve1 ,m.radians(-angle), curve1start , gh.UnitY(1))[0])[1]
sphere = gh.Sphere(point , gh.Length(curve3))
#==================================================circle
circle = gh.Circle(gh.ConstructPlane(curve1start ,curve2, gh.UnitZ(1)) , gh.Length(curve2))
#========================================================intersect
circle = circle.ToNurbsCurve()
intersect = rg.Intersect.Intersection.CurveBrep(circle , sphere, 0.001 , 0.001 )[1]
point1 = gh.EvaluateCurve(circle , intersect[1])[0]
#=============================================
xy = gh.XYPlane(gh.ConstructPoint(0,0,0))
xz=  gh.XZPlane(gh.ConstructPoint(0,0,0))
surface = rg.NurbsSurface.CreateFromCorners(curve1start , point , point1)
both = gh.BrepJoin([gh.Mirror(surface ,xz )[0] , surface])[0]
polar_array = gh.PolarArray(both , xy , 3 ,2*m.pi)[0]
moved = gh.Move(polar_array , gh.UnitZ(-point1[2]))[0]
a = gh.BrepJoin(moved)[0]
#============================================scale
edge = gh.DeconstructBrep(a)[1][-1]
factor = Triangle_Edge/gh.Length(edge)
a = gh.Scale(a , gh.ConstructPoint(0,0,0) , factor)[0]
# ---------- end python ----------
