# Grasshopper definition Demo_RandomGradientScatterPoints.gh (Grasshopper 1.0.7)

number_slider = Slider(100, range=0..100)
number_slider_2 = Slider(1000, range=0..1000)
rectangle = Rectangle(Plane=PlaneXY(0, 0, 0), XSize=number_slider, YSize=number_slider, Radius=0)  # -> Rectangle, Length
pop2d = Populate2D(Region=rectangle.Rectangle, Count=number_slider_2, Seed=1)
pdecon = Deconstruct(Point=pop2d)  # -> XComponent, YComponent, ZComponent
random = Random(Range=Domain(0, 1), Number=number_slider_2, Seed=2)
bnd = Bounds(Numbers=pdecon.XComponent)
remap = RemapNumbers(Value=pdecon.XComponent, Source=bnd, Target=Domain(0, 1))  # -> Mapped, Clipped
graph = GraphMapper(
    remap.Mapped,
    x0=0,
    x1=1,
    y0=0,
    y1=1,
    container_name="Bezier",
    cpx=[0, 0.4012681246, 0.5484601259, 1],
    cpy=[0, 0.1132246256, 1, 1])
smaller = SmallerThan(FirstNumber=graph, SecondNumber=random)  # -> SmallerThan, OrEqualTo
cull = CullPattern(List=pop2d, CullPattern=smaller.SmallerThan)
