# Grasshopper definition Demo_RecursionMotion.gh (Grasshopper 1.0.7)

# ----
# Engine
number_slider = Slider(6, range=0..10)
timer = Timer(Interval=20, TimerInterval=20, Target=rec)
rec = DataRecorder(number_slider, DataLimit=-10, RecordData=True)
ma = MassAddition(Input=rec)  # -> Result, PartialResults

box = CenterBox(Base=PlaneXY(0, 0, 0), X=1, Y=1, Z=1)
rotate = Rotate(Geometry=box, Angle=degrees(ma.Result), Plane=PlaneXY(0, 0, 0))  # -> Geometry, Transform
xz = XZPlane(Origin=Point(0, 0, 0))
rotate_2 = Rotate(Geometry=rotate.Geometry, Angle=degrees(ma.Result), Plane=xz)  # -> Geometry, Transform
yz = YZPlane(Origin=Point(0, 0, 0))
rotate_3 = Rotate(Geometry=rotate_2.Geometry, Angle=degrees(ma.Result), Plane=yz)  # -> Geometry, Transform

number_slider_2 = Slider(0.229, range=0..4)
pt = ConstructPoint(XCoordinate=number_slider_2, YCoordinate=number_slider_2, ZCoordinate=number_slider_2)
yz_2 = YZPlane(Origin=pt)
mirror = Mirror(Geometry=rotate_3.Geometry, Plane=yz_2)  # -> Geometry, Transform

debrep = DeconstructBrep(Brep=rotate_3.Geometry)  # -> Faces, Edges, Vertices
debrep_2 = DeconstructBrep(Brep=mirror.Geometry)  # -> Faces, Edges, Vertices
number_slider_3 = Slider(0.025, range=0..1)
ln = Line(StartPoint=debrep_2.Vertices, EndPoint=debrep.Vertices)
pipe = Pipe(Curve=ln, Radius=number_slider_3, Caps=0)
pipe_2 = Pipe(Curve=[debrep_2.Edges, debrep.Edges], Radius=number_slider_3, Caps=0)
preview = CustomPreview(Geometry=pipe, Material=ColourSwatch(SwatchColor=RGB(212, 212, 38)))
preview_2 = CustomPreview(Geometry=pipe_2, Material=ColourSwatch(SwatchColor=RGB(212, 38, 38)))
