# Grasshopper definition Demo_Rheotomic_Surfaces.gh (Grasshopper 1.0.7)

custom_vectors = Vector([Vector(0, 2, 0), Vector(1, 2, 0), Vector(1, 0, 0)])
linear_flow = MDSlider(
    SliderMode=0,
    slider_value=Point(0.6453130622, 0.2199232584, 0.5),
    x_domain=Domain(-1, 1),
    y_domain=Domain(-1, 1),
    z_domain=Domain(0, 1))
resolution = WidthCount(65)
sources = Point([Point(-5, 2, 0), Point(6, -1, 0)])
linear_flow_on = BooleanToggle(True)
list = ValueList({"Streamlines": 0, "Equipotentials": 1, "Square": 2, "Triangle": 3, "Diagonal 1": 4, "Diagonal 2": 5, "Diagonals 1 + 2": 6, "Square + Diagonals": 7, "Custom": 8}, selected="Square")
movement_r = Slider(0, range=0..1)
sinks = Point([Point(1, -5, 0), Point(-1, 7, 0), Point(6, 6, 0)])
divisions = Slider(16, range=1..50)
movement_i = Slider(0, range=0..1)
# "...to refer just to the scope and to the consistency of complex numbers does not do justice to this system. There is something more which, in my view, can only be described as 'magic'...
# 
# ...Over the four centuries that complex numbers have been known, a great many magical qualities have been gradually revealed.
# 
# 	Yet this is a magic that had been percieved to lie within mathematics, and it indeed provided a utility and a depth of mathematical insight that could not be achieved by use of the reals alone. There had not been any reason to expect that the physical world should be concerned with it.
# 
# 	And for some 350 years from the time that these numbers were introduced through the works of Cardano and Bombelli, it was purely through their mathematical role that the magic of the complex number system was percieved.
# 
# 	It would, no doubt, have come as a great surprise to all those who had voiced their suspicion of complex numbers to find that, according to the physics of the latter three quarters of the 20th century, the laws governing the behaviour of the world, at its tiniest scales, is fundamentally governed by the complex number system."
# 
# from 'The Road to Reality' by Roger Penrose
null = Data()
rheotomic = RheotomicSurface(
    WidthCount=resolution,
    Complex=sources,
    Complex_2=sinks,
    Linear_Flow=linear_flow,
    Linear_On=linear_flow_on,
    Line_Option=list,
    Custom_Dir=custom_vectors,
    Divisions=divisions,
    Number=movement_r,
    Number_2=movement_i,
    WidthCount_2=resolution,
    Complex_3=sources,
    Complex_4=sinks,
    Linear_Flow_2=linear_flow,
    Linear_On_2=linear_flow_on,
    Line_Option_2=list,
    Custom_Dir_2=custom_vectors,
    Divisions_2=divisions,
    Number_3=movement_r,
    Number_4=movement_i,
    Base=PlaneXY(0.5, 0.5, 0),
    Width=Domain(-10, 10),
    Height=Domain(-10, 10),
    WidthCount_3=rheotomic.WidthCount,
    HeightCount=rheotomic.WidthCount,
    Mesh=rheotomic.Mesh,
    Point=rheotomic.Vertices,
    System=PlaneXY(0, 0, 0),
    Real=rheotomic.XComponent,
    Imaginary=rheotomic.YComponent,
    Value=rheotomic.Result,
    Input=[rheotomic.Result, rheotomic.Result],
    XComponent=rheotomic.XComponent,
    YComponent=rheotomic.YComponent,
    ZComponent=rheotomic.Imaginary,
    System_2=PlaneXY(0, 0, 0),
    Complex_5=rheotomic.Result,
    Vertices=rheotomic.Point,
    Faces=rheotomic.Faces,
    Shape=rheotomic.A,
    Point_2=rheotomic.Geometry,
    Direction=Vector(0, 0, 1),
    Distance=rheotomic.Result,
    A=rheotomic.Element,
    B=rheotomic.Integer,
    M=rheotomic.Mesh,
    P=rheotomic.A,
    A_2=rheotomic.Complex,
    B_2=rheotomic.Complex,
    Value_2=rheotomic.Result,
    A_3=rheotomic.Complex,
    B_3=rheotomic.Complex,
    A_4=rheotomic.Complex,
    B_4=rheotomic.Complex,
    A_5=rheotomic.Result,
    B_5=rheotomic.Result,
    A_6=rheotomic.Result,
    B_6=rheotomic.Tree,
    List=rheotomic.Result,
    Index=rheotomic.Boolean,
    Wrap=False,
    Vector=Vector(0, 0, 0),
    Point_3=Point(0, 0, 0),
    Geometry=rheotomic.Point,
    Motion=rheotomic.UnitVector,
    Factor=rheotomic.Result,
    A_7=rheotomic.Real,
    B_7=rheotomic.Number,
    Data=rheotomic.Complex,
    Strip=False,
    Complex_6=rheotomic.Tree,
    X=rheotomic.Real,
    Geometry_2=rheotomic.Contours,
    Plane=PlaneXY(0, 0, 0),
    Curve=rheotomic.Data,
    Data_2=rheotomic.Geometry,
    Offset=-2,
    Vector_2=[Vector(1, 0, 0), Vector(0, 1, 0)],
    Vector_3=[Vector(1, 0, 0), Vector(-0.5, 0.8660254038, 0), Vector(-0.5, -0.8660254038, 0)],
    Tree=rheotomic.Result,
    Path=rheotomic.Integer,
    Branch00=rheotomic.Vector,
    Branch01=rheotomic.Vector,
    Branch02=rheotomic.Vector,
    Branch03=rheotomic.Vector,
    Branch04=rheotomic.Vector,
    Branch05=rheotomic.Vector,
    Branch06=rheotomic.Vector,
    Branch07=rheotomic.Vector,
    Branch08=rheotomic.Vector,
    Vector_4=[Vector(1, 1, 0), Vector(-1, 1, 0)],
    Vector_5=[Vector(1, 0, 0), Vector(1, 1, 0), Vector(0, 1, 0), Vector(-1, 1, 0)],
    Complex_7=rheotomic.Element,
    Complex_8=rheotomic.Branch,
    Keys=flatten(rheotomic.A),
    List_2=rheotomic.Keys,
    Index_2=0,
    Wrap_2=False,
    Complex_9=rheotomic.Complex,
    Complex_10=rheotomic.Complex,
    Mesh_2=flatten(rheotomic.A),
    Vector_6=Vector(1, 0, 0),
    Vector_7=Vector(0, 1, 0),
    Vector_8=Vector(1, 1, 0),
    Vector_9=Vector(-1, 1, 0),
    Geometry_3=rheotomic.Geometry,
    Motion_2=rheotomic.UnitVector,
    Factor_2=rheotomic.Result,
    A_8=rheotomic.Imaginary,
    B_8=rheotomic.Number,
    WidthCount_4=rheotomic.WidthCount,
    Integer=rheotomic.Integer,
    Vector_10=rheotomic.Vector,
    Data1=rheotomic.Vector,
    Data2=rheotomic.Vector,
    Vector_11=rheotomic.Vector,
    Boolean=rheotomic.Boolean,
    Mesh_3=rheotomic.Mesh,
    Curve_2=rheotomic.Curve,
    Integer_2=rheotomic.Integer,
    Number_5=rheotomic.Number,
    Number_6=rheotomic.Number,
    Mesh_4=rheotomic.Mesh,
    Curve_3=rheotomic.Curve,
    A_9=rheotomic.Result,
    B_9=-1,
    InternalDocument_plugin_version=(1, 0, 7),
    InternalDocument_DocumentHeader_PreviewMeshType=1,
    InternalDocument_DocumentHeader_PreviewNormal=RGBA(150, 0, 0, 100),
    InternalDocument_DocumentHeader_PreviewSelected=RGBA(0, 150, 0, 100),
    InternalDocument_DefinitionProperties_Projection_Zoom=0.2621440589,
    InternalDocument_DefinitionObjects_Object32_Container_MaintainPaths=False,
    InternalDocument_DefinitionObjects_Object33_Container_FlattenInputs=True)  # -> Mesh, Curve, Mesh_2, Curve_2
mesh = Mesh(rheotomic.Mesh_2)
crv = Curve(rheotomic.Curve_2)
