# Grasshopper definition Demo_SetTimer.gh (Grasshopper 1.0.7)
# plug-ins: MetaHopper

timer = Timer(Interval=1000, TimerInterval=1000, Target=toggle)  # disabled
objfromgroup = GetObjectsInGroup()

# ---- group: Set Internval
interval_ms = Slider(1000, range=0..1000)
set_timer_interval = CSharpScript(t=objfromgroup, i=interval_ms)  # inputs i: Int32
# ---------- set_timer_interval: C# ----------
    Grasshopper.Kernel.Special.GH_Timer timer = t as Grasshopper.Kernel.Special.GH_Timer;
    timer.Interval = i;
# ---------- end set_timer_interval ----------

# ---- group: Enable/Disable
onoff = EnableDisableObject(Objects=objfromgroup, Enabled=Toggle(False), AllObjects_Object=timer)

# ----
toggle = BooleanToggle(True)
rec = DataRecorder(toggle, DataLimit=-10, RecordData=True)
panel = Panel(rec)
