# Grasshopper definition Demo_ShoptestWalk.gh (Grasshopper 1.0.7)

number_slider = Slider(0.3, range=0..1)
python = GhPythonScript(x=Slider(21, range=0..50), y=Slider(24, range=0..50))  # -> out, a; inputs x: Int32, y: Int32
# ---------- python: Python ----------
import rhinoscriptsyntax as rs

a = []

for i in range(0,x):
    for j in range(0,y):
        myPoint = rs.AddPoint( (i,j,0) )
        a.append(myPoint)
# ---------- end python ----------
pt = ConstructPoint(XCoordinate=Slider(2.084, range=0..50), YCoordinate=Slider(10.157, range=0..50), ZCoordinate=Slider(0, range=0..50))
pt_2 = ConstructPoint(XCoordinate=Slider(15.088, range=0..50), YCoordinate=Slider(19.858, range=0..50), ZCoordinate=Slider(0, range=0..50))
pt_3 = Point([pt, pt_2])
pt_4 = Point(python.a)
sph = Sphere(Base=pt_2, Radius=number_slider)
sph_2 = Sphere(Base=pt_3, Radius=number_slider)
python_2 = GhPythonScript(x=pt_4, y=pt_3)  # -> out, a; inputs x: list of Point3d, y: Point3d
# ---------- python_2: Python ----------
import rhinoscriptsyntax as rs

def closest(list,point):
    return rs.PointArrayClosestPoint(list,point)

b = closest(x,y)
a = x[b]
# ---------- end python_2 ----------
panel = Panel(python_2.a)
pt_5 = Point(python_2.a)
python_3 = GhPythonScript(x=pt_4, y=pt_5, z=Slider(1.5, range=1.5..50))  # -> out, a, b; inputs x: list of Point3d, y: list of Point3d
# ---------- python_3: Python ----------
import rhinoscriptsyntax as rs

def route(str, end, pnts_field):
    pnts_direct = []
    cnt = 0 # failsafe in case we don't find a proper endpoint?
    maxloop = len(pnts_field)
    
    # lets start with str as our current point
    curpt = str
    
    while curpt != end and cnt <= maxloop: # arbitrarily chosen limit, this can likely be done more elegantly
        cnt = cnt + 1
        
        # get all distances to curpt
        distances = rs.Distance(curpt, pnts_field)
        proximities = []
        # loop over all distances
        for i, d in enumerate(distances):
            if d>0 and d <= z:
                # save those who are within z, but not with distance 0 (that'd be curpt)
                proximities.append(pnts_field[i])
        # get the index of the closest point in proximities to end
        cidx = rs.PointArrayClosestPoint(proximities, end)
        
        # get the closest point from proximities
        cp = proximities[cidx]
        if cp != end:
            # not end, so append to pnts_direct
            pnts_direct.append(cp)
        
        # our closest point we found gets the honor of being the new current point
        curpt = cp
    
    # done figuring out a route 
    return pnts_direct

str = y[0]
end = y[-1]

# the picked points in a
a = route(str, end, x)
# start and end in b
b = [str, end]
# ---------- end python_3 ----------
pt_6 = Point(python_3.a)
pt_7 = Point(python_3.b)
flatten_tree = FlattenTree(Tree=[pt_6, pt_7], Path="{0}")  # -> flatten(Tree)
sort_pt = SortPoints(Points=flatten_tree)  # -> Points, Indices
pline = PolyLine(Vertices=sort_pt.Points, Closed=False)
