# Grasshopper definition Demo_SiftandCombine.gh (Grasshopper 1.0.7)
# plug-ins: treesloth01

# Sift and Combine + Flip Last
planesrf = PlaneSurface(Plane=PlaneXY(0, 0, 0), XSize=Domain(-10, 10), YSize=Domain(-10, 10))
sdivide = DivideSurface(Surface=planesrf, UCount=10, VCount=10)  # -> Points, Normals, Parameters
lng = ListLength(List=sdivide.Points)
pshift = ShiftPaths(Data=lng, Offset=-1)
lng_2 = ListLength(List=pshift)
lng_3 = ListLength(List=sdivide.Points)
series = Series(Start=0, Step=1, Count=lng_2)
mod = Modulus(A=series, B=Slider(7, range=0..10))  # -> graft(Result)
range = Range(Domain="0.1 to 1", Steps=expr("x-1", lng_3))
sift = SiftPattern(List=range, SiftPattern=mod)  # -> Output0, Output1, Output2
rev = ReverseList(List=sift.Output2)
jitter = Jitter(List=sift.Output0, Jitter=1, Seed=2)  # -> Values, Indices
combine = CombineData(Input0=jitter.Values, Input1=sift.Output1, Input2=rev)  # -> Result, Index
yz = YZPlane(Origin=sdivide.Points)
cir = Circle(Plane=yz, Radius=combine.Result)
boundary = BoundarySurfaces(Edges=cir)  # -> simplify(Surfaces)
flip_last = FlipLast(Data=boundary)
path_mapper = PathMapper(boundary, source="{A} (i)", target="{i}")
loft = Loft(Curves=flip_last, Options={Adjust=False, Closed=False, LoftEnds=0, LoftSimp=0, LoftType=0, Rebuild=10, Refit=0.01})
panel = Panel(path_mapper)
