# Grasshopper definition Demo_SortAlongCurveCP.gh (Grasshopper 1.0.7)

pop2d = Populate2D(Region={Plane=PlaneXY(0, 0, 0), Size=Domain2(u=0..20, v=0..10)}, Count=100, Seed=1)

# ---- group: Removes InteriorPts
bbox = BoundingBox(Content=pop2d, Plane=PlaneXY(0, 0, 0), UnionBox=True)  # -> Box, Box_2
rec = Rectangle(bbox.Box)
pcen = PolygonCenter(Polyline=rec)  # -> CenterV, CenterE
scale = Scale(Geometry=rec, Center=pcen.CenterV, Factor=Slider(0.76, range=0..1))  # -> Geometry, Transform

# ----
crv = Curve(scale.Geometry)
con = Containment(Point=pop2d, Curve=crv)  # -> Relationship, Point
equals = Equality(FirstNumber=con.Relationship, SecondNumber="0")  # -> Equality, Inequality
cull = CullPattern(List=con.Point, CullPattern=equals.Equality)

# ---- group: Curve To Sort Along
crv_2 = Curve(rec)

# ---- group: Points to Sort
pt = Point(cull)

# ----
crv_cp = CurveCP(Point=pt, Curve=reparameterize(crv_2))  # -> Point, Parameter, Distance
sort = SortList(Keys=crv_cp.Parameter, ValuesA=pt)  # -> Keys, ValuesA, ValuesB
pline = PolyLine(Vertices=sort.ValuesA, Closed=Toggle(True))
