# Grasshopper definition Demo_TabBuilder.gh (Grasshopper 1.0.7)

crv = Curve(graft(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))
tab_builder = TABBUILDER(C_2=crv, C=crv)

# ==== cluster TABBUILDER
C = ClusterInput()
C_2 = ClusterInput()
flip = FlipCurve(Curve=C)  # -> Curve, Flag
offset = OffsetCurve(Curve=C_2, Distance=-1, Plane=PlaneXY(0, 0, 0), Corners=1)
offset_2 = OffsetCurve(Curve=flip.Curve, Distance=-1, Plane=PlaneXY(0, 0, 0), Corners=1)
divide = DivideCurve(Curve=offset, Count=10, Kinks=False)  # -> Points, Tangents, Parameters
cull = CULL(L=divide.Points)
offset_3 = OffsetCurve(Curve=offset_2, Distance=-1, Plane=PlaneXY(0, 0, 0), Corners=1)
offset_4 = OffsetCurve(Curve=offset, Distance=-1, Plane=PlaneXY(0, 0, 0), Corners=1)
crv_cp = CurveClosestPoint(Point=cull, Curve=offset_2)  # -> Point, Parameter, Distance
crv_cp_2 = CurveClosestPoint(Point=crv_cp.Point, Curve=offset_3)  # -> Point, Parameter, Distance
crv_cp_3 = CurveClosestPoint(Point=cull, Curve=offset_4)  # -> Point, Parameter, Distance
vec2pt = Vector2Pt(PointA=crv_cp.Point, PointB=crv_cp_2.Point, Unitize=False)  # -> Vector, Length
vec2pt_2 = Vector2Pt(PointA=cull, PointB=crv_cp_3.Point, Unitize=False)  # -> Vector, Length
orient = OrientDirection(
    Geometry=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,
    PointA=Point(0, 0, 0),
    DirectionA=Vector(0, 1, 0),
    PointB=cull,
    DirectionB=vec2pt_2.Vector)  # -> Geometry, Transform
orient_2 = OrientDirection(
    Geometry=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,
    PointA=Point(0, 0, 0),
    DirectionA=Vector(0, 1, 0),
    PointB=crv_cp.Point,
    DirectionB=vec2pt.Vector)  # -> Geometry, Transform
end = EndPoints(Curve=offset_2)  # -> Start, End
end_2 = EndPoints(Curve=offset)  # -> Start, End
ln = Line(StartPoint=end_2.End, EndPoint=end.Start)
ln_2 = Line(StartPoint=end_2.Start, EndPoint=end.End)
join = JoinCurves(Curves=[offset, offset_2, ln, ln_2], Preserve=False)
runion = RegionUnion(Curves=flatten([join, orient.Geometry, orient_2.Geometry]))
R = ClusterOutput(runion)

# ==== cluster CULL
L = ClusterInput()
cull_i = CullIndex(List=L, Indices=0, Wrap=True)
rev = ReverseList(List=cull_i)
cull_i_2 = CullIndex(List=rev, Indices=0, Wrap=True)
rev_2 = ReverseList(List=cull_i_2)
L_2 = ClusterOutput(rev_2)
