# Grasshopper definition Demo_attractor-triangles.gh (Grasshopper 1.0.7)

md_slider = MDSlider(
    SliderMode=0,
    slider_value=Point(0.9251656717, 0.2304045304, 0.5),
    x_domain=Domain(0, 1),
    y_domain=Domain(0, 1),
    z_domain=Domain(0, 1))
md_slider_2 = MDSlider(
    SliderMode=0,
    slider_value=Point(0.2172065115, 0.5460796854, 0.5),
    x_domain=Domain(0, 1),
    y_domain=Domain(0, 1),
    z_domain=Domain(0, 1))
plane_surface = PlaneSurface(Plane=PlaneXY(0, 0, 0), XSize=Slider(91.1, range=0..100), YSize=Slider(45.4, range=0..100))
N = Slider(7, range=3..10)
dimensions = Dimensions(Surface=plane_surface)  # -> UDimension, VDimension
custom_preview = CustomPreview(Geometry=plane_surface, Material=ColourSwatch(SwatchColor=RGB(53, 192, 59)))
division = Division(A=dimensions.UDimension, B=dimensions.VDimension)
multiplication = Multiplication(A=division, B=N)
evaluate_surface = EvaluateSurface(Surface=reparameterize(plane_surface), Point=[md_slider_2, md_slider])  # -> Point, Normal, UDirection, VDirection, Frame
divide_domain² = DivideDomain²(Domain=plane_surface, UCount=multiplication, VCount=N)
isotrim = Isotrim(Surface=plane_surface, Domain=divide_domain²)
curve = Curve(isotrim)
polygon_center = PolygonCenter(Polyline=curve)  # -> CenterV, CenterE, CenterA
point = Point(evaluate_surface.Point)
closest_point = ClosestPoint(Point=polygon_center.CenterV, Cloud=point)  # -> ClosestPoint, CPIndex, Distance
bounds = Bounds(Numbers=closest_point.Distance)
construct_domain = ConstructDomain(DomainStart=Slider(0.2, range=0..1), DomainEnd=Slider(0.7, range=0..1))
remap_numbers = RemapNumbers(Value=closest_point.Distance, Source=bounds, Target=construct_domain)  # -> Mapped, Clipped
scale = Scale(Geometry=curve, Center=polygon_center.CenterV, Factor=remap_numbers.Mapped)  # -> Geometry, Transform
explode = Explode(Curve=curve, Recursive=True)  # -> Segments, Vertices
explode_2 = Explode(Curve=scale.Geometry, Recursive=True)  # -> Segments, Vertices
point_on_curve = PointOnCurve(explode_2.Segments, parameter=0.5)
cull_index = CullIndex(List=reverse(explode.Vertices), Indices="0", Wrap=True)  # -> reverse(List)
shift_list = ShiftList(List=cull_index, Shift=1, Wrap=True)
_4point_surface = _4PointSurface(CornerA=cull_index, CornerB=shift_list, CornerC=point_on_curve)
brep_edges = BrepEdges(Brep=_4point_surface)  # -> Naked, Interior, NonManifold
custom_preview_2 = CustomPreview(Geometry=_4point_surface, Material=ColourSwatch(SwatchColor=RGB(232, 232, 232)))
