# Grasshopper definition Demo_mathCurves.gh (Grasshopper 1.0.7)

surface = Surface(<surface referenced from the Rhino model>)  # disabled

time_x = Slider(11, range=0..12)  # disabled
time_interval = Slider(40, range=0..100)  # disabled
A = Slider(0.567, range=0..12)  # disabled
omega = Slider(0.281, range=0..12)  # disabled
phi = Slider(7.143, range=0..12)  # disabled
pi = Pi(Factor=time_x)  # disabled
range = Range(Domain=pi, Steps=time_interval)  # disabled
panel = Panel("A*Tan((Omega*t)+Phi)")  # disabled
evaluate = Evaluate(Expression=panel, A=A, Omega=omega, Phi=phi, t=range)  # disabled

# ----
# y(t) = A*Sin(Omega*t+Phi)
# A = Amplitude
# Omega = angular frequency
# Phi = phase (i.e. where t = 0)
A_2 = Slider(2.996, range=0..12)  # disabled
omega_2 = Slider(0.281, range=0..12)  # disabled
phi_2 = Slider(7.143, range=0..12)  # disabled
time_x_2 = Slider(11, range=0..12)  # disabled
time_interval_2 = Slider(40, range=0..100)  # disabled
pi_2 = Pi(Factor=time_x_2)  # disabled
range_2 = Range(Domain=pi_2, Steps=time_interval_2)  # disabled
multiplication = Multiplication(A=omega_2, B=range_2)  # disabled
addition = Addition(A=multiplication, B=phi_2)  # disabled
sine = Sine(Value=addition)  # disabled
cosine = Cosine(Value=addition)  # disabled
multiplication_2 = Multiplication(A=A_2, B=sine)  # disabled
multiplication_3 = Multiplication(A=A_2, B=cosine)  # disabled
y_values = Panel(cosine)  # disabled
x_values = Panel(range_2)  # disabled
x_values_2 = Panel(range_2)  # disabled
y_values_2 = Panel(multiplication_2)  # disabled
construct_point = ConstructPoint(XCoordinate=x_values_2, YCoordinate=y_values_2, ZCoordinate=0)  # disabled
construct_point_2 = ConstructPoint(XCoordinate=x_values, YCoordinate=y_values, ZCoordinate=0)  # disabled
interpolate = Interpolate(Vertices=construct_point, Degree=3, Periodic=False, KnotStyle=1)  # -> Curve, Length, Domain; disabled
interpolate_2 = Interpolate(Vertices=construct_point_2, Degree=3, Periodic=False, KnotStyle=1)  # -> Curve, Length, Domain; disabled

height = Slider(5, range=0..100)  # disabled
height_2 = Slider(15, range=0..100)  # disabled
isocurve_density = DivideDomain²(Domain=surface, UCount=height, VCount=height_2)  # disabled
isotrim = Isotrim(Surface=surface, Domain=isocurve_density)  # disabled
deconstruct_brep = DeconstructBrep(Brep=isotrim)  # -> Faces, Edges, Vertices; disabled
panel_2 = Panel(deconstruct_brep.Vertices)  # disabled

time_x_3 = Slider(11, range=0..12)  # disabled
time_interval_3 = Slider(40, range=0..100)  # disabled
A_3 = Slider(2.996, range=0..12)  # disabled
omega_3 = Slider(0.281, range=0..12)  # disabled
phi_3 = Slider(7.143, range=0..12)  # disabled
pi_3 = Pi(Factor=time_x_3)  # disabled
range_3 = Range(Domain=pi_3, Steps=time_interval_3)  # disabled
panel_3 = Panel("A*Sin((Omega*t)+Phi)")  # disabled
evaluate_2 = Evaluate(Expression=panel_3, A=A_3, Omega=omega_3, Phi=phi_3, t=range_3)  # disabled

time_x_4 = Slider(11, range=0..12)  # disabled
time_interval_4 = Slider(40, range=0..100)  # disabled
A_4 = Slider(2.996, range=0..12)  # disabled
omega_4 = Slider(0.281, range=0..12)  # disabled
phi_4 = Slider(7.143, range=0..12)  # disabled
pi_4 = Pi(Factor=time_x_4)  # disabled
range_4 = Range(Domain=pi_4, Steps=time_interval_4)  # disabled
panel_4 = Panel("A*Cos((Omega*t)+Phi)")  # disabled
evaluate_3 = Evaluate(Expression=panel_4, A=A_4, Omega=omega_4, Phi=phi_4, t=range_4)  # disabled

panel_5 = Panel("1")  # disabled
panel_6 = Panel("0")  # disabled
panel_7 = Panel("2")  # disabled
panel_8 = Panel("3")  # disabled
b_right_pt = ListItem(List=deconstruct_brep.Vertices, Index=panel_8, Wrap=True)  # disabled
t_right_pt = ListItem(List=deconstruct_brep.Vertices, Index=panel_7, Wrap=True)  # disabled
b_left_pt = ListItem(List=deconstruct_brep.Vertices, Index=panel_6, Wrap=True)  # disabled
t_left_pt = ListItem(List=deconstruct_brep.Vertices, Index=panel_5, Wrap=True)  # disabled
verticals = Line(StartPoint=t_right_pt, EndPoint=b_right_pt)  # disabled
verticals_2 = Line(StartPoint=b_left_pt, EndPoint=t_left_pt)  # disabled
horizontals = Line(StartPoint=b_left_pt, EndPoint=b_right_pt)  # disabled
horizontals_2 = Line(StartPoint=t_left_pt, EndPoint=t_right_pt)  # disabled
diagonal_left = Line(StartPoint=t_left_pt, EndPoint=b_right_pt)  # disabled
diagonal_right = Line(StartPoint=b_left_pt, EndPoint=t_right_pt)  # disabled

X = Panel(range)  # disabled
Y = Panel(evaluate)  # disabled
X_2 = Panel(range_3)  # disabled
Y_2 = Panel(evaluate_2)  # disabled
X_3 = Panel(range_4)  # disabled
Y_3 = Panel(evaluate_3)  # disabled
construct_point_3 = ConstructPoint(XCoordinate=X, YCoordinate=Y, ZCoordinate=0)  # disabled
construct_point_4 = ConstructPoint(XCoordinate=X_2, YCoordinate=Y_2, ZCoordinate=0)  # disabled
construct_point_5 = ConstructPoint(XCoordinate=X_3, YCoordinate=Y_3, ZCoordinate=0)  # disabled
interpolate_3 = Interpolate(Vertices=construct_point_3, Degree=3, Periodic=False, KnotStyle=1)  # -> Curve, Length, Domain; disabled

interpolate_4 = Interpolate(Vertices=construct_point_4, Degree=3, Periodic=False, KnotStyle=1)  # -> Curve, Length, Domain; disabled
interpolate_5 = Interpolate(Vertices=construct_point_5, Degree=3, Periodic=False, KnotStyle=1)  # -> Curve, Length, Domain; disabled
height_3 = Slider(22, range=0..100)  # disabled
unit_z = UnitZ(Factor=height_3)  # disabled
move = Move(Geometry=interpolate_5.Curve, Motion=unit_z)  # -> Geometry, Transform; disabled
loft = Loft(
    Curves=[interpolate_4.Curve, move.Geometry],
    Options={Adjust=False, Closed=False, LoftEnds=0, LoftSimp=0, LoftType=0, Rebuild=10, Refit=0.01})  # disabled

crv = Curve(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)
crv_2 = Curve(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)

height_4 = Slider(4, range=0..100)  # disabled
height_5 = Slider(15, range=0..100)  # disabled
isocurve_density_2 = DivideDomain²(Domain=loft, UCount=height_4, VCount=height_5)  # disabled
isotrim_2 = Isotrim(Surface=loft, Domain=isocurve_density_2)  # disabled
deconstruct_brep_2 = DeconstructBrep(Brep=isotrim_2)  # -> Faces, Edges, Vertices; disabled
panel_9 = Panel(deconstruct_brep_2.Vertices)  # disabled

number_slider = Slider(144, range=0..1000)

# ---- group: Vector
divide = DivideCurve(Curve=crv_2, Count=number_slider, Kinks=False)  # -> Points, Tangents, Parameters
divide_2 = DivideCurve(Curve=crv, Count=number_slider, Kinks=False)  # -> Points, Tangents, Parameters
rev = ReverseList(List=divide.Points)
shift = ShiftList(List=divide_2.Points, Shift=Slider(0, range=0..10), Wrap=True)
ln = Line(StartPoint=rev, EndPoint=shift)  # -> flatten(Line)

# ----
panel_10 = Panel("0")  # disabled
panel_11 = Panel("1")  # disabled
panel_12 = Panel("2")  # disabled
panel_13 = Panel("3")  # disabled
b_right_pt_2 = ListItem(List=deconstruct_brep_2.Vertices, Index=panel_13, Wrap=True)  # disabled
t_right_pt_2 = ListItem(List=deconstruct_brep_2.Vertices, Index=panel_12, Wrap=True)  # disabled
b_left_pt_2 = ListItem(List=deconstruct_brep_2.Vertices, Index=panel_10, Wrap=True)  # disabled
t_left_pt_2 = ListItem(List=deconstruct_brep_2.Vertices, Index=panel_11, Wrap=True)  # disabled
verticals_3 = Line(StartPoint=t_right_pt_2, EndPoint=b_right_pt_2)  # disabled
verticals_4 = Line(StartPoint=b_left_pt_2, EndPoint=t_left_pt_2)  # disabled
horizontals_3 = Line(StartPoint=b_left_pt_2, EndPoint=b_right_pt_2)  # disabled
horizontals_4 = Line(StartPoint=t_left_pt_2, EndPoint=t_right_pt_2)  # disabled
diagonal_left_2 = Line(StartPoint=t_left_pt_2, EndPoint=b_right_pt_2)  # disabled
diagonal_right_2 = Line(StartPoint=b_left_pt_2, EndPoint=t_right_pt_2)  # disabled

# ---- group: remap curves
divide_3 = DivideCurve(Curve=ln, Count=10, Kinks=False)  # -> Points, Tangents, Parameters
lng = ListLength(List=divide_3.Points)
range_5 = Range(Domain=Domain(0, 1), Steps=expr("x-1", lng))
number_slider_2 = Slider(0.955, range=0..100)
graph = GraphMapper(
    range_5,
    x0=0,
    x1=-1,
    y0=0,
    y1=1,
    container_name="Sine",
    Equation_px=[0.0153987566, 0.3167127967],
    Equation_py=[0.01402878761, 0.768635869])
bnd = Bounds(Numbers=graph)
neg = Negative(Value=number_slider_2)
dom = ConstructDomain(DomainStart=number_slider_2, DomainEnd=neg)
remap = RemapNumbers(Value=graph, Source=bnd, Target=dom)  # -> Mapped, Clipped
Z = UnitZ(Factor=1)
amp = Amplitude(Vector=Z, Amplitude=remap.Mapped)
move_2 = Move(Geometry=divide_3.Points, Motion=amp)  # -> Geometry, Transform
intcrv = Interpolate(Vertices=move_2.Geometry, Degree=3, Periodic=False, KnotStyle=1)  # -> Curve, Length, Domain
