# Grasshopper definition Demo_mathSurfaces.ghx (Grasshopper 1.0.7)
# plug-ins: Pufferfish

numb = Slider(31, range=2..100)
numb_2 = Slider(27, range=2..100)
animation = Slider(9.441, range=0..18.85)
size = Slider(0.401754, range=0..0.5)
sqgrid = Square(Plane=PlaneXY(-0.5, -0.5, 0), Size=size, ExtentX=numb_2, ExtentY=numb)  # -> Cells, Points
pcomp = Decompose(Point=sqgrid.Points, System=PlaneXY(0, 0, 0))  # -> XComponent, YComponent, ZComponent
addition = Addition(A=animation, B=pcomp.XComponent)

panel = Panel("(cos(x) + sin(x-y²)) / 2")
eval = Evaluate(F="(cos(x) + sin(x-y²)) / 2", x=addition, y=pcomp.YComponent)

pt = PointXYZ(XComponent=pcomp.XComponent, YComponent=pcomp.YComponent, ZComponent=eval, System=PlaneXY(0, 0, 0))
yz = YZPlane(Origin=Point(0, 0, 0))
srfgrid = SurfaceFromPoints(Points=flatten(pt), UCount=expr("x+1", numb_2), Interpolate=True)
mirror = Mirror(Geometry=srfgrid, Plane=yz)  # -> Geometry, Transform
brec = BoundingRectangle(Geometry=srfgrid, Plane=PlaneXY(0, 0, 0), Axis=0, Slide=0, Union=True)  # -> Bounding, DimensionX, DimensionY
num = Number(brec.DimensionY)
num_2 = Number(brec.DimensionX)
crv = Curve(brec.Bounding)
recgrid = Rectangular(Plane=PlaneXY(0, 0, 0), SizeX=num_2, SizeY=num, ExtentX=Slider(12, range=0..100), ExtentY=Slider(12, range=0..100))  # -> Cells, Points
scale = Scale(Geometry=srfgrid, Center=Point(0, 0, 0), Factor=Slider(100, range=0..100))  # -> Geometry, Transform
