# Grasshopper definition Demo_particles.gh (Grasshopper 1.0.7)
# plug-ins: Stella

pt = Point(Point(-2.152186493, 0.2034423679, 0))

# ----
# Attractor preview
number_slider = Slider(0.3, range=0..1)
tag = TextTag(Location=pt, Text="Attractor")
sph = Sphere(Base=pt, Radius=number_slider)
preview = CustomPreview(Geometry=sph, Material=ColourSwatch(SwatchColor=RGB(201, 44, 44)))

box = CenterBox(Base=PlaneXY(0, 0, 0), X=Slider(4, range=0..10), Y=Slider(4, range=0..10), Z=Slider(0.1, range=0..1))
pop2d = Populate2D(Region=box, Count=Slider(70, range=0..100), Seed=1)
simplex_noise = SimplexNoise(Factor=Slider(-0.01, range=-1..1))
particle_atr = StarProperties(LifeSpan=Slider(136, range=0..1000))
se = StarEmittingSource(Points=pop2d)
environment = Environment(Density=1, Brep=box, Noise=simplex_noise)

# ----
# Doubleclick to
# pause/run simulation
timer = Timer(Interval=20, TimerInterval=20, Target=bigbang)  # disabled

bigbang = BigBang(
    Environment=environment,
    StarProperties=particle_atr,
    MaximumAllowedStars=Slider(127, range=0..1000),
    EmittingSpeed=Slider(0, range=0..100),
    EmitterSource=se,
    StarAttractor=pt,
    AttractionFactor=Slider(0.019, range=-0.5..0.5),
    Reset=Button())
show_stars = ShowStars(Stars=bigbang)
cullpt = CullDuplicates(Points=show_stars, Tolerance=0.1, CullMode=3)  # -> Points, Indices, Valence
series = Series(Start=Slider(10, range=0..10), Step=Slider(3, range=0..10), Count=Slider(12, range=0..12))
number_slider_2 = Slider(0.013, range=0..10)
lng = ListLength(List=series)
metaball_t = MetaBallT(Points=cullpt.Points, Plane=PlaneXY(0, 0, 0), Threshold=series, Accuracy=Slider(0.08, range=0..1))
series_2 = Series(Start=Slider(0, range=0..10), Step=number_slider_2, Count=lng)
crv = Curve(metaball_t)
Z = UnitZ(Factor=series_2)  # -> simplify(UnitVector)
move = Move(Geometry=metaball_t, Motion=graft(Z))  # -> Geometry, Transform
# Final curve
# Caution: Heavy calculation!
# make sure you pause the simulation (timer)
# and save your simulation by internalising
# final curve
crv_2 = Curve(move.Geometry)

# ----
# To create volume from curves you can connect
# final curve to boundary input (Edges).
boundary = BoundarySurfaces()
Z_2 = UnitZ(Factor=number_slider_2)
extr = Extrude(Base=boundary, Direction=Z_2)

preview_2 = CustomPreview(Geometry=extr, Material=ColourSwatch(SwatchColor=RGB(199, 190, 93)))
