# Grasshopper definition Demo_random-facade.gh (Grasshopper 1.0.7)
# plug-ins: Bifocals, Weaverbird, MeshEdit Components

# PARAMETRIC HOUSE
x = Slider(50.2, range=0..100)
y = Slider(89.1, range=0..100)
xz_plane = XZPlane(Origin=Point(0, 0, 0))
plane_surface = PlaneSurface(Plane=xz_plane, XSize=x, YSize=y)
curve = Curve(plane_surface)
offset_curve = OffsetCurve(Curve=plane_surface, Distance=expr("-x", Slider(2.5, range=0..10)), Plane=PlaneXY(0, 0, 0), Corners=1)
populate_geometry = PopulateGeometry(Geometry=curve, Count=Slider(32, range=20..60), Seed=Slider(211, range=0..1000))
explode = Explode(Curve=curve, Recursive=True)  # -> Segments, Vertices
number_slider = Slider(54, range=30..120)
construct_domain = ConstructDomain(DomainStart=Slider(0, range=0..100), DomainEnd=Slider(6.22, range=0..10))
seed = Slider(348, range=0..1000)
surface = Surface(offset_curve)
random = Random(Range=construct_domain, Number=number_slider, Seed=Slider(473, range=0..1000))
populate_geometry_2 = PopulateGeometry(Geometry=surface, Count=number_slider, Seed=seed)
unit_y = UnitY(Factor=random)
move = Move(Geometry=populate_geometry_2, Motion=expr("-x", unit_y))  # -> Geometry, Transform
point = Point(flatten([populate_geometry, explode.Vertices, move.Geometry]))
cull_duplicates = CullDuplicates(Points=point, Tolerance=0.1, CullMode=3)  # -> Points, Indices, Valence
delaunay_mesh = DelaunayMesh(Points=cull_duplicates.Points, Plane=xz_plane)
number_slider_2 = Slider(8.9, range=0..10)
weaverbird_s_picture_frame = WeaverbirdsPictureFrame(MeshPolylines=delaunay_mesh, Distance=number_slider_2, InsetType=0)
weaverbird_s_mesh_window = WeaverbirdsMeshWindow(MeshPolylines=delaunay_mesh, Distance=number_slider_2, InsetType=0)
weaverbird_s_mesh_thicken = WeaverbirdsMeshThicken(MeshCurves=weaverbird_s_picture_frame, Distance=Slider(0.25, range=0..1), OffsetType=0)
mesh_explode = MeshExplode(Mesh=weaverbird_s_picture_frame, Interpolate=False)
custom_preview = CustomPreview(Geometry=weaverbird_s_picture_frame, Material=ColourSwatch(SwatchColor=RGB(151, 62, 255)))
partition_list = PartitionList(List=mesh_explode, Size=Slider(3, range=0..10))
mesh_explode_2 = MeshExplode(Mesh=weaverbird_s_mesh_window, Interpolate=False)
custom_preview_2 = CustomPreview(Geometry=mesh_explode_2, Material=ColourSwatch(SwatchColor=RGB(39, 171, 255)))
mesh_join = MeshJoin(Meshes=partition_list)  # -> flatten(Mesh)
mesh = Mesh(mesh_explode_2)
list_length = ListLength(List=mesh)
square_root = SquareRoot(Value=list_length)
curve_2 = Curve(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)
mesh_2 = Mesh(mesh_join)
list_length_2 = ListLength(List=mesh_2)
square_root_2 = SquareRoot(Value=list_length_2)
face_normals = FaceNormals(Mesh=mesh)  # -> flatten(Centers), flatten(Normals)
series = Series(Start=0, Step=1, Count=list_length)
division = Division(A=list_length, B=square_root)
curve_3 = Curve(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)
division_2 = Division(A=list_length_2, B=square_root_2)
series_2 = Series(Start=0, Step=1, Count=list_length_2)
offset_curve_2 = OffsetCurve(Curve=curve_2, Distance=expr("-x", Slider(5.8, range=0..10)), Plane=PlaneXY(0, 0, 0), Corners=1)
text_tag = TextTag(Location=face_normals.Centers, Text=series)
surface_frames = SurfaceFrames(Surface=offset_curve_2, UCount=square_root, VCount=division)  # -> flatten(Frames), Parameters
offset_curve_3 = OffsetCurve(Curve=curve_3, Distance=expr("-x", Slider(10, range=0..10)), Plane=PlaneXY(0, 0, 0), Corners=1)
plane_normal = PlaneNormal(Origin=face_normals.Centers, ZAxis=face_normals.Normals)  # -> flatten(Plane)
surface_frames_2 = SurfaceFrames(Surface=offset_curve_3, UCount=square_root_2, VCount=division_2)  # -> flatten(Frames), Parameters
shortest_list = ShortestList(ListListA=plane_normal, ListListB=surface_frames.Frames, TrimMode=2)  # -> ListListA, ListListB
shortest_list_2 = ShortestList(ListListA=plane_normal, ListListB=surface_frames_2.Frames, TrimMode=2)  # -> ListListA, ListListB
orient = Orient(Geometry=mesh, Source=plane_normal, Target=shortest_list.ListListB)  # -> Geometry, Transform
point_2 = Point(shortest_list.ListListB)
orient_2 = Orient(Geometry=mesh_2, Source=plane_normal, Target=shortest_list_2.ListListB)  # -> Geometry, Transform
point_3 = Point(shortest_list_2.ListListB)
mesh_edges = MeshEdges(Mesh=orient.Geometry)  # -> NakedEdges, InteriorEdges, NonManifoldEdges
mesh_edges_2 = MeshEdges(Mesh=orient_2.Geometry)  # -> NakedEdges, InteriorEdges, NonManifoldEdges
text_tag_2 = TextTag(Location=point_2, Text=series)
join_curves = JoinCurves(Curves=mesh_edges.NakedEdges, Preserve=False)
text_tag_3 = TextTag(Location=point_3, Text=series_2)
