# Grasshopper definition Demo_reBuildSrufaceAndCurves.gh (Grasshopper 1.0.7)

precision = Slider(67, range=0..100)
spacing = Slider(24, range=0..100)
srf = Surface([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])

# ---- group: JOIN SURFACES
join = BrepJoin(Breps=srf)  # -> Breps, Closed

# ---- group: Set Normals
pt = Point(Point(-95, 0, 0))
X = UnitX(Factor=pt)
Y = UnitY(Factor=pt)

# ---- group: Contour Surfaces bith direcitons
contour = Contour(Shape=srf, Point=pt, Direction=X, Distance=spacing)
contour_2 = Contour(Shape=join.Breps, Point=pt, Direction=Y, Distance=spacing)

# ---- group: Smoothing
divide = DivideCurve(Curve=contour_2, Count=precision, Kinks=False)  # -> Points, Tangents, Parameters
divide_2 = DivideCurve(Curve=contour, Count=precision, Kinks=False)  # -> Points, Tangents, Parameters
intcrv = Interpolate(Vertices=divide.Points, Degree=3, Periodic=False, KnotStyle=1)  # -> Curve, Length, Domain
intcrv_2 = Interpolate(Vertices=divide_2.Points, Degree=3, Periodic=False, KnotStyle=1)  # -> Curve, Length, Domain
