# Grasshopper definition Demo_rigid-body-simple.gh (Grasshopper 1.0.7)
# plug-ins: Bifocals, Kangaroo2 Components

number_slider = Slider(7.06, range=0..100)
domain_box = DomainBox(Base=PlaneXY(0, 0, 0), X=number_slider, Y=Slider(21.6, range=0..100), Z=Slider(9.83, range=0..100))
unit_x = UnitX(Factor=number_slider)
linear_array = LinearArray(Geometry=domain_box, Direction=unit_x, Count=Slider(37, range=0..100))  # -> Geometry, Transform
deconstruct_brep = DeconstructBrep(Brep=linear_array.Geometry)  # -> Faces, Edges, Vertices
list_item = ListItem(List=reverse(linear_array.Geometry), Index=0, Wrap=True)
list_item_2 = ListItem(List=linear_array.Geometry, Index=0, Wrap=True)
rigidbody = RigidBody(Part=graft(linear_array.Geometry), Points=deconstruct_brep.Vertices, Strength=Slider(1000, range=0..1000))  # -> RigidBody, Planes
deconstruct_brep_2 = DeconstructBrep(Brep=list_item)  # -> Faces, Edges, Vertices
deconstruct_brep_3 = DeconstructBrep(Brep=list_item_2)  # -> Faces, Edges, Vertices
list_item_3 = ListItem(List=deconstruct_brep_2.Vertices, Index="6", Wrap=True)
point = Point(Point(181.6979125, 3.181152047, 2.392472993))
list_item_4 = ListItem(List=deconstruct_brep_3.Vertices, Index=[0, 3, 4, 7], Wrap=True)
anchor = Anchor(Point=list_item_3, Target=point, Strength=10000)
anchorxyz = AnchorXYZ(Point=deconstruct_brep.Vertices, X=False, Y=False, Z=Toggle(False), Strength=Slider(2000, range=0..10000))
anchor_2 = Anchor(Point=list_item_4, Target=list_item_4, Strength=Slider(2000, range=0..10000))
solver = Solver(GoalObjects=[rigidbody.RigidBody, anchor, anchorxyz, anchor_2], Reset=Button(), Threshold=1e-15, Tolerance=0.01, On=True)  # -> I, V, O
bouncysolver = BouncySolver(
    GoalObjects=[rigidbody.RigidBody, anchor, anchorxyz, anchor_2],
    Reset=Button(),
    Threshold=1e-15,
    Tolerance=0.01,
    Damping=0.99,
    Iterations=10,
    On=True)  # -> I, V, O; disabled
brep = Brep(solver.O)
deconstruct_brep_4 = DeconstructBrep(Brep=brep)  # -> Faces, Edges, Vertices
list_item_5 = ListItem(List=reverse(deconstruct_brep_4.Faces), Index=0, Wrap=True)
