# Grasshopper definition Demo_rotational-image.gh (Grasshopper 1.0.7)
# plug-ins: Bifocals, Weaverbird

X = Slider(39.08, range=0..100)
Y = Slider(41.12, range=0..100)
xz_plane = XZPlane(Origin=Point(0, 0, 0))
U = Slider(25, range=3..200)
V = Slider(25, range=3..200)
plane_surface = PlaneSurface(Plane=xz_plane, XSize=X, YSize=Y)
divide_domain² = DivideDomain²(Domain=plane_surface, UCount=U, VCount=V)
isotrim = Isotrim(Surface=plane_surface, Domain=divide_domain²)
area = Area(Geometry=isotrim)  # -> Area, Centroid
deconstruct_brep = DeconstructBrep(Brep=isotrim)  # -> Faces, Edges, Vertices
surface_closest_point = SurfaceClosestPoint(Point=area.Centroid, Surface=reparameterize(plane_surface))  # -> Point, UVPoint, Distance
list_item = ListItem(List=deconstruct_brep.Edges, Index=0, Wrap=True)  # -> Item, Item1, Item2, Item3
max_rot = Slider(60, range=0..60)
min_rot = Slider(0, range=0..60)
image_sampler = ImageSampler(surface_closest_point.UVPoint, Filter="Value", Interpolate=False, Umax=1, Umin=0, Vmax=1, Vmin=0, Wrap=1)
# Best with
# Gradient Grayscales
construct_domain = ConstructDomain(DomainStart=min_rot, DomainEnd=max_rot)
remap_numbers = RemapNumbers(Value=image_sampler, Source=Domain(0, 1), Target=construct_domain)  # -> graft(Mapped), Clipped
rotate_axis = RotateAxis(Geometry=deconstruct_brep.Faces, Angle=degrees(remap_numbers.Mapped), Axis=list_item.Item2)  # -> Geometry, Transform
deconstruct_brep_2 = DeconstructBrep(Brep=rotate_axis.Geometry)  # -> Faces, Edges, Vertices
list_item_2 = ListItem(List=deconstruct_brep_2.Edges, Index=0, Wrap=True)
surface = Surface(rotate_axis.Geometry)
unit_y = UnitY(Factor=expr("-x", 1))
point_on_curve = PointOnCurve(list_item.Item, parameter=0.5)
point_on_curve_2 = PointOnCurve(list_item_2, parameter=0.5)
simple_mesh = SimpleMesh(Brep=surface)
thcikness = Slider(0.14, range=0..1)
arc_sed = ArcSED(Start=point_on_curve, End=point_on_curve_2, Direction=unit_y)  # -> flatten(Arc), Plane, Radius
weaverbird_s_mesh_thicken = WeaverbirdsMeshThicken(MeshCurves=simple_mesh, Distance=thcikness, OffsetType=0)  # -> flatten(OutputMeshCurves)
deconstruct_arc = DeconstructArc(Arc=arc_sed.Arc)  # -> BasePlane, Radius, Angle
point_on_curve_3 = PointOnCurve(arc_sed.Arc, parameter=0.5)
weaverbird_s_mesh_edges = WeaverbirdsMeshEdges(MeshOrPolylines=weaverbird_s_mesh_thicken)
degrees = Degrees(Radians=deconstruct_arc.Angle)
integer = Integer(degrees)
custom_preview = CustomPreview(Geometry=weaverbird_s_mesh_edges, Material=ColourSwatch(SwatchColor=RGB(0, 0, 0)))
custom_preview_2 = CustomPreview(Geometry=weaverbird_s_mesh_thicken, Material=ColourSwatch(SwatchColor=RGB(186, 195, 0)))
text_tag = TextTag(Location=point_on_curve_3, Text=integer)
curve = Curve(arc_sed.Arc)
