# Grasshopper definition Demo_simple_def.gh (Grasshopper 1.0.7)

pt = Point(Point(-3.3943921, -2.611043335, 0))
pt_2 = Point(Point(-5.557440742, 12.75798649, 0))
ln = Line(StartPoint=pt_2, EndPoint=pt)
collectme = Line(ln)
