# Grasshopper definition Demo_sinusoid.gh (Grasshopper 1.0.7)

number_slider = Slider(35, range=0..100)
dom = ConstructDomain(DomainStart="-PI", DomainEnd="PI")
series = Series(Start=0, Step=1, Count=expr("x+1", number_slider))
range = Range(Domain=dom, Steps=number_slider)
expression = Expression(x=range, Expression="sin(x)")
pt = ConstructPoint(XCoordinate=series, YCoordinate=expression, ZCoordinate=0)
panel = Panel(expression)
