# Grasshopper definition Demo_tween through surface.gh (Grasshopper 1.0.7)
# plug-ins: Pufferfish

# ----
# count of final surfaces
number_slider = Slider(100, range=0..100)
range = Range(Domain=Domain(0, 1), Steps=number_slider)

# ----
# 1
srf = Surface(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)

# ----
# 3
srf_2 = Surface(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)

# ----
# 2
srf_3 = Surface(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)

# ----
# 5
srf_4 = Surface(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)

# ----
# 4
srf_5 = Surface(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)

# ----
# 6
srf_6 = Surface(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)

# ----
# Base surfaces
# Note:
# sequence of connecting surfaces
# to tween through surface component
# are important.
# 7
srf_7 = Surface(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)

# ----
# True = normalized
# If you are looking for specific
# factor between each base
# surfaces.
# it is better to not normalize
# the component, and use series
# component as input for factor.
# False = rule for factor are(0.0 = first surface,index0   ;
# index number of last surface = surface at last index)
toggle = BooleanToggle(True)

# ----
# Interpolation type
# 0 = Linear
# 1 = Chord
# 2 = Square root
# 3 = uniform
number_slider_2 = Slider(3, range=0..3)

# ----
# Tween Through Surface
twnthrusrfs = TweenThroughSurfaces(
    Surfaces=[srf_7, srf_6, srf_4, srf_5, srf_2, srf_3, srf],
    Factor=range,
    Normalized=toggle,
    Equalized=False,
    Weighted=False,
    Degree=3,
    InterpolationType=number_slider_2,
    Refit=0,
    PointSample=0)

# ----
# Thickening surface
number_slider_3 = Slider(0.1, range=0..1)
offsrf = OffsetSurface(Surface=twnthrusrfs, Distance=number_slider_3, BothSides=False, CreateSolid=True)

preview = CustomPreview(Geometry=offsrf, Material=ColourSwatch(SwatchColor=RGB(242, 12, 12)))
