# Grasshopper definition Demo_waveformSurfaceBetweenCurves.gh (Grasshopper 1.0.7)

crv = Curve(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)
crv_2 = Curve(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)
number_slider = Slider(27, range=0..1000)

# ---- group: Vector
divide = DivideCurve(Curve=crv, Count=number_slider, Kinks=False)  # -> Points, Tangents, Parameters
divide_2 = DivideCurve(Curve=crv_2, Count=number_slider, Kinks=False)  # -> Points, Tangents, Parameters
rev = ReverseList(List=divide.Points)
shift = ShiftList(List=divide_2.Points, Shift=Slider(0, range=0..10), Wrap=True)
ln = Line(StartPoint=rev, EndPoint=shift)  # -> flatten(Line)

# ---- group: DSnake
crv_3 = Curve(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)
crv_4 = Curve(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)

# ----
number_slider_2 = Slider(27, range=0..1000)

# ---- group: Vector
divide_3 = DivideCurve(Curve=crv_4, Count=number_slider_2, Kinks=False)  # -> Points, Tangents, Parameters
divide_4 = DivideCurve(Curve=crv_3, Count=number_slider_2, Kinks=False)  # -> Points, Tangents, Parameters
rev_2 = ReverseList(List=divide_4.Points)
shift_2 = ShiftList(List=divide_3.Points, Shift=Slider(0, range=0..10), Wrap=True)
ln_2 = Line(StartPoint=rev_2, EndPoint=shift_2)  # -> flatten(Line)

# ---- group: Alternate Pattern
cull = CullPattern(List=ln, CullPattern=[False, True])
cull_2 = CullPattern(List=ln, CullPattern=[True, False])

cull_3 = CullPattern(List=ln_2, CullPattern=[False, True])
cull_4 = CullPattern(List=ln_2, CullPattern=[True, False])

# ---- group: remap curves Opposite
divide_5 = DivideCurve(Curve=cull, Count=10, Kinks=False)  # -> Points, Tangents, Parameters
lng = ListLength(List=divide_5.Points)
range = Range(Domain=Domain(0, 1), Steps=expr("x-1", lng))
graph = GraphMapper(range, x0=0, x1=-1, y0=0, y1=1, container_name="Sine", Equation_px=[0.4990157485, 0.009664664976], Equation_py=[0, 1])
number_slider_3 = Slider(0.955, range=0..100)
bnd = Bounds(Numbers=graph)
neg = Negative(Value=number_slider_3)
dom = ConstructDomain(DomainStart=number_slider_3, DomainEnd=neg)
remap = RemapNumbers(Value=graph, Source=bnd, Target=dom)  # -> Mapped, Clipped
Z = UnitZ(Factor=1)
amp = Amplitude(Vector=Z, Amplitude=remap.Mapped)
move = Move(Geometry=divide_5.Points, Motion=amp)  # -> Geometry, Transform
intcrv = Interpolate(Vertices=move.Geometry, Degree=3, Periodic=False, KnotStyle=1)  # -> Curve, Length, Domain

# ---- group: remap curves
divide_6 = DivideCurve(Curve=cull_2, Count=10, Kinks=False)  # -> Points, Tangents, Parameters
lng_2 = ListLength(List=divide_6.Points)
range_2 = Range(Domain=Domain(0, 1), Steps=expr("x-1", lng_2))
number_slider_4 = Slider(0.955, range=0..100)
graph_2 = GraphMapper(range_2, x0=0, x1=-1, y0=0, y1=1, container_name="Sine", Equation_px=[1, 0.4905482829], Equation_py=[0, 1])
bnd_2 = Bounds(Numbers=graph_2)
neg_2 = Negative(Value=number_slider_4)
dom_2 = ConstructDomain(DomainStart=number_slider_4, DomainEnd=neg_2)
remap_2 = RemapNumbers(Value=graph_2, Source=bnd_2, Target=dom_2)  # -> Mapped, Clipped
Z_2 = UnitZ(Factor=1)
amp_2 = Amplitude(Vector=Z_2, Amplitude=remap_2.Mapped)
move_2 = Move(Geometry=divide_6.Points, Motion=amp_2)  # -> Geometry, Transform
intcrv_2 = Interpolate(Vertices=move_2.Geometry, Degree=3, Periodic=False, KnotStyle=1)  # -> Curve, Length, Domain

# ---- group: remap curves Opposite
divide_7 = DivideCurve(Curve=cull_3, Count=10, Kinks=False)  # -> Points, Tangents, Parameters
lng_3 = ListLength(List=divide_7.Points)
range_3 = Range(Domain=Domain(0, 1), Steps=expr("x-1", lng_3))
graph_3 = GraphMapper(range_3, x0=0, x1=-1, y0=0, y1=1, container_name="Sine", Equation_px=[0.4990157485, 0.009664664976], Equation_py=[0, 1])
number_slider_5 = Slider(0.955, range=0..100)
bnd_3 = Bounds(Numbers=graph_3)
neg_3 = Negative(Value=number_slider_5)
dom_3 = ConstructDomain(DomainStart=number_slider_5, DomainEnd=neg_3)
remap_3 = RemapNumbers(Value=graph_3, Source=bnd_3, Target=dom_3)  # -> Mapped, Clipped
Z_3 = UnitZ(Factor=1)
amp_3 = Amplitude(Vector=Z_3, Amplitude=remap_3.Mapped)
move_3 = Move(Geometry=divide_7.Points, Motion=amp_3)  # -> Geometry, Transform
intcrv_3 = Interpolate(Vertices=move_3.Geometry, Degree=3, Periodic=False, KnotStyle=1)  # -> Curve, Length, Domain

# ---- group: remap curves
divide_8 = DivideCurve(Curve=cull_4, Count=10, Kinks=False)  # -> Points, Tangents, Parameters
lng_4 = ListLength(List=divide_8.Points)
range_4 = Range(Domain=Domain(0, 1), Steps=expr("x-1", lng_4))
number_slider_6 = Slider(0.955, range=0..100)
graph_4 = GraphMapper(range_4, x0=0, x1=-1, y0=0, y1=1, container_name="Sine", Equation_px=[1, 0.4905482829], Equation_py=[0, 1])
bnd_4 = Bounds(Numbers=graph_4)
neg_4 = Negative(Value=number_slider_6)
dom_4 = ConstructDomain(DomainStart=number_slider_6, DomainEnd=neg_4)
remap_4 = RemapNumbers(Value=graph_4, Source=bnd_4, Target=dom_4)  # -> Mapped, Clipped
Z_4 = UnitZ(Factor=1)
amp_4 = Amplitude(Vector=Z_4, Amplitude=remap_4.Mapped)
move_4 = Move(Geometry=divide_8.Points, Motion=amp_4)  # -> Geometry, Transform
intcrv_4 = Interpolate(Vertices=move_4.Geometry, Degree=3, Periodic=False, KnotStyle=1)  # -> Curve, Length, Domain

# ---- group: Edges
end = EndPoints(Curve=intcrv_2.Curve)  # -> flatten(Start), flatten(End)
end_2 = EndPoints(Curve=intcrv.Curve)  # -> flatten(Start), flatten(End)
weave = Weave(Pattern=[0, 1], Stream0=end.Start, Stream1=end_2.Start, NullGaps=True)
weave_2 = Weave(Pattern=[0, 1], Stream0=end.End, Stream1=end_2.End, NullGaps=True)
intcrv_5 = Interpolate(Vertices=weave, Degree=3, Periodic=False, KnotStyle=1)  # -> Curve, Length, Domain
intcrv_6 = Interpolate(Vertices=weave_2, Degree=3, Periodic=False, KnotStyle=1)  # -> Curve, Length, Domain

# ---- group: Midpoint
eval = EvaluateLength(Curve=intcrv_2.Curve, Length=0.5, Normalized=True)  # -> flatten(Point), Tangent, Parameter
eval_2 = EvaluateLength(Curve=intcrv.Curve, Length=0.5, Normalized=True)  # -> flatten(Point), Tangent, Parameter
weave_3 = Weave(Pattern=[0, 1], Stream0=eval.Point, Stream1=eval_2.Point, NullGaps=False)
intcrv_7 = Interpolate(Vertices=weave_3, Degree=3, Periodic=False, KnotStyle=1)  # -> Curve, Length, Domain

# ---- group: Edges
end_3 = EndPoints(Curve=intcrv_4.Curve)  # -> flatten(Start), flatten(End)
end_4 = EndPoints(Curve=intcrv_3.Curve)  # -> flatten(Start), flatten(End)
weave_4 = Weave(Pattern=[0, 1], Stream0=end_3.Start, Stream1=end_4.Start, NullGaps=True)
weave_5 = Weave(Pattern=[0, 1], Stream0=end_3.End, Stream1=end_4.End, NullGaps=True)
intcrv_8 = Interpolate(Vertices=weave_4, Degree=3, Periodic=False, KnotStyle=1)  # -> Curve, Length, Domain
intcrv_9 = Interpolate(Vertices=weave_5, Degree=3, Periodic=False, KnotStyle=1)  # -> Curve, Length, Domain

# ---- group: Midpoint
eval_3 = EvaluateLength(Curve=intcrv_4.Curve, Length=0.5, Normalized=True)  # -> flatten(Point), Tangent, Parameter
eval_4 = EvaluateLength(Curve=intcrv_3.Curve, Length=0.5, Normalized=True)  # -> flatten(Point), Tangent, Parameter
weave_6 = Weave(Pattern=[0, 1], Stream0=eval_3.Point, Stream1=eval_4.Point, NullGaps=False)
intcrv_10 = Interpolate(Vertices=weave_6, Degree=3, Periodic=False, KnotStyle=1)  # -> Curve, Length, Domain

# ---- group: View:Lines
number_slider_7 = Slider(0.01, range=0..0.01)  # disabled
move_5 = Move(Geometry=[intcrv_7.Curve, intcrv_5.Curve, intcrv_6.Curve, intcrv_2.Curve, intcrv.Curve], Motion=Vector(0, 0, 10))  # -> Geometry, Transform; disabled
pipe = Pipe(Curve=move_5.Geometry, Radius=number_slider_7, Caps=0)  # disabled
swatch = ColourSwatch(SwatchColor=RGB(250, 251, 252))  # disabled
material = CreateMaterial(Diffuse=swatch, Specular=RGB(255, 255, 255), Emission=RGB(0, 0, 0), Transparency=0, Shine=0)  # disabled
preview = CustomPreview(Geometry=pipe, Material=material)  # disabled

# ---- group: Surface Development / V Curves (Wevae and Flatten)
weave_7 = Weave(Pattern=[0, 1], Stream0=intcrv_2.Curve, Stream1=intcrv.Curve, NullGaps=False)  # -> flatten(Weave)

# ---- group: Surface Development / U Direction (In Order)
merge = Merge(Data1=intcrv_5.Curve, Data2=intcrv_7.Curve, Data3=intcrv_6.Curve)

# ---- group: Surface Development / V Curves (Wevae and Flatten)
weave_8 = Weave(Pattern=[0, 1], Stream0=intcrv_4.Curve, Stream1=intcrv_3.Curve, NullGaps=False)  # -> flatten(Weave)

# ---- group: Surface Development / U Direction (In Order)
merge_2 = Merge(Data1=intcrv_8.Curve, Data2=intcrv_10.Curve, Data3=intcrv_9.Curve)

# ---- group: Surface Development / Create Surface
netsurf = NetworkSurface(CurvesU=merge, CurvesV=weave_7, Continuity=2)

# ---- group: Surface Development / Color Surface
move_6 = Move(Geometry=netsurf, Motion=Vector(0, 0, 10))  # -> Geometry, Transform
material_2 = CreateMaterial(
    Diffuse=ColourSwatch(SwatchColor=RGB(124, 166, 196)),
    Specular=RGB(255, 255, 255),
    Emission=RGB(0, 0, 0),
    Transparency=0,
    Shine=0)
preview_2 = CustomPreview(Geometry=move_6.Geometry, Material=material_2)

# ---- group: Surface Development / Create Surface
netsurf_2 = NetworkSurface(CurvesU=merge_2, CurvesV=weave_8, Continuity=2)

# ---- group: Surface Development / Color Surface
move_7 = Move(Geometry=netsurf_2, Motion=Vector(0, 0, 10))  # -> Geometry, Transform
material_3 = CreateMaterial(
    Diffuse=ColourSwatch(SwatchColor=RGB(124, 166, 196)),
    Specular=RGB(255, 255, 255),
    Emission=RGB(0, 0, 0),
    Transparency=0,
    Shine=0)
preview_3 = CustomPreview(Geometry=move_7.Geometry, Material=material_3)
