# Grasshopper definition Fabrication_BasicDemo.gh (Grasshopper 1.0.7)

second_base_multiply = Slider(0.7084, range=0..1)
sitting_parameter = Slider(1.288, range=1.1..1.4)
groups = Slider(4, range=2..6)
gap1 = Slider(1.1, range=0.2..2.5)
gap2 = Slider(1.3, range=0.2..2.5)
parts_height = Slider(3.89, range=0..10)
base_cm = Slider(23.38, range=0..100)
base_height = Slider(7.62, range=0..10)
base_offset = Slider(2.982, range=0..10)
thickness_cm = Slider(1, range=0.3..1.3)
top_offset = Slider(0, range=0..1)
first_part_sit = Slider(0.36, range=0.3..0.5)
parts_offset = Slider(7.84, range=0..10)
top_count = Slider(20, range=0..100)
extend_base = Slider(6.04, range=0..10)
rotation = Slider(5.63, range=0..10)
gap2_2 = Slider(0.7, range=0.2..2.5)
gap2_3 = Slider(1.1, range=0.2..2.5)
point = Point(Point(51.27463166, 88.17288693, 0))
point_2 = Point(Point(54.64002941, 12.7473521, 0))
point_3 = Point(Point(50.27641688, -21.45669747, 0))
cluster = Cluster(
    B_7=gap2,
    count_3=groups,
    B_5=groups,
    target_3=point,
    B_8=gap1,
    B_4=gap2_2,
    target=point_2,
    parameter_2=top_offset,
    start_2=parts_offset,
    end_2=parts_offset,
    parameter=top_offset,
    rotation=rotation,
    number=parts_height,
    count=top_count,
    B_2=first_part_sit,
    x_size=base_cm,
    y_size=base_cm,
    factor=base_height,
    B_3=sitting_parameter,
    distance=base_offset,
    width=thickness_cm,
    start=extend_base,
    end=extend_base,
    B=second_base_multiply,
    B_6=gap2_3,
    target_2=point_3)  # -> geometry_3, geometry, geometry_2
curve = Curve(cluster.geometry_2)
curve_2 = Curve(cluster.geometry)
curve_3 = Curve(cluster.geometry_3)

# ==== cluster Cluster
plane = Plane(PlaneXY(0, 0, 0))
x_size = ClusterInput()
y_size = ClusterInput()
rectangle = Rectangle(Plane=plane, XSize=x_size, YSize=y_size, Radius=0)  # -> Rectangle, Length
polygon_center = PolygonCenter(Polyline=rectangle.Rectangle)  # -> CenterV, CenterE, CenterA
explode = Explode(Curve=rectangle.Rectangle, Recursive=True)  # -> Segments, Vertices
factor = ClusterInput()
list_item = ListItem(List=explode.Segments, Index=0, Wrap=True)  # -> Item, Item1, Item2, Item3
unit_z = UnitZ(Factor=factor)
distance = ClusterInput()
offset_curve = OffsetCurve(Curve=[list_item.Item1, list_item.Item3], Distance=expr("-x", distance), Plane=PlaneXY(0, 0, 0), Corners=1)
B = ClusterInput()
start = ClusterInput()
end = ClusterInput()
multiplication = Multiplication(A=unit_z, B=B)
extend_curve = ExtendCurve(Curve=offset_curve, Type=0, Start=start, End=end)
unit_z_2 = UnitZ(Factor=multiplication)
extrude = Extrude(Base=[list_item.Item, list_item.Item2], Direction=unit_z)
extrude_2 = Extrude(Base=extend_curve, Direction=unit_z_2)
move = Move(Geometry=list_item.Item, Motion=unit_z)  # -> Geometry, Transform
move_2 = Move(Geometry=list_item.Item2, Motion=unit_z)  # -> Geometry, Transform
parameter = ClusterInput()
parameter_2 = ClusterInput()
evaluate_curve = EvaluateCurve(Curve=reparameterize(move_2.Geometry), Parameter=parameter)  # -> Point, Tangent, Angle
evaluate_curve_2 = EvaluateCurve(Curve=reparameterize(move.Geometry), Parameter=expr("1-x", parameter_2))  # -> Point, Tangent, Angle
number = ClusterInput()
number_2 = Number(number)
line = Line(StartPoint=evaluate_curve_2.Point, EndPoint=evaluate_curve.Point)
start_2 = ClusterInput()
end_2 = ClusterInput()
extend_curve_2 = ExtendCurve(Curve=line, Type=0, Start=start_2, End=end_2)
B_2 = ClusterInput()
unit_z_3 = UnitZ(Factor=number_2)
multiplication_2 = Multiplication(A=number_2, B=B_2)
extrude_3 = Extrude(Base=extend_curve_2, Direction=unit_z_3)
unit_z_4 = UnitZ(Factor=expr("-x", multiplication_2))
move_3 = Move(Geometry=extrude_3, Motion=unit_z_4)  # -> Geometry, Transform
point = Point(polygon_center.CenterV)
polar_array = PolarArray(Geometry=move_3.Geometry, Plane=point, Count=4, Angle=6.283185307)  # -> Geometry, Transform
list_item_2 = ListItem(List=polar_array.Geometry, Index=0, Wrap=True)  # -> Item, Item1, Item2, Item3
unit_z_5 = UnitZ(Factor=number_2)
surface = Surface([list_item_2.Item1, list_item_2.Item3])
move_4 = Move(Geometry=surface, Motion=unit_z_5)  # -> Geometry, Transform
move_5 = Move(Geometry=move_4.Geometry, Motion=unit_z_4)  # -> Geometry, Transform
B_3 = ClusterInput()
surface_2 = Surface([list_item_2.Item, list_item_2.Item2])
multiplication_3 = Multiplication(A=number_2, B=B_3)
count = ClusterInput()
unit_z_6 = UnitZ(Factor=multiplication_3)
count_2 = Count(count)
rotation = ClusterInput()
linear_array = LinearArray(Geometry=move_5.Geometry, Direction=unit_z_6, Count=count_2)  # -> Geometry, Transform
linear_array_2 = LinearArray(Geometry=surface_2, Direction=unit_z_6, Count=count_2)  # -> Geometry, Transform
series = Series(Start=0, Step=rotation, Count=count_2)
rotate_3d = Rotate3D(Geometry=linear_array_2.Geometry, Angle=degrees(series), Center=point, Axis=Vector(0, 0, 1))  # -> Geometry, Transform
rotate_3d_2 = Rotate3D(Geometry=linear_array.Geometry, Angle=degrees(series), Center=point, Axis=Vector(0, 0, 1))  # -> Geometry, Transform
curve = Curve([rotate_3d.Geometry, rotate_3d_2.Geometry])
width = ClusterInput()
region_slits = RegionSlits(Regions=flatten([extrude, extrude_2, curve]), Width=width, Gap=0)  # -> flatten(Regions), Topology
plane_2 = Plane(region_slits.Regions)
orient = Orient(Geometry=region_slits.Regions, Source=plane_2, Target=PlaneXY(0, 0, 0))  # -> Geometry, Transform
curve_2 = Curve(orient.Geometry)
cull_index = CullIndex(List=curve_2, Indices=[0, 1, 2], Wrap=True)
list_item_3 = ListItem(List=curve_2, Index=0, Wrap=True)  # -> Item, Item1, Item2
surface_3 = Surface(region_slits.Regions)
colour_parts = ColourSwatch(SwatchColor=RGB(155, 143, 105))
colour_edges = ColourSwatch(SwatchColor=RGB(0, 0, 0))
brep_edges = BrepEdges(Brep=surface_3)  # -> Naked, Interior, NonManifold
list_item_4 = ListItem(List=reverse(curve_2), Index=0, Wrap=True)
custom_preview = CustomPreview(Geometry=brep_edges.Naked, Material=colour_edges)
custom_preview_2 = CustomPreview(Geometry=surface_3, Material=colour_parts)
curve_3 = Curve([list_item_3.Item, list_item_3.Item1])
target = ClusterInput()
plane_3 = Plane(curve_3)
cull_index_2 = CullIndex(List=reverse(cull_index), Indices=0, Wrap=True)
orient_2 = Orient(Geometry=curve_3, Source=plane_3, Target=target)  # -> Geometry, Transform
curve_4 = Curve([list_item_3.Item2, list_item_4])
box = Box(cull_index_2)
target_2 = ClusterInput()
plane_4 = Plane(curve_4)
deconstruct_brep = DeconstructBrep(Brep=box)  # -> Faces, Edges, Vertices
target_3 = ClusterInput()
orient_3 = Orient(Geometry=curve_4, Source=plane_4, Target=target_2)  # -> Geometry, Transform
integer = Integer(2)
curve_5 = Curve(orient_2.Geometry)
list_length = ListLength(List=curve_5)
target_4 = Target(target_3)
list_item_5 = ListItem(List=deconstruct_brep.Vertices, Index=0, Wrap=True)  # -> flatten(Item)
list_item_6 = ListItem(List=curve_5, Index=0, Wrap=True)
division = Division(A=list_length, B=integer)
orient_4 = Orient(Geometry=cull_index_2, Source=list_item_5, Target=target_4)  # -> Geometry, Transform
box_2 = Box(list_item_6)
integer_2 = Integer(2)
curve_6 = Curve(orient_3.Geometry)
list_length_2 = ListLength(List=curve_6)
B_4 = ClusterInput()
list_item_7 = ListItem(List=curve_6, Index=0, Wrap=True)
deconstruct_brep_2 = DeconstructBrep(Brep=box_2)  # -> Faces, Edges, Vertices
partition_list = PartitionList(List=curve_5, Size=division)
B_5 = ClusterInput()
curve_7 = Curve(orient_4.Geometry)
list_length_3 = ListLength(List=curve_7)
division_2 = Division(A=list_length_2, B=integer_2)
list_item_8 = ListItem(List=curve_7, Index=0, Wrap=True)
box_3 = Box(list_item_7)
list_item_9 = ListItem(List=deconstruct_brep_2.Vertices, Index=0, Wrap=True)  # -> Item, Item1, Item2, Item3
division_3 = Division(A=list_length_3, B=B_5)
B_6 = ClusterInput()
box_4 = Box(list_item_8)
deconstruct_brep_3 = DeconstructBrep(Brep=box_3)  # -> Faces, Edges, Vertices
partition_list_2 = PartitionList(List=curve_6, Size=division_2)
distance_2 = Distance(PointA=list_item_9.Item, PointB=list_item_9.Item1)
addition = Addition(A=distance_2, B=B_4)
series_2 = Series(Start=0, Step=addition, Count=integer)
B_7 = ClusterInput()
distance_3 = Distance(PointA=list_item_9.Item, PointB=list_item_9.Item3)
deconstruct_brep_4 = DeconstructBrep(Brep=box_4)  # -> Faces, Edges, Vertices
partition_list_3 = PartitionList(List=curve_7, Size=division_3)
list_item_10 = ListItem(List=deconstruct_brep_3.Vertices, Index=0, Wrap=True)  # -> Item, Item1, Item2, Item3
list_item_11 = ListItem(List=deconstruct_brep_4.Vertices, Index=0, Wrap=True)  # -> Item, Item1, Item2, Item3
unit_x = UnitX(Factor=series_2)  # -> graft(UnitVector)
count_3 = ClusterInput()
distance_4 = Distance(PointA=list_item_10.Item, PointB=list_item_10.Item1)
addition_2 = Addition(A=distance_4, B=B_6)
series_3 = Series(Start=0, Step=addition_2, Count=integer_2)
series_4 = Series(Start=0, Step=distance_3, Count=division)
distance_5 = Distance(PointA=list_item_10.Item, PointB=list_item_10.Item3)
distance_6 = Distance(PointA=list_item_11.Item, PointB=list_item_11.Item1)
addition_3 = Addition(A=distance_6, B=B_7)
series_5 = Series(Start=0, Step=addition_3, Count=count_3)
distance_7 = Distance(PointA=list_item_11.Item, PointB=list_item_11.Item3)
unit_x_2 = UnitX(Factor=series_3)  # -> graft(UnitVector)
move_6 = Move(Geometry=partition_list, Motion=unit_x)  # -> Geometry, Transform
B_8 = ClusterInput()
series_6 = Series(Start=0, Step=distance_5, Count=division_2)
unit_y = UnitY(Factor=series_4)
unit_x_3 = UnitX(Factor=series_5)  # -> graft(UnitVector)
addition_4 = Addition(A=distance_7, B=B_8)
series_7 = Series(Start=0, Step=addition_4, Count=division_3)
move_7 = Move(Geometry=partition_list_2, Motion=unit_x_2)  # -> Geometry, Transform
move_8 = Move(Geometry=move_6.Geometry, Motion=unit_y)  # -> flatten(Geometry), Transform
unit_y_2 = UnitY(Factor=series_6)
move_9 = Move(Geometry=partition_list_3, Motion=unit_x_3)  # -> Geometry, Transform
unit_y_3 = UnitY(Factor=series_7)
geometry = ClusterOutput(move_8.Geometry)
move_10 = Move(Geometry=move_7.Geometry, Motion=unit_y_2)  # -> flatten(Geometry), Transform
move_11 = Move(Geometry=move_9.Geometry, Motion=unit_y_3)  # -> flatten(Geometry), Transform
geometry_2 = ClusterOutput(move_10.Geometry)
geometry_3 = ClusterOutput(move_11.Geometry)
