# Grasshopper definition ImageSmapler124.gh (Grasshopper 1.0.7)
# plug-ins: Pufferfish

number_slider = Slider(31, range=0..100)
number_slider_2 = Slider(69, range=0..100)
planesrf = PlaneSurface(Plane=PlaneXY(0, 0, 0), XSize=Slider(48, range=0..1000), YSize=Slider(55, range=0..1000))
srf = Surface(reparameterize(planesrf))
brec = BoundingRectangle(Geometry=srf, Plane=PlaneXY(0, 0, 0), Axis=0, Slide=0, Union=True)  # -> Bounding, DimensionX, DimensionY
division = Division(A=brec.DimensionY, B=number_slider_2)
galapagos = Galapagos(fitness=division, gene=number_slider_2)
sdivide = DivideSurface(Surface=srf, UCount=number_slider, VCount=number_slider_2)  # -> Points, Normals, Parameters
panel = Panel(division)
pt = Point(flatten(sdivide.Points))
image = ImageSampler(
    sdivide.Parameters,
    FilePath="C:\Users\cforneri\Desktop\jiminy-cricket.png",
    Filter="Value",
    Interpolate=True,
    Umax=1,
    Umin=0,
    Vmax=1,
    Vmin=0,
    Wrap=1)
division_2 = Division(A=division, B=Slider(2, range=0..10))
pdecon = Deconstruct(Point=pt)  # -> XComponent, YComponent, ZComponent
addition = Addition(A=number_slider, B=Slider(1, range=0..1))
multiplication = Multiplication(A=division_2, B=-1)
sort = SortList(Keys=pdecon.YComponent, ValuesA=pt)  # -> Keys, ValuesA
partition = PartitionList(List=sort.ValuesA, Size=addition)
bnd = Bounds(Numbers=image)
pdecon_2 = Deconstruct(Point=partition)  # -> XComponent, YComponent, ZComponent
dom = ConstructDomain(DomainStart=Slider(0, range=0..100), DomainEnd=division_2)
remap = RemapNumbers(Value=image, Source=bnd, Target=dom)  # -> Mapped, Clipped
sort_2 = SortList(Keys=pdecon_2.XComponent, ValuesA=partition)  # -> Keys, ValuesA
number_slider_3 = Slider(0.5, range=0..1)
Y = UnitY(Factor=remap.Mapped)
nurbs = NurbsCurve(Vertices=sort_2.ValuesA, Degree=3, Periodic=False)  # -> Curve, Length, Domain
move = Move(Geometry=sdivide.Points, Motion=Y)  # -> flatten(Geometry), Transform
ext = ExtendCurve(Curve=nurbs.Curve, Type=0, Start=number_slider_3, End=number_slider_3)
pdecon_3 = Deconstruct(Point=move.Geometry)  # -> XComponent, YComponent, ZComponent
path = ConstructPath(Indices=Slider(14, range=0..100))
sort_3 = SortList(Keys=pdecon_3.YComponent, ValuesA=move.Geometry)  # -> Keys, ValuesA
partition_2 = PartitionList(List=sort_3.ValuesA, Size=addition)
branch = TreeBranch(Tree=simplify(partition_2), Path=path, MaintainPaths=True)
reb = RebuildCurve(Curve=ext, Count=2, Tangents=False)
pdecon_4 = Deconstruct(Point=partition_2)  # -> XComponent, YComponent, ZComponent
sort_4 = SortList(Keys=pdecon_4.XComponent, ValuesA=partition_2)  # -> Keys, ValuesA
crv = Curve(planesrf)
crv_2 = Curve(reb)
nurbs_2 = NurbsCurve(Vertices=sort_4.ValuesA, Degree=3, Periodic=False)  # -> flatten(Curve), Length, Domain
cull_i = CullIndex(List=nurbs_2.Curve, Indices=[Slider(0, range=0..100), number_slider_2], Wrap=True)
crv_3 = Curve(nurbs_2.Curve)
number_slider_4 = Slider(0.5, range=0..1)
crv_4 = Curve(<curve referenced from the Rhino model>)  # disabled
number_slider_5 = Slider(20, range=0..100)
ext_2 = ExtendCurve(Curve=crv_3, Type=0, Start=number_slider_4, End=number_slider_4)
trim = TrimWithRegion(Curve=[ext_2, crv_2], Region=crv_4)  # -> Inside, Outside; disabled
crv_5 = Curve(trim.Inside)  # disabled
