# Grasshopper definition MathAndSurfaces.GH (Grasshopper 1.0.7)

# Expressions and point series definition
step = Step(0.1)
step_2 = Step(0.1)

series = Series(Start=0, Step=step, Count=Slider(800, range=0..2100))
expression = Expression(
    x=series,
    a=Slider(0, range=0..10),
    b=Slider(2, range=0..4),
    c=Slider(0, range=0..4),
    Expression="(a*sin(x)^b)*(cos(x)^c)")
# Select to move by gumball
construct_point = ConstructPoint(XCoordinate=series, YCoordinate=expression, ZCoordinate=0)
interpolate = Interpolate(Vertices=construct_point, Degree=3, Periodic=False, KnotStyle=1)  # -> Curve, Length, Domain

step_3 = Step(0.1)

series_2 = Series(Start=0, Step=step_2, Count=Slider(300, range=0..2100))
expression_2 = Expression(
    x=series_2,
    a=Slider(0.23, range=0..10),
    b=Slider(0, range=0..4),
    c=Slider(3, range=0..4),
    Expression="(a*sin(x)^b)*(cos(x)^c)")
# Select to move by gumball
construct_point_2 = ConstructPoint(XCoordinate=series_2, YCoordinate=expression_2, ZCoordinate=0)
interpolate_2 = Interpolate(Vertices=construct_point_2, Degree=3, Periodic=False, KnotStyle=1)  # -> Curve, Length, Domain

series_3 = Series(Start=0, Step=step_3, Count=Slider(787, range=0..2100))
expression_3 = Expression(
    x=series_3,
    a=Slider(5.73, range=0..10),
    b=Slider(0, range=0..4),
    c=Slider(1, range=0..4),
    Expression="(a*sin(x)^b)*(cos(x)^c)")
# Select to move by gumball
construct_point_3 = ConstructPoint(XCoordinate=series_3, YCoordinate=expression_3, ZCoordinate=0)
interpolate_3 = Interpolate(Vertices=construct_point_3, Degree=3, Periodic=False, KnotStyle=1)  # -> Curve, Length, Domain

# ----
# Move them!
point = Point(Point(0, 0, 0))
point_on_curve = PointOnCurve(interpolate.Curve, parameter=0)
# Move them!
point_2 = Point(Point(0, 0, 79.69317636))
point_on_curve_2 = PointOnCurve(interpolate_2.Curve, parameter=0)
# Move them!
point_3 = Point(Point(10.13299685, 0, 24.54622375))
point_on_curve_3 = PointOnCurve(interpolate_3.Curve, parameter=0)
vector_2pt = Vector2Pt(PointA=point_on_curve, PointB=point, Unitize=False)  # -> Vector, Length
vector_2pt_2 = Vector2Pt(PointA=point_on_curve_2, PointB=point_3, Unitize=False)  # -> Vector, Length
vector_2pt_3 = Vector2Pt(PointA=point_on_curve_3, PointB=point_2, Unitize=False)  # -> Vector, Length
move = Move(Geometry=interpolate.Curve, Motion=vector_2pt.Vector)  # -> Geometry, Transform
move_2 = Move(Geometry=interpolate_2.Curve, Motion=vector_2pt_2.Vector)  # -> Geometry, Transform
move_3 = Move(Geometry=interpolate_3.Curve, Motion=vector_2pt_3.Vector)  # -> Geometry, Transform
loft_options = LoftOptions(Closed=False, Adjust=False, Rebuild=Slider(35, range=0..60), Refit=0, Type=0)
loft = Loft(Curves=[move.Geometry, move_2.Geometry, move_3.Geometry], Options=loft_options)
custom_preview = CustomPreview(
    Geometry=loft,
    Material={diffuse=RGB(221, 160, 221), emission=RGB(66, 48, 66), shine=0.5, specular=RGB(255, 255, 255), transparency=0})
