# Grasshopper definition Math_Attractor.gh (Grasshopper 1.0.7)
# plug-ins: Anemone

cir = Circle(Plane=PlaneXY(0, 0, 0), Radius=Slider(100, range=0..100))
# Base sphere
sph = Sphere(Base=PlaneXY(0, 0, 0), Radius=Slider(10, range=0..10))

# ----
# L O O P
loop_start = LoopStart(N=Slider(144, range=0..150), T=Button(), D0=sph, D1="0")  # -> port, Counter, Data, Data_2

multiplication = Multiplication(A=loop_start.Counter, B=Slider(0.01, range=0..0.01))
eval = EvaluateCurve(Curve=reparameterize(cir), Parameter=multiplication)  # -> Point, Tangent, Angle
addition = Addition(A=loop_start.Data_2, B=multiplication)
addition_2 = Addition(A=loop_start.Counter, B=Slider(1, range=0..1))
srf_cp = SurfaceClosestPoint(Point=eval.Point, Surface=loop_start.Data)  # -> Point, UVPoint, Distance
multiplication_2 = Multiplication(A=addition_2, B=Slider(0.15, range=0..1))
division = Division(A=Slider(5, range=0..10), B=multiplication_2)
sph_2 = Sphere(Base=srf_cp.Point, Radius=division)

loop_end = LoopEnd(
    port=loop_start.port,
    Exit=False,
    Data=sph_2,
    Data_2=addition,
    TimeOutVal=0,
    pausedState=False,
    state="Constant & Record")  # -> D0, D1

preview = CustomPreview(Geometry=loop_end.D0, Material=ColourSwatch(SwatchColor=RGB(255, 0, 0)))
