# Grasshopper definition Math_SineCurve.gh (Grasshopper 1.0.7)

crv = Curve(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)
divide = DivideCurve(Curve=crv, Count=10, Kinks=False)  # -> Points, Tangents, Parameters
lng = ListLength(List=divide.Points)
range = Range(Domain=Domain(0, 1), Steps=expr("x-1", lng))
number_slider = Slider(3.08, range=0..100)
graph = GraphMapper(
    range,
    x0=0,
    x1=-1,
    y0=0,
    y1=1,
    container_name="Sine",
    Equation_px=[0.0153987566, 0.1203007549],
    Equation_py=[0.01402878761, 0.9855072498])
bnd = Bounds(Numbers=graph)
neg = Negative(Value=number_slider)
dom = ConstructDomain(DomainStart=number_slider, DomainEnd=neg)
remap = RemapNumbers(Value=graph, Source=bnd, Target=dom)  # -> Mapped, Clipped
Z = UnitZ(Factor=1)
amp = Amplitude(Vector=Z, Amplitude=remap.Mapped)
move = Move(Geometry=divide.Points, Motion=amp)  # -> Geometry, Transform
intcrv = Interpolate(Vertices=move.Geometry, Degree=3, Periodic=False, KnotStyle=1)  # -> Curve, Length, Domain
