# Grasshopper definition Math_lorenzattractor.gh (Grasshopper 1.0.7)
# plug-ins: Anemone

# ----
# click on button
# to restart iteration
number_slider = Slider(559, range=0..1000)

# ----
# Start position
number_slider_2 = Slider(1, range=0..1)

sigma = Slider(12, range=0..100)
beta = Slider(6.2, range=0..100)
rho = Slider(28, range=0..100)

pt = ConstructPoint(XCoordinate=number_slider_2, YCoordinate=number_slider_2, ZCoordinate=number_slider_2)  # -> graft(Point)
step_size = Slider(0.01, range=0..0.01)

# ----
# L O O P
loop_start = LoopStart(Repeat=number_slider, Trigger=Button(), Data=pt)  # -> port, Counter, Data

pdecon = Deconstruct(Point=loop_start.Data)  # -> XComponent, YComponent, ZComponent

# ----
# X
expression = Expression(x=pdecon.XComponent, y=pdecon.YComponent, sigma=sigma, Expression="sigma*(y-x)")
multiplication = Multiplication(A=expression, B=step_size)
addition = Addition(A=pdecon.XComponent, B=multiplication)

# ----
# Y
expression_2 = Expression(x=pdecon.XComponent, y=pdecon.YComponent, z=pdecon.ZComponent, rho=rho, Expression="x*(rho-z)-y")
multiplication_2 = Multiplication(A=expression_2, B=step_size)
addition_2 = Addition(A=pdecon.YComponent, B=multiplication_2)

# ----
# Z
expression_3 = Expression(x=pdecon.XComponent, y=pdecon.YComponent, z=pdecon.ZComponent, beta=beta, Expression="x*y-beta*z")
multiplication_3 = Multiplication(A=expression_3, B=step_size)
addition_3 = Addition(A=pdecon.ZComponent, B=multiplication_3)

pt_2 = ConstructPoint(XCoordinate=addition, YCoordinate=addition_2, ZCoordinate=addition_3)  # -> graft(Point)

running = Running(port=loop_start.port, Exit=False, Data=pt_2, TimeOutVal=0, pausedState=False, state="Constant & Record")

data = Data(flatten(running))
cullpt = CullDuplicates(Points=data, Tolerance=0.1, CullMode=3)  # -> Points, Indices, Valence
nurbs = NurbsCurve(Vertices=cullpt.Points, Degree=3, Periodic=False)  # -> Curve, Length, Domain
pipe = Pipe(Curve=nurbs.Curve, Radius=1, Caps=Slider(1, range=0..10))
preview = CustomPreview(Geometry=pipe, Material=ColourSwatch(SwatchColor=RGB(0, 225, 255)))
