# Grasshopper definition Math_reciprocalFrames.ghx (Grasshopper 1.0.7)

beamthickness_h2_vertical = Slider(6, range=0..20)
extendbeyondintersection = Slider(6, range=0..20)
numberofelements = Slider(3, range=3..50)
beamwidth = Slider(2, range=0..20)
# info: A definition creating a reciprocal frame structure. any number of elements can be added.
# note: the beam height used as imput is not the actual size of the beam, but the vertical extrusion.
radius1 = Slider(120, range=0..200)
radius2 = Slider(45, range=0..200)
pt = ConstructPoint(XCoordinate=0, YCoordinate=0, ZCoordinate=0)

# ---- group: Calculations
eval = Evaluate(F="(2*pi)/x", x=numberofelements)
eval_2 = Evaluate(F="(r1^2 - (r2*cos(t/2))^2)^(1/2) - (2*r2*sin(t/2))/2", r1=radius1, r2=radius2, t=eval)
eval_3 = Evaluate(F="2*r2*sin(t/2)", r2=radius2, t=eval)
addition = Addition(A=eval_2, B=eval_3)
eval_4 = Evaluate(F="((x1/x)*h2)/(1 - x1/x)", x=addition, x1=eval_2, h2=beamthickness_h2_vertical)
addition_2 = Addition(A=eval_4, B=beamthickness_h2_vertical)
eval_5 = Evaluate(F="(x^2 + H^2)^(1/2)", x=addition, H=addition_2)

# ----
circle = CircleCNR(Center=pt, Normal=Vector(0, 0, 1), Radius=radius1)
circle_2 = CircleCNR(Center=pt, Normal=Vector(0, 0, 1), Radius=radius2)
divide = DivideCurve(Curve=circle, Count=numberofelements, Kinks=False)  # -> Points, Tangents, Parameters
circle_3 = CircleCNR(Center=divide.Points, Normal=Vector(0, 0, 1), Radius=eval_2)
vec2pt = Vector2Pt(PointA=divide.Points, PointB=pt, Unitize=False)  # -> Vector, Length
xy = XYPlane(Origin=divide.Points)
ccx = CurveCurve(CurveA=circle_2, CurveB=circle_3)  # -> Points, ParamsA, ParamsB
align = AlignPlane(Plane=xy, Direction=vec2pt.Vector)  # -> Plane, Angle
pt_2 = Point(ccx.Points)
weave = Weave(Pattern=[0, 1], Stream0=align.Plane, Stream1=align.Plane, NullGaps=False)
plcoord = PlaneCoordinates(Point=flatten(pt_2), System=weave)  # -> XCoordinate, YCoordinate, ZCoordinate
larger = LargerThan(FirstNumber=flatten(plcoord.YCoordinate), SecondNumber=0)  # -> LargerThan, OrEqualTo
dispatch = Dispatch(List=flatten(pt_2), DispatchPattern=larger.LargerThan)  # -> ListA, ListB
Z = UnitZ(Factor=eval_4)
pt_3 = Point(dispatch.ListA)
move = Move(Geometry=pt_3, Motion=Z)  # -> Geometry, Transform

# ---- group: projected lines
vec2pt_2 = Vector2Pt(PointA=divide.Points, PointB=pt_3, Unitize=False)  # -> Vector, Length
ln = Line(StartPoint=pt_3, EndPoint=divide.Points)
line = LineSDL(Start=divide.Points, Direction=vec2pt_2.Vector, Length=addition)

# ----
vec2pt_3 = Vector2Pt(PointA=divide.Points, PointB=move.Geometry, Unitize=False)  # -> Vector, Length
addition_3 = Addition(A=eval_5, B=extendbeyondintersection)
line_2 = LineSDL(Start=divide.Points, Direction=vec2pt_3.Vector, Length=addition_3)

pi = Pi(Factor=1)
Z_2 = UnitZ(Factor=1)
angle = Angle(VectorA=vec2pt_3.Vector, VectorB=Z_2)  # -> Angle, Reflex
division = Division(A=pi, B=2)
rotate = Rotate(Geometry=line, Angle=division, Plane=align.Plane)  # -> Geometry, Transform
subtraction = Subtraction(A=angle.Angle, B=division)

# ---- group: actual beam thickness
eval_6 = Evaluate(F="h2*cos(abs(pi/2-a))", a=angle.Angle, h2=beamthickness_h2_vertical)

# ----
panel = Panel(eval_6)
Z_3 = UnitZ(Factor=eval_6)
vrot = Rotate(Vector=Z_3, Axis=rotate.Geometry, Angle=subtraction)

# ---- group: surface
extr = Extrude(Base=line_2, Direction=vrot)

# ----
unit = UnitVector(Vector=rotate.Geometry)
division_2 = Division(A=beamwidth, B=2)
multiplication = Multiplication(A=unit, B=division_2)
move_2 = Move(Geometry=extr, Motion=multiplication)  # -> Geometry, Transform
eval_7 = Evaluate(F="-x*y", x=unit, y=beamwidth)

# ---- group: Geometry
extr_2 = Extrude(Base=move_2.Geometry, Direction=eval_7)
