# Grasshopper definition Miscellaneous-01.gh (Grasshopper 1.0.7)
# plug-ins: Noise 4D, Anemone

cir = Circle(Plane=PlaneXY(0, 0, 0), Radius=Slider(58, range=0..100))
area = Area(Geometry=cir)  # -> Area, Centroid
fastloopstart = FastLoopStart(I=Slider(70, range=0..100), D0=cir, D1=area.Centroid)  # -> port, Counter, Data, Data_2
crv = Curve(fastloopstart.Data)
len = Length(Curve=crv)
division = Division(A=len, B=Slider(3, range=0..10))
max = Maximum(A=division, B="3")
divide = DivideCurve(Curve=crv, Count=max, Kinks=False)  # -> Points, Tangents, Parameters
number_slider = Slider(1, range=0..1)
area_2 = Area(Geometry=crv)  # -> Area, Centroid
pt = Point(fastloopstart.Data_2)
dom = ConstructDomain(DomainStart=number_slider, DomainEnd=Slider(10, range=0..10))
multiplication = Multiplication(A=fastloopstart.Counter, B=Slider(0.4333, range=0..1))
random = Random(Range=dom, Number=1, Seed=area_2.Area)
vec2pt = Vector2Pt(PointA=pt, PointB=divide.Points, Unitize=False)  # -> Vector, Length
perlin = PerlinNoise(Values=divide.Points, Time=multiplication, Scale=Slider(0.02, range=0..1))
bnd = Bounds(Numbers=perlin)
dom_2 = ConstructDomain(DomainStart=number_slider, DomainEnd=random)
remap = RemapNumbers(Value=perlin, Source=bnd, Target=dom_2)  # -> Mapped, Clipped
amp = Amplitude(Vector=vec2pt.Vector, Amplitude=remap.Mapped)
move = Move(Geometry=divide.Points, Motion=amp)  # -> Geometry, Transform
intcrv = Interpolate(Vertices=move.Geometry, Degree=3, Periodic=True, KnotStyle=1)  # -> Curve, Length, Domain
fastloopend = FastLoopEnd(port=fastloopstart.port, Exit=False, Data=intcrv.Curve, Data_2=fastloopstart.Data_2, RecordData=True, TimeOutVal=0)  # -> D0, D1
crv_2 = Curve(flatten(fastloopend.D0))
item = ListItem(List=reverse(crv_2), Index=0, Wrap=True)
cp = ControlPoints(Curve=item)  # -> Points, Weights, Knots
lng = ListLength(List=cp.Points)
divide_2 = DivideCurve(Curve=crv_2, Count=lng, Kinks=False)  # -> Points, Tangents, Parameters
pline = PolyLine(Vertices=divide_2.Points, Closed=True)  # -> flatten(Polyline)
lng_2 = ListLength(List=pline)
series = Series(Start=0, Step=1, Count=lng_2)
consec = ConsecutiveDomains(Numbers=series, Additive=False)
subset = SubList(List=crv_2, Domain=consec, Wrap=True)  # -> List, Index
item_2 = ListItem(List=crv_2, Index=0, Wrap=True)
loft = Loft(Curves=subset.List, Options={Adjust=False, Closed=False, LoftEnds=0, LoftSimp=0, LoftType=0, Rebuild=10, Refit=0.01})  # -> flatten(Loft)
boundary = BoundarySurfaces(Edges=item_2)  # -> flatten(Surfaces)
merge = Merge(Data1=boundary, Data2=loft)
smooth = SettingsQuality()
lng_3 = ListLength(List=merge)  # -> expr("x-1", Length)
range = Range(Domain=Domain(0, 1), Steps=lng_3)
mesh = MeshBrep(Brep=merge, Settings=smooth)
gradient = Gradient(
    LowerLimit=0,
    UpperLimit=1,
    Parameter=range,
    stops=[0.0805: RGB(135, 4, 4), 0.462: RGB(243, 57, 0), 0.547: RGB(103, 0, 120), 0.75: RGB(220, 237, 33), 0.891: RGB(52, 168, 191), 1: RGB(39, 72, 161)])
preview = CustomPreview(Geometry=mesh, Shader=gradient)
