# Grasshopper definition Miscellaneous-02.gh (Grasshopper 1.0.7)

number_slider = Slider(100, range=0..100)
rectangle = Rectangle(Plane=PlaneXY(0, 0, 0), XSize=number_slider, YSize=number_slider, Radius=0)  # -> Rectangle, Length
range = Range(Domain=Domain(0, 1), Steps=Slider(10, range=0..20))
pop2d = Populate2D(Region=rectangle.Rectangle, Count=Slider(100, range=0..100), Seed=1)
dom = ConstructDomain(DomainStart=Slider(0.01, range=0..1), DomainEnd=Slider(0.156, range=0..1))
sqr = Square(Value=range)
lng = ListLength(List=pop2d)
dom_2 = ConstructDomain(DomainStart=Slider(0.5, range=0..1), DomainEnd=Slider(1, range=0..1))
remap = RemapNumbers(Value=sqr, Source=Domain(0, 1), Target=dom)  # -> flatten(Mapped), Clipped
random = Random(Range=Domain(0, 1), Number=lng, Seed=dom_2)
metaball_t = MetaBallT(Points=pop2d, Plane=PlaneXY(0, 0, 0), Threshold=remap.Mapped)
metaball_t_2 = MetaBallTCustom(Points=pop2d, Charge=random, Plane=PlaneXY(0, 0, 0), Threshold=remap.Mapped)  # -> simplify(Isocurve)
crv = Curve(metaball_t_2)
viewer = ParamViewer(crv)
rev = ReverseList(List=viewer)
item = ListItem(List=rev, Index=0, Wrap=True)
group = Group(Objects=crv)  # -> flatten(Group)
shift = ShiftList(List=group, Shift=1, Wrap=False)  # -> graft(List)
shift_2 = ShiftList(List=group, Shift=-1, Wrap=False)  # -> graft(List)
merge = Merge(Data1=simplify(shift), Data2=simplify(shift_2))
ungroup = Ungroup(Group=merge)  # -> simplify(Objects)
pshift = ShiftPaths(Data=ungroup, Offset=-1)
branch = TreeBranch(Tree=crv, Path=item, MaintainPaths=True)
merge_2 = Merge(Data1=pshift, Data2=branch)
md_slider = MDSlider(SliderMode=0, slider_value=Point(0.5, 0.5, 0.5), x_domain=Domain(0, 1), y_domain=Domain(0, 1), z_domain=Domain(0, 1))
boundary = BoundarySurfaces(Edges=merge_2)
evalsrf = EvaluateSurface(Surface=reparameterize(boundary), Point=md_slider)  # -> Point, Normal, Frame
Z = UnitZ(Factor=1)
dprod = DotProduct(VectorA=Z, VectorB=evalsrf.Normal, Unitize=False)
larger = LargerThan(FirstNumber=dprod, SecondNumber=0)  # -> LargerThan, OrEqualTo
dispatch = Dispatch(List=boundary, DispatchPattern=larger.LargerThan)  # -> ListA, ListB
flip = Flip(Surface=dispatch.ListB)  # -> Surface, Result
merge_3 = Merge(Data1=dispatch.ListA, Data2=flip.Surface)
tstat = TreeStatistics(Tree=merge_3)  # -> Paths, Length, Count
lng_2 = ListLength(List=tstat.Paths)  # -> expr("x-1", Length)
range_2 = Range(Domain=Domain(0, 1), Steps=lng_2)
gradient = Gradient(
    LowerLimit=0,
    UpperLimit=1,
    Parameter=range_2,
    stops=[0: RGB(5, 61, 181), 0.489: RGB(88, 155, 209), 1: RGB(171, 255, 240)])
graft = GraftTree(Tree=gradient, IncludeEmptyLists=True, IncludeNullItems=True)  # -> simplify(Tree)
preview = CustomPreview(Geometry=merge_3, Shader=graft)
