# Grasshopper definition Organic_01.gh (Grasshopper 1.0.7)
# plug-ins: Anemone

number_slider = Slider(5.2, range=0..10)
pt = ConstructPoint(XCoordinate=0, YCoordinate=0, ZCoordinate=0)
cir = Circle(Plane=pt, Radius=number_slider)
popgeo = PopulateGeometry(Geometry=cir, Count=Slider(5, range=0..10), Seed=1)
ln = Line(StartPoint=pt, EndPoint=popgeo)
fastloopstart = FastLoopStart(I=Slider(10, range=0..15), D0=number_slider, D1=ln)  # -> port, Counter, Data, Data_2
rad = Radians(Degrees=Slider(34.5, range=0..100))
addition = Addition(A=fastloopstart.Data, B=number_slider)
remap = RemapNumbers(Value=addition, Source=number_slider, Target=rad)  # -> Mapped, Clipped
end = EndPoints(Curve=fastloopstart.Data_2)  # -> Start, End
sin = Sine(Value=remap.Mapped)
pt_2 = Point(end.End)
multiplication = Multiplication(A=sin, B=Slider(1.5, range=0..10))
cir_2 = Circle(Plane=pt, Radius=addition)
Z = UnitZ(Factor=multiplication)
lng = ListLength(List=pt_2)
random = Random(Range=Domain(0, 1), Number=lng, Seed=2)
move = Move(Geometry=cir_2, Motion=Z)  # -> Geometry, Transform
graft = GraftTree(Tree=pt_2, IncludeEmptyLists=True, IncludeNullItems=True)
smaller = SmallerThan(FirstNumber=random, SecondNumber=Slider(0.3, range=0..1))  # -> SmallerThan, OrEqualTo
addition_2 = Addition(A=smaller.SmallerThan, B=1)  # -> graft(Result)
dup = DuplicateData(Data=graft, Number=addition_2, Order=True)  # -> simplify(Data)
flatten = FlattenTree(Tree=dup, Path="{0}")
lng_2 = ListLength(List=flatten)
popgeo_2 = PopulateGeometry(Geometry=move.Geometry, Count=lng_2, Seed=1)
cp = ClosestPoint(Point=popgeo_2, Cloud=flatten)  # -> ClosestPoint, CPIndex, Distance
ln_2 = Line(StartPoint=cp.ClosestPoint, EndPoint=popgeo_2)
fastloopend = FastLoopEnd(port=fastloopstart.port, Exit=False, Data=addition, Data_2=ln_2, RecordData=True, TimeOutVal=0)  # -> D0, simplify(D1)
merge = Merge(Data1=ln, Data2=fastloopend.D1)
Z_2 = UnitZ(Factor=Slider(2, range=0..2))
xy = XYPlane(Origin=Point(0, 0, 0))
panel = Panel(fastloopend.D0)
move_2 = Move(Geometry=merge, Motion=Z_2)  # -> Geometry, Transform
project = Project(Geometry=move_2.Geometry, Plane=xy)  # -> Geometry, Transform
graft_2 = GraftTree(Tree=move_2.Geometry, IncludeEmptyLists=True, IncludeNullItems=True)
graft_3 = GraftTree(Tree=project.Geometry, IncludeEmptyLists=True, IncludeNullItems=True)
merge_2 = Merge(Data1=graft_2, Data2=graft_3)
swatch = ColourSwatch(SwatchColor=RGB(255, 255, 255))
loft = Loft(Curves=merge_2, Options={Adjust=False, Closed=False, LoftEnds=0, LoftSimp=0, LoftType=0, Rebuild=10, Refit=0.01})
smesh = SimpleMesh(Brep=loft)
flatten_2 = FlattenTree(Tree=smesh, Path="{0}")
mjoin = MeshJoin(Meshes=flatten_2)
demesh = DeconstructMesh(Mesh=mjoin)  # -> Vertices, Faces, Colours, Normals
pt_3 = Point(pt)
dist = Distance(PointA=pt_3, PointB=demesh.Vertices)
bnd = Bounds(Numbers=flatten(dist))
remap_2 = RemapNumbers(Value=dist, Source=bnd, Target=Domain(0, 1))  # -> Mapped, Clipped
gradient = Gradient(
    LowerLimit=0,
    UpperLimit=1,
    Parameter=remap_2.Mapped,
    stops=[0: RGB(56, 0, 240), 0.475: RGB(194, 228, 255), 1: RGB(147, 124, 252)])
mcol = MeshColours(Mesh=mjoin, Colours=gradient)
