# Grasshopper definition Rigging_Scissors.gh (Grasshopper 1.0.7)
# plug-ins: Anemone

length = Slider(45.83, range=5..100)
start = Start(Point(0, 0, 0))
unit_y = UnitY(Factor=1)
rotation = Slider(32.375, range=10..60)
line_sdl = LineSDL(Start=start, Direction=unit_y, Length=length)
rotate_3d = Rotate3D(Geometry=line_sdl, Angle=expr("-x", degrees(rotation)), Center=start, Axis=Vector(0, 0, 1))  # -> Geometry, Transform
# The base module
# You can control the :
# - location of the pin
# - size of the scissors
# - Opening degree
pin_location = Slider(0.671, range=0..1)
evaluate_curve = EvaluateCurve(Curve=reparameterize(rotate_3d.Geometry), Parameter=pin_location)  # -> Point, Tangent, Angle
unit_z = UnitZ(Factor=1)
yz_plane = YZPlane(Origin=evaluate_curve.Point)
rotate_3d_2 = Rotate3D(Geometry=yz_plane, Angle=degrees(0), Center=yz_plane, Axis=unit_z)  # -> Geometry, Transform
mirror = Mirror(Geometry=rotate_3d.Geometry, Plane=rotate_3d_2.Geometry)  # -> Geometry, Transform
curve = Curve(rotate_3d.Geometry)
curve_2 = Curve([curve, mirror.Geometry])

length_2 = Slider(45.19, range=5..100)
unit_y_2 = UnitY(Factor=1)
exact_degree = Slider(54.669, range=10..60)
start_2 = Start(Point(0, 0, 0))
line_sdl_2 = LineSDL(Start=start_2, Direction=unit_y_2, Length=length_2)
rotate_3d_3 = Rotate3D(Geometry=line_sdl_2, Angle=expr("-x", degrees(exact_degree)), Center=start_2, Axis=Vector(0, 0, 1))  # -> Geometry, Transform
t = Slider(0.629, range=0..1)
evaluate_curve_2 = EvaluateCurve(Curve=reparameterize(rotate_3d_3.Geometry), Parameter=t)  # -> Point, Tangent, Angle
unit_z_2 = UnitZ(Factor=1)
yz_plane_2 = YZPlane(Origin=evaluate_curve_2.Point)
rotate_3d_4 = Rotate3D(Geometry=yz_plane_2, Angle=degrees(0), Center=yz_plane_2, Axis=unit_z_2)  # -> Geometry, Transform
mirror_2 = Mirror(Geometry=rotate_3d_3.Geometry, Plane=rotate_3d_4.Geometry)  # -> Geometry, Transform
curve_3 = Curve(rotate_3d_3.Geometry)
curve_4 = Curve([curve_3, mirror_2.Geometry])
# Example with an exact looped scissor
fast_loop_start = FastLoopStart(Iterations=Slider(7, range=0..10), Data=curve_4)  # -> port, Counter, Data
curve_5 = Curve(fast_loop_start.Data)
list_item = ListItem(List=curve_5, Index=0, Wrap=True)  # -> Item, Item1
point_on_curve = PointOnCurve(list_item.Item, parameter=1)
point_on_curve_2 = PointOnCurve(list_item.Item1, parameter=0)
unit_z_3 = UnitZ(Factor=1)
vector_2pt = Vector2Pt(PointA=point_on_curve_2, PointB=point_on_curve, Unitize=False)  # -> Vector, Length
construct_plane = ConstructPlane(Origin=point_on_curve_2, XAxis=vector_2pt.Vector, YAxis=unit_z_3)
mirror_3 = Mirror(Geometry=curve_5, Plane=construct_plane)  # -> Geometry, Transform
flip_curve = FlipCurve(Curve=mirror_3.Geometry)  # -> Curve, Flag
fast_loop_end = FastLoopEnd(port=fast_loop_start.port, Exit=False, Data=flip_curve.Curve, RecordData=True, TimeOutVal=0)  # -> flatten(Data)
curve_6 = Curve([curve_4, fast_loop_end])
r_holes = Slider(1, range=0.2..1.2)
width = Slider(1.86, range=0..10)
thickness = Slider(1.48, range=0..10)
dispatch = Dispatch(List=curve_6, DispatchPattern=[True, False, False, True])  # -> ListA, ListB
curve_7 = Curve(dispatch.ListA)
curve_8 = Curve(dispatch.ListB)
curve_curve = CurveCurve(CurveA=dispatch.ListA, CurveB=dispatch.ListB)  # -> Points, ParamsA, ParamsB
pipe = Pipe(Curve=curve_7, Radius=width, Caps=2)
end_points = EndPoints(Curve=curve_7)  # -> Start, End
end_points_2 = EndPoints(Curve=curve_8)  # -> Start, End
pipe_2 = Pipe(Curve=curve_8, Radius=width, Caps=2)
brep_plane = BrepPlane(Brep=pipe, Plane=PlaneXY(0, 0, 0))  # -> Curves, Points
circle = Circle(Plane=[end_points.Start, end_points.End, curve_curve.Points], Radius=r_holes)
brep_plane_2 = BrepPlane(Brep=pipe_2, Plane=PlaneXY(0, 0, 0))  # -> Curves, Points
circle_2 = Circle(Plane=[end_points_2.Start, end_points_2.End, curve_curve.Points], Radius=r_holes)
unit_z_4 = UnitZ(Factor=thickness)
boundary_surfaces = BoundarySurfaces(Edges=flatten([brep_plane.Curves, circle]))
unit_z_5 = UnitZ(Factor=thickness)
boundary_surfaces_2 = BoundarySurfaces(Edges=flatten([brep_plane_2.Curves, circle_2]))
move = Move(Geometry=boundary_surfaces_2, Motion=unit_z_5)  # -> Geometry, Transform
extrude = Extrude(Base=move.Geometry, Direction=unit_z_5)
extrude_2 = Extrude(Base=boundary_surfaces, Direction=unit_z_4)
brep_edges = BrepEdges(Brep=[extrude_2, extrude])  # -> Naked, Interior, NonManifold
custom_preview = CustomPreview(Geometry=extrude_2, Material=ColourSwatch(SwatchColor=RGB(205, 255, 5)))
custom_preview_2 = CustomPreview(Geometry=extrude, Material=ColourSwatch(SwatchColor=RGB(207, 29, 5)))

count = Slider(10, range=0..10)
fast_loop_start_2 = FastLoopStart(Iterations=count, Data=curve_2)  # -> port, Counter, Data
curve_9 = Curve(fast_loop_start_2.Data)
list_item_2 = ListItem(List=curve_9, Index=0, Wrap=True)  # -> Item, Item1
point_on_curve_3 = PointOnCurve(list_item_2.Item, parameter=1)
point_on_curve_4 = PointOnCurve(list_item_2.Item1, parameter=0)
# Find other modules based on plane
unit_z_6 = UnitZ(Factor=1)
vector_2pt_2 = Vector2Pt(PointA=point_on_curve_4, PointB=point_on_curve_3, Unitize=False)  # -> Vector, Length
construct_plane_2 = ConstructPlane(Origin=point_on_curve_4, XAxis=vector_2pt_2.Vector, YAxis=unit_z_6)
mirror_4 = Mirror(Geometry=curve_9, Plane=construct_plane_2)  # -> Geometry, Transform
flip_curve_2 = FlipCurve(Curve=mirror_4.Geometry)  # -> Curve, Flag
fast_loop_end_2 = FastLoopEnd(port=fast_loop_start_2.port, Exit=False, Data=flip_curve_2.Curve, RecordData=True, TimeOutVal=0)  # -> flatten(Data)
curve_10 = Curve([curve_2, fast_loop_end_2])

r_holes_2 = Slider(1, range=0.2..1.2)
width_2 = Slider(1.86, range=0..10)
thickness_2 = Slider(1.48, range=0..10)

dispatch_2 = Dispatch(List=curve_10, DispatchPattern=[True, False, False, True])  # -> ListA, ListB
curve_11 = Curve(dispatch_2.ListA)
curve_12 = Curve(dispatch_2.ListB)
curve_curve_2 = CurveCurve(CurveA=dispatch_2.ListA, CurveB=dispatch_2.ListB)  # -> Points, ParamsA, ParamsB
pipe_3 = Pipe(Curve=curve_11, Radius=width_2, Caps=2)
end_points_3 = EndPoints(Curve=curve_11)  # -> Start, End
end_points_4 = EndPoints(Curve=curve_12)  # -> Start, End
# Turn the lines into 3D!
pipe_4 = Pipe(Curve=curve_12, Radius=width_2, Caps=2)
brep_plane_3 = BrepPlane(Brep=pipe_3, Plane=PlaneXY(0, 0, 0))  # -> Curves, Points
circle_3 = Circle(Plane=[end_points_3.Start, end_points_3.End, curve_curve_2.Points], Radius=r_holes_2)
brep_plane_4 = BrepPlane(Brep=pipe_4, Plane=PlaneXY(0, 0, 0))  # -> Curves, Points
circle_4 = Circle(Plane=[end_points_4.Start, end_points_4.End, curve_curve_2.Points], Radius=r_holes_2)
unit_z_7 = UnitZ(Factor=thickness_2)
boundary_surfaces_3 = BoundarySurfaces(Edges=flatten([brep_plane_3.Curves, circle_3]))
unit_z_8 = UnitZ(Factor=thickness_2)
boundary_surfaces_4 = BoundarySurfaces(Edges=flatten([brep_plane_4.Curves, circle_4]))
move_2 = Move(Geometry=boundary_surfaces_4, Motion=unit_z_8)  # -> Geometry, Transform

extrude_3 = Extrude(Base=move_2.Geometry, Direction=unit_z_8)
extrude_4 = Extrude(Base=boundary_surfaces_3, Direction=unit_z_7)
brep_edges_2 = BrepEdges(Brep=[extrude_4, extrude_3])  # -> Naked, Interior, NonManifold
custom_preview_3 = CustomPreview(Geometry=extrude_3, Material=ColourSwatch(SwatchColor=RGB(0, 255, 251)))
custom_preview_4 = CustomPreview(Geometry=extrude_4, Material=ColourSwatch(SwatchColor=RGB(255, 220, 219)))
