# Grasshopper definition Surface_Louvering.gh (Grasshopper 1.0.7)
# plug-ins: Kangaroo Components, Noise 4D

cir = Circle(Plane=PlaneXY(0, 0, 0), Radius=Slider(100, range=0..100))
Z = UnitZ(Factor=Slider(533, range=0..1000))
extr = Extrude(Base=cir, Direction=Z)
srf = Surface(reparameterize(extr))
sdivide = DivideSurface(Surface=srf, UCount=Slider(30, range=0..30), VCount=Slider(30, range=0..30))  # -> Points, Normals, Parameters
number_slider = Slider(1.2, range=0..10)
duppt = RemoveDuplicatePts(Points=sdivide.Points, Tolerance=0.01)
preview = CustomPreview(Geometry=srf, Shader=ColourSwatch(SwatchColor=RGB(140, 247, 255)))
avr = Average(Input=duppt)
scale_nu = ScaleNU(Geometry=sdivide.Points, Plane=avr, ScaleX=number_slider, ScaleY=number_slider, ScaleZ=1)  # -> Geometry, Transform
number_slider_2 = Slider(5, range=0..15)
Z_2 = UnitZ(Factor=1)
pl = ConstructPlane(Origin=scale_nu.Geometry, XAxis=sdivide.Normals, YAxis=Z_2)
neg = Negative(Value=number_slider_2)
dom = ConstructDomain(DomainStart=neg, DomainEnd=number_slider_2)
perlin = PerlinNoise(Values=sdivide.Points, Time=Slider(1, range=0..1), Scale=Slider(0.01866, range=0..0.1))  # -> simplify(OutputNoise)
number_slider_3 = Slider(0.4, range=0..1)
rectangle = Rectangle(Plane=pl, XSize=dom, YSize=dom, Radius=0)  # -> simplify(Rectangle), Length
smaller = SmallerThan(FirstNumber=perlin, SecondNumber=0)  # -> SmallerThan, OrEqualTo
rotate = Rotate(Geometry=rectangle.Rectangle, Angle="Rad(45)", Plane=pl)  # -> simplify(Geometry), Transform
not = GateNot(A=smaller.SmallerThan)
max = Maximum(A=number_slider_3, B=smaller.SmallerThan)
max_2 = Maximum(A=number_slider_3, B=not)
scale_nu_2 = ScaleNU(Geometry=rotate.Geometry, Plane=pl, ScaleX=max, ScaleY=max_2, ScaleZ=1)  # -> simplify(Geometry), Transform
cull_i = CullIndex(List=scale_nu_2.Geometry, Indices=0, Wrap=True)
loft = Loft(Curves=cull_i, Options={Adjust=False, Closed=True, LoftEnds=0, LoftSimp=0, LoftType=0, Rebuild=10, Refit=0.01})
preview_2 = CustomPreview(Geometry=loft, Shader=ColourSwatch(SwatchColor=RGB(255, 147, 59)))
