# Grasshopper definition Surface_ShortestWalk.gh (Grasshopper 1.0.7)

# ---- group: finding next point
starting_point = Point(<point referenced from the Rhino model>)
ending_point = Point(<point referenced from the Rhino model>)
srf = Surface(<surface referenced from the Rhino model>)
vb = VBScript(srf=srf, stp=starting_point, edp=ending_point, res=Slider(0.5, range=0..1), slope=Slider(6, range=1..12))  # -> out, A; inputs srf: Surface, stp: Point3d, edp: Point3d
# ---------- vb: VB ----------
    '///// get the shortest path on a surface

    Dim u0,u1,v0,v1 As Double
    srf.ClosestPoint(stp, u0, v0)
    srf.ClosestPoint(edp, u1, v1)

    Dim stp2d As New Point2d(u0, v0)
    Dim edp2d As New Point2d(u1, v1)

    Dim short_path As curve = srf.ShortPath(stp2d, edp2d, 0)

    '///// get the slope vector on the path

    Dim slope_vec As vector3d = short_path.TangentAt(0)
    slope_vec.Unitize

    '///// get the slope of the vector on the path (with z vector)

    Dim angle As Double = vector3d.VectorAngle(vector3d.ZAxis, slope_vec)
    angle = angle / (math.PI) * 180

    '///// set max/min walkable slope angles

    Dim refslope As Double = math.Atan(1 / slope)
    Dim dnhillslope, uphillslope As Double
    uphillslope = 90 - refslope / (math.PI ) * 180
    dnhillslope = 90 + refslope / (math.PI ) * 180

    '///// check cases based on angle

    Dim vec_out As vector3d

    If angle < uphillslope Or angle > dnhillslope Then

      Dim nor_vec As New vector3d(srf.NormalAt(u0, v0))
      Dim vec_out_cw, vec_out_ccw As vector3d
      Dim slope_vec_rot_cw As vector3d = slope_vec
      Dim slope_vec_rot_ccw As vector3d = slope_vec

      For i As Integer = 0 To -180 Step -5
        slope_vec_rot_cw.Rotate(i * math.PI / 180, nor_vec)
        Dim check_angle As Double = vector3d.VectorAngle(vector3d.ZAxis, slope_vec_rot_cw)
        check_angle = check_angle / (math.PI) * 180
        If check_angle >= uphillslope And check_angle <= dnhillslope Then
          vec_out_cw = slope_vec_rot_cw
          Exit For
        End If
      Next

      For i As Integer = 0 To 180 Step 5
        slope_vec_rot_ccw.Rotate(i * math.PI / 180, nor_vec)
        Dim check_angle As Double = vector3d.VectorAngle(vector3d.ZAxis, slope_vec_rot_ccw)
        check_angle = check_angle / (math.PI) * 180
        If check_angle >= uphillslope And check_angle <= dnhillslope Then
          vec_out_ccw = slope_vec_rot_ccw
          Exit For
        End If
      Next

      Dim check_pt_cw As Point3d = stp + vec_out_cw
      Dim check_pt_ccw As Point3d = stp + vec_out_ccw

      Dim check_dist_cw As Double = edp.DistanceTo(check_pt_cw)
      Dim check_dist_ccw As Double = edp.DistanceTo(check_pt_ccw)

      If check_dist_cw > check_dist_ccw Then
        vec_out = vec_out_ccw
      Else
        vec_out = vec_out_cw
      End If

    Else

      vec_out = slope_vec

    End If

    Dim nextpt As point3d = stp + vec_out * res

    Dim u,v As Double

    srf.ClosestPoint(nextpt, u, v)

    Dim output_pt As point3d = srf.PointAt(u, v)


    A = output_pt
# ---------- end vb ----------

# ---- group: system
starting_point_2 = Point(<point referenced from the Rhino model>)
ending_point_2 = Point(<point referenced from the Rhino model>)
srf_2 = Surface(<surface referenced from the Rhino model>)
vb_2 = VBScript(srf=srf, stp=starting_point, edp=ending_point, res=Slider(0.5, range=0..1), slope=Slider(6, range=1..12))  # -> out, A; inputs srf: Surface, stp: Point3d, edp: Point3d
# ---------- vb_2: VB ----------
    Dim input_pt As Point3d = stp
    Dim output_pt As point3d
    Dim output_pt_list As New List(Of point3d)
    output_pt_list.Add(input_pt)

    For i As Integer = 0 To 50

      NextPoint(srf, input_pt, edp, res, slope, output_pt)

      Dim dist_check As Double = output_pt.DistanceTo(edp)

      If dist_check < res Then
        output_pt_list.add(edp)
        Exit For
      Else
        output_pt_list.add(output_pt)
        input_pt = output_pt
      End If

    Next

    Dim path As Curve = curve.CreateInterpolatedCurve(output_pt_list.ToArray, 3)

    A = path
# ---------- vb_2: VB additional code ----------
  Private Sub NextPoint(ByVal srf As Surface, ByVal stp As Point3d, ByVal edp As Point3d, ByVal res As Double, ByVal slope As Integer, ByRef A As Object)

    '///// get the shortest path on a surface

    Dim u0,u1,v0,v1 As Double
    srf.ClosestPoint(stp, u0, v0)
    srf.ClosestPoint(edp, u1, v1)

    Dim stp2d As New Point2d(u0, v0)
    Dim edp2d As New Point2d(u1, v1)

    Dim short_path As curve = srf.ShortPath(stp2d, edp2d, 0)

    '///// get the slope vector on the path

    Dim slope_vec As vector3d = short_path.TangentAt(0)
    slope_vec.Unitize

    '///// get the slope of the vector on the path (with z vector)

    Dim angle As Double = vector3d.VectorAngle(vector3d.ZAxis, slope_vec)
    angle = angle / (math.PI) * 180

    '///// set max/min walkable slope angles

    Dim refslope As Double = math.Atan(1 / slope)
    Dim dnhillslope, uphillslope As Double
    uphillslope = 90 - refslope / (math.PI ) * 180
    dnhillslope = 90 + refslope / (math.PI ) * 180

    '///// check cases based on angle

    Dim vec_out As vector3d

    If angle < uphillslope Or angle > dnhillslope Then

      Dim nor_vec As New vector3d(srf.NormalAt(u0, v0))
      Dim vec_out_cw, vec_out_ccw As vector3d
      Dim slope_vec_rot_cw As vector3d = slope_vec
      Dim slope_vec_rot_ccw As vector3d = slope_vec

      For i As Integer = 0 To -180 Step -5
        slope_vec_rot_cw.Rotate(i * math.PI / 180, nor_vec)
        Dim check_angle As Double = vector3d.VectorAngle(vector3d.ZAxis, slope_vec_rot_cw)
        check_angle = check_angle / (math.PI) * 180
        If check_angle >= uphillslope And check_angle <= dnhillslope Then
          vec_out_cw = slope_vec_rot_cw
          Exit For
        End If
      Next

      For i As Integer = 0 To 180 Step 5
        slope_vec_rot_ccw.Rotate(i * math.PI / 180, nor_vec)
        Dim check_angle As Double = vector3d.VectorAngle(vector3d.ZAxis, slope_vec_rot_ccw)
        check_angle = check_angle / (math.PI) * 180
        If check_angle >= uphillslope And check_angle <= dnhillslope Then
          vec_out_ccw = slope_vec_rot_ccw
          Exit For
        End If
      Next

      Dim check_pt_cw As Point3d = stp + vec_out_cw
      Dim check_pt_ccw As Point3d = stp + vec_out_ccw

      Dim check_dist_cw As Double = edp.DistanceTo(check_pt_cw)
      Dim check_dist_ccw As Double = edp.DistanceTo(check_pt_ccw)

      If check_dist_cw > check_dist_ccw Then
        vec_out = vec_out_ccw
      Else
        vec_out = vec_out_cw
      End If

    Else

      vec_out = slope_vec

    End If

    Dim nextpt As point3d = stp + vec_out * res

    Dim u,v As Double

    srf.ClosestPoint(nextpt, u, v)

    Dim output_pt As point3d = srf.PointAt(u, v)

    A = output_pt

  End Sub
# ---------- end vb_2 ----------
