# Grasshopper definition Surfaces-02.gh (Grasshopper 1.0.7)
# plug-ins: Bifocals

construct_domain = ConstructDomain(DomainStart=Slider(4, range=2.2..12.5), DomainEnd=Slider(11.2, range=2.2..52.5))
range = Range(Domain=construct_domain, Steps=Slider(4, range=3..16))
plane = Plane(PlaneXY(0, 0, 0))
circle = Circle(Plane=plane, Radius=range)
divide_curve = DivideCurve(Curve=circle, Count=Slider(16, range=6..20), Kinks=False)  # -> simplify(Points), Tangents, Parameters
shift_list = ShiftList(List=divide_curve.Points, Shift=1, Wrap=True)
partition_list = PartitionList(List=shift_list, Size="2")
number_slider = Slider(5.34, range=0..10)
partition_list_2 = PartitionList(List=divide_curve.Points, Size="2")
list_item = ListItem(List=partition_list, Index=0, Wrap=True)  # -> Item, Item1
unit_z = UnitZ(Factor=1)
unit_z_2 = UnitZ(Factor=1)
list_item_2 = ListItem(List=partition_list_2, Index=0, Wrap=True)  # -> Item, Item1
catenary = Catenary(PointA=list_item_2.Item, PointB=list_item_2.Item1, Length=number_slider, Gravity=expr("-x", unit_z))  # -> simplify(Catenary)
catenary_2 = Catenary(PointA=list_item.Item, PointB=list_item.Item1, Length=number_slider, Gravity=unit_z_2)  # -> simplify(Catenary)
shift_paths = ShiftPaths(Data=[catenary, catenary_2], Offset=-1)
join_curves = JoinCurves(Curves=shift_paths, Preserve=False)
rebuild_curve = RebuildCurve(Curve=join_curves, Degree="3", Count=Slider(236, range=0..1000), Tangents=False)  # -> flatten(Curve)
loft_options = LoftOptions(Closed=False, Adjust=Toggle(True), Rebuild=0, Refit=0, Type=0)
loft = Loft(Curves=rebuild_curve, Options=loft_options)
custom_preview = CustomPreview(Geometry=loft, Material=ColourSwatch(SwatchColor=RGB(62, 57, 255)))
