# Grasshopper definition Surfaces-04.gh (Grasshopper 1.0.7)

number_slider = Slider(20, range=0..100)
square = Square(Plane=PlaneXY(0, 0, 0), Size=Slider(12.56, range=0..100), ExtentX=number_slider, ExtentY=Slider(17, range=0..100))  # -> Cells, Points
flip_matrix = FlipMatrix(Data=square.Points)
point = Point(Point(119.715988, 111.8040955, 0))
point_2 = Point(flip_matrix)
closest_point = ClosestPoint(Point=point_2, Cloud=point)  # -> ClosestPoint, CPIndex, flatten(Distance)
remap = Remap(data=closest_point.Distance, min=0, max=1)
graph_mapper = GraphMapper(remap, x0=0, x1=1, y0=0, y1=1, container_name="Sine", Equation_px=[0, 0.2657342553], Equation_py=[0, 1])
graph_mapper_2 = GraphMapper(
    graph_mapper,
    x0=0,
    x1=1,
    y0=0,
    y1=1,
    container_name="Bezier",
    cpx=[0, 0.862937212, 0.08295509964, 1],
    cpy=[0, 0, 0.7730158567, 1])
remap_2 = Remap(data=graph_mapper_2, min=Slider(12.5, range=0..100), max=Slider(35.3, range=0..100))
partition_list = PartitionList(List=remap_2, Size=expr("x+1", number_slider))
unit_z = UnitZ(Factor=partition_list)
move = Move(Geometry=point_2, Motion=unit_z)  # -> Geometry, Transform
interpolate = Interpolate(Vertices=move.Geometry, Degree=3, Periodic=False, KnotStyle=1)  # -> flatten(Curve), Length, Domain
unit_y = UnitY(Factor=Slider(6.15, range=0..10))
loft = Loft(
    Curves=interpolate.Curve,
    Options={Adjust=False, Closed=False, LoftEnds=0, LoftSimp=0, LoftType=0, Rebuild=10, Refit=0.01})
extrude = Extrude(Base=interpolate.Curve, Direction=unit_y)
offset = Offset(Surface=extrude, Distance=Slider(2.26, range=0..10), Retrim=True)
curve = Curve(graft(offset))
curve_2 = Curve(graft(extrude))
loft_2 = Loft(
    Curves=[curve_2, curve],
    Options={Adjust=False, Closed=False, LoftEnds=0, LoftSimp=0, LoftType=0, Rebuild=10, Refit=0.01})
brep_join = BrepJoin(Breps=flatten([offset, extrude, loft_2]))  # -> Breps, Closed
brep_edges = BrepEdges(Brep=brep_join.Breps)  # -> Naked, Interior, NonManifold
custom_preview = CustomPreview(Geometry=brep_edges.Interior, Shader=ColourSwatch(SwatchColor=RGB(255, 255, 255)))
custom_preview_2 = CustomPreview(Geometry=brep_join.Breps, Shader=ColourSwatch(SwatchColor=RGB(0, 0, 0)))

# ==== cluster Remap: Remaps numbers
data = ClusterInput()
min = ClusterInput()
max = ClusterInput()
bnd = Bounds(Numbers=data)
dom = ConstructDomain(DomainStart=min, DomainEnd=max)
remap = RemapNumbers(Value=data, Source=bnd, Target=dom)  # -> Mapped, Clipped
R = ClusterOutput(remap.Mapped)
