# Grasshopper definition Surfaces-06.gh (Grasshopper 1.0.7)
# plug-ins: Monolith, Bifocals

number_slider = Slider(13.4, range=0..100)
construct_domain = ConstructDomain(DomainStart=expr("-X", number_slider), DomainEnd=number_slider)
panel = Panel("cos(x*T) * sin(y*T) + cos(y*T) * sin(z*T) + cos(z*T) * sin(x*T)")
panel_2 = Panel("min( ((x*cos(0.866646*y) - z*sin(0.866646*y))-0.7)*((x*cos(0.866646*y) - z*sin(0.866646*y))-0.7) + (y/2.9)*(y/2.9) + (x*sin(0.866646*y) + z*cos(0.866646*y))*(x*sin(0.866646*y) + z*cos(0.866646*y)) - 1,  ((x*cos(0.866646*y) - z*sin(0.866646*y))+0.5)*((x*cos(0.866646*y) - z*sin(0.866646*y))+0.5) + (y/2.9)*(y/2.9) + (x*sin(0.866646*y) + z*cos(0.866646*y))*(x*sin(0.866646*y) + z*cos(0.866646*y)) - 1)")
domain_box = DomainBox(Base=PlaneXY(0, 0, 0), X=construct_domain, Y=construct_domain, Z=construct_domain)
number_slider_2 = Slider(2.97, range=0..10)
construct_function_source = ConstructFunctionSource(Function=panel_2)
construct_function_source_2 = ConstructFunctionSource(Function=panel, T=Slider(1.23, range=0..10), variables="t")
construct_base_voxels = ConstructBaseVoxels(Box=domain_box, Resolution=Slider(100, range=0..100), BaseChannelTypes=Slider(1, range=0..1), Fill=0)
add_sources = AddSources(Voxels=construct_base_voxels, Shape=flatten(construct_function_source), variables="Shape")
number_slider_3 = Slider(200, range=0..1000)
get_channel_names = GetChannelNames(Voxels=add_sources, variables="Shape")
construct_domain_2 = ConstructDomain(DomainStart=expr("-X", number_slider_3), DomainEnd=number_slider_3)
get_iso_mesh = GetIsoMesh(Voxels=add_sources, Channel=get_channel_names, IsoValue=Slider(0.41, range=0..1), CapEdgeFaces=Toggle(True))
plane_surface = PlaneSurface(Plane=PlaneXY(0, 0, 0), XSize=construct_domain_2, YSize=construct_domain_2)
mesh_split = MeshSplit(Mesh=get_iso_mesh, Splitters=plane_surface)
list_item = ListItem(List=mesh_split, Index=0, Wrap=True)
unit_y = UnitY(Factor=1)
contour = Contour(Shape=list_item, Point=Point(0.2865068775, -3.74696317, 0), Direction=unit_y, Distance=Slider(0.2, range=0..10))
smooth_polyline = SmoothPolyline(Polyline=contour, Strength=1, Times=Slider(18, range=0..100))
rebuild_curve = RebuildCurve(Curve=smooth_polyline, Degree=Slider(3, range=0..10), Count=Slider(100, range=0..100), Tangents=False)
pipe = Pipe(Curve=rebuild_curve, Radius=Slider(0.05, range=0..0.1), Caps=0)
