# Grasshopper definition Surfaces-09.gh (Grasshopper 1.0.7)
# plug-ins: Pufferfish, DendroGH

srf = Surface([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])
netsrf = NetOnSurface(Surface=srf, CountU=Slider(6, range=0..10), CountV=Slider(3, range=0..10), Flip=False)
vsettings = CreateSettings(VoxelSize=Slider(0.08, range=0..0.1), Bandwidth=1, Isovalue=0, Adaptivity=0.1)

# ----
# to have curve thickness
# enable this component
vcurve = CurveToVolume(Curves=netsrf, CurveRadius=Slider(0.2, range=0..1), Settings=vsettings)  # disabled

mvolume = VolumeToMesh(Volume=flatten(vcurve), VolumeSettings=vsettings)
preview = CustomPreview(Geometry=mvolume, Material=ColourSwatch(SwatchColor=RGB(201, 68, 68)))
