# Grasshopper definition Surfaces_06.ghx (Grasshopper 1.0.7)

_0_100 = Slider(56, range=0..100)
_0_100_2 = Slider(12, range=0..100)
number_slider = Slider(9, range=0..20)
number_slider_2 = Slider(5, range=0..20)
dom = Domain(DomainStart=_0_100_2, DomainEnd=_0_100)
number_slider_3 = Slider(3, range=0..20)
dom_2 = Domain(DomainStart=0, DomainEnd=number_slider_2)
dom_3 = Domain(DomainStart=0, DomainEnd=number_slider_3)
_0_100_3 = Slider(27, range=0..100)
dom_4 = Domain(DomainStart=0, DomainEnd=number_slider_2)
multiplication = Multiplication(A=_0_100_3, B=2)
addition = Addition(A=number_slider, B=multiplication)
random = Random(Range=dom, Number=multiplication, Seed=addition, Integers=True)
dom_5 = Domain(DomainStart=0, DomainEnd=random)
ma = MassAddition(Input=random)  # -> Result, PartialResult
subset = SubList(List=ma.PartialResult, Interval=dom_2, Cycle=False)  # -> List, Index
vec = VectorXYZ(XComponent=subset.List, YComponent=0, ZComponent=0)  # -> Vector, Length
rectangle = Rectangle(Plane=PlaneXY(0, 0, 0), XSize=dom_5, YSize=dom_3, Radius=0)  # -> Rec, Length
shift = ShiftList(List=rectangle.Rec, Shift=1, Wrap=False)
item = ListItem(List=rectangle.Rec, Index=0, Wrap=False)
subset_2 = SubList(List=shift, Interval=dom_4, Cycle=False)  # -> List, Index
move = Move(Geometry=subset_2.List, Translation=vec.Vector)  # -> Geometry, Transform
ins = ListInsert(List=move.Geometry, Item=item, Indices=0, Wrap=False)
series = Series(Start=0, Step=number_slider_3, Count=multiplication)
repeat = RepeatData(Data=graft(ins), Length=multiplication)
vec_2 = VectorXYZ(XComponent=random, YComponent=series, ZComponent=0)  # -> Vector, Length
pt = Point(Point(167.1071154, 28.64830363, 0))
pt_2 = Point(Point(183.5147269, 117.7009228, 0))
pt_3 = Point(Point(75.88904717, 79.48088179, 0))
move_2 = Move(Geometry=repeat, Translation=vec_2.Vector)  # -> Geometry, Transform
crv_cp = CurveCP(Point=pt_3, Curve=move_2.Geometry)  # -> Point, Parameter, Distance
crv_cp_2 = CurveCP(Point=pt_2, Curve=move_2.Geometry)  # -> Point, Parameter, Distance
crv_cp_3 = CurveCP(Point=pt, Curve=move_2.Geometry)  # -> Point, Parameter, Distance
sort = SortList(Keys=flatten(crv_cp.Distance), ValuesA=flatten(move_2.Geometry))  # -> List, ValuesA
number_slider_4 = Slider(13, range=0..20)
panel = Panel(sort.List)
sort_2 = SortList(Keys=flatten(crv_cp_3.Distance), ValuesA=flatten(move_2.Geometry))  # -> List, ValuesA
number_slider_5 = Slider(17, range=0..20)
sort_3 = SortList(Keys=flatten(crv_cp_2.Distance), ValuesA=flatten(move_2.Geometry))  # -> List, ValuesA
number_slider_6 = Slider(12, range=0..20)
smaller = SmallerThan(FirstNumber=sort.List, SecondNumber=number_slider_4)  # -> SmallerThan, OrEqualTo
cull = CullPattern(List=sort.ValuesA, CullPattern=smaller.SmallerThan)
smaller_2 = SmallerThan(FirstNumber=sort_2.List, SecondNumber=number_slider_5)  # -> SmallerThan, OrEqualTo
smaller_3 = SmallerThan(FirstNumber=sort_3.List, SecondNumber=number_slider_6)  # -> SmallerThan, OrEqualTo
planar = PlanarSrf(Edges=cull)
cull_2 = CullPattern(List=sort_2.ValuesA, CullPattern=smaller_2.SmallerThan)
cull_3 = CullPattern(List=sort_3.ValuesA, CullPattern=smaller_3.SmallerThan)
planar_2 = PlanarSrf(Edges=cull_2)
planar_3 = PlanarSrf(Edges=cull_3)
