# Grasshopper definition Surfaces_08.gh (Grasshopper 1.0.7)

width = Slider(95.67, range=0..100)
height = Slider(60, range=0..100)

xz_plane = XZPlane(Origin=Point(0, 0, 0))
md_slider = MDSlider(
    SliderMode=0,
    slider_value=Point(0.7789414322, 0.7549256073, 0.5),
    x_domain=Domain(0, 1),
    y_domain=Domain(0, 1),
    z_domain=Domain(0, 1))
md_slider_2 = MDSlider(
    SliderMode=0,
    slider_value=Point(0.9649177074, 0.5437986878, 0.5),
    x_domain=Domain(0, 1),
    y_domain=Domain(0, 1),
    z_domain=Domain(0, 1))
md_slider_3 = MDSlider(
    SliderMode=0,
    slider_value=Point(0.2181309938, 0.7256659146, 0.5),
    x_domain=Domain(0, 1),
    y_domain=Domain(0, 1),
    z_domain=Domain(0, 1))
md_slider_4 = MDSlider(
    SliderMode=0,
    slider_value=Point(0.4117674351, 0.4941739488, 0.5),
    x_domain=Domain(0, 1),
    y_domain=Domain(0, 1),
    z_domain=Domain(0, 1))
md_slider_5 = MDSlider(
    SliderMode=0,
    slider_value=Point(0.7909883359, 0.7078429474, 0.5),
    x_domain=Domain(0, 1),
    y_domain=Domain(0, 1),
    z_domain=Domain(0, 1))
md_slider_6 = MDSlider(
    SliderMode=0,
    slider_value=Point(0.9649177074, 0.1612724217, 0.5),
    x_domain=Domain(0, 1),
    y_domain=Domain(0, 1),
    z_domain=Domain(0, 1))
md_slider_7 = MDSlider(
    SliderMode=0,
    slider_value=Point(0.06597874165, 0.1609223464, 0.5),
    x_domain=Domain(0, 1),
    y_domain=Domain(0, 1),
    z_domain=Domain(0, 1))
md_slider_8 = MDSlider(
    SliderMode=0,
    slider_value=Point(0.3669672489, 0.2823132044, 0.5),
    x_domain=Domain(0, 1),
    y_domain=Domain(0, 1),
    z_domain=Domain(0, 1))
number = Number(width)
number_2 = Number(height)
md_slider_9 = MDSlider(
    SliderMode=0,
    slider_value=Point(0.7794282773, 0.3803072524, 0.5),
    x_domain=Domain(0, 1),
    y_domain=Domain(0, 1),
    z_domain=Domain(0, 1))
md_slider_10 = MDSlider(
    SliderMode=0,
    slider_value=Point(0.8464280044, 0.08785905509, 0.5),
    x_domain=Domain(0, 1),
    y_domain=Domain(0, 1),
    z_domain=Domain(0, 1))
md_slider_11 = MDSlider(
    SliderMode=0,
    slider_value=Point(0.142744565, 0, 0.5),
    x_domain=Domain(0, 1),
    y_domain=Domain(0, 1),
    z_domain=Domain(0, 1))
md_slider_12 = MDSlider(
    SliderMode=0,
    slider_value=Point(0.4038145542, 0.0620759109, 0.5),
    x_domain=Domain(0, 1),
    y_domain=Domain(0, 1),
    z_domain=Domain(0, 1))
plane_surface = PlaneSurface(Plane=xz_plane, XSize=number, YSize=number_2)
surface = Surface(reparameterize(plane_surface))
curve_on_surface = CurveOnSurface(Surface=surface, UVCoordinates=[md_slider_3, md_slider_4, md_slider, md_slider_2], Closed=Toggle(False))  # -> Curve, Length, Domain
curve_on_surface_2 = CurveOnSurface(Surface=surface, UVCoordinates=[md_slider_7, md_slider_8, md_slider_5, md_slider_6], Closed=Toggle(False))  # -> Curve, Length, Domain
curve_on_surface_3 = CurveOnSurface(Surface=surface, UVCoordinates=[md_slider_11, md_slider_12, md_slider_9, md_slider_10], Closed=Toggle(False))  # -> Curve, Length, Domain
resolution = Slider(100, range=10..200)
collection = Curve(flatten([curve_on_surface.Curve, curve_on_surface_2.Curve, curve_on_surface_3.Curve]))
surface_2 = Surface(surface)
dimensions = Dimensions(Surface=surface_2)  # -> UDimension, VDimension
integer = Integer(resolution)
division = Division(A=dimensions.VDimension, B=dimensions.UDimension)
multiplication = Multiplication(A=division, B=integer)
divide_surface = DivideSurface(Surface=surface_2, UCount=integer, VCount=multiplication)  # -> flatten(Points), Normals, Parameters
curve_closest_point = CurveClosestPoint(Point=graft(divide_surface.Points), Curve=collection)  # -> Point, Parameter, Distance
sort_list = SortList(Keys=curve_closest_point.Distance)  # -> Keys, ValuesValuesA
list_item = ListItem(List=sort_list.Keys, Index=0, Wrap=True)  # -> flatten(Item)
bounds = Bounds(Numbers=list_item)
remap_numbers = RemapNumbers(Value=list_item, Source=bounds, Target=Domain(0, 1))  # -> Mapped, Clipped

max = Slider(10.13, range=0.2..11.65)
min = Slider(1.16, range=0.2..5.65)

# ---- group: Distribution
graph_mapper = GraphMapper(
    remap_numbers.Mapped,
    x0=0,
    x1=1,
    y0=0,
    y1=1,
    container_name="Bezier",
    cpx=[0, 0.2348562032, 0.3707982898, 1],
    cpy=[0, 0.2979418039, 1, 1])
graph_mapper_2 = GraphMapper(
    graph_mapper,
    x0=0,
    x1=1,
    y0=0,
    y1=1,
    container_name="Sine",
    Equation_px=[0, 0.3417758346],
    Equation_py=[0, 0.9886952043])

# ----
number_3 = Number(max)
number_4 = Number(min)
number_5 = Number(graph_mapper_2)
construct_domain = ConstructDomain(DomainStart=number_4, DomainEnd=number_3)
bounds_2 = Bounds(Numbers=number_5)
remap_numbers_2 = RemapNumbers(Value=number_5, Source=bounds_2, Target=construct_domain)  # -> Mapped, Clipped
unit_y = UnitY(Factor=expr("-x", remap_numbers_2.Mapped))
move = Move(Geometry=divide_surface.Points, Motion=unit_y)  # -> Geometry, Transform
surface_from_points = SurfaceFromPoints(Points=move.Geometry, UCount=expr("x+1", integer), Interpolate=False)
sections = Slider(45, range=2..100)
curve = Curve(surface_from_points)
project = Project(Geometry=curve, Plane=surface)  # -> Geometry, Transform
loft = Loft(
    Curves=[curve, project.Geometry],
    Options={Adjust=False, Closed=False, LoftEnds=0, LoftSimp=0, LoftType=0, Rebuild=10, Refit=0.01})
number_6 = Number(number)
brep_join = BrepJoin(Breps=[surface_from_points, loft, surface])  # -> Breps, Closed
unit_x = UnitX(Factor=1)
division_2 = Division(A=number_6, B=sections)
_3d_detail = BooleanToggle(True)

sheet_x = Slider(196.19, range=0..300)
sheet_y = Slider(417.87, range=0..600)

subtraction = Subtraction(A=division_2, B=Slider(0.001, range=0..0.001))
contour = Contour(Shape=brep_join.Breps, Point=Point(0, 0, 0), Direction=unit_x, Distance=subtraction)  # -> flatten(Contours)
contour_2 = Contour(Shape=surface, Point=Point(0, 0, 0), Direction=unit_x, Distance=subtraction)  # -> flatten(Contours)
point = Point(Point(101.0657287, -2.467746462, 0))
integer_2 = Integer(_3d_detail)
cull_pattern = CullPattern(List=contour, CullPattern=_3d_detail)
point_on_curve = PointOnCurve(contour_2, parameter=0)
evaluate = Evaluate(Expression="if(s=1,0,1)", s=integer_2)
rectangle = Rectangle(Plane=point, XSize=sheet_x, YSize=sheet_y, Radius=0)  # -> Rectangle, Length
unit_x_2 = UnitX(Factor=subtraction)
number_slider = Slider(8, range=3..10)
boundary_surfaces = BoundarySurfaces(Edges=cull_pattern)
cull_pattern_2 = CullPattern(List=contour, CullPattern=evaluate)
curve_2 = Curve(rectangle.Rectangle)
integer_3 = Integer(_3d_detail)
point_2 = Point(point_on_curve)
list_length = ListLength(List=cull_pattern_2)
evaluate_2 = Evaluate(Expression="if(s=1,0,1)", s=integer_3)
results_1 = Extrude(Base=boundary_surfaces, Direction=unit_x_2)
yz_plane = YZPlane(Origin=point_2)
cull_pattern_3 = CullPattern(List=brep_join.Breps, CullPattern=evaluate_2)
division_3 = Division(A=list_length, B=number_slider)
surface_frames = SurfaceFrames(Surface=curve_2, UCount=expr("x-1", number_slider), VCount=division_3)  # -> flatten(Frames), Parameters
custom_preview = CustomPreview(Geometry=cull_pattern_3, Shader=ColourSwatch(SwatchColor=RGBA(147, 148, 255, 58)))
brep_edges = BrepEdges(Brep=results_1)  # -> Naked, Interior, NonManifold
custom_preview_2 = CustomPreview(Geometry=contour, Shader=ColourSwatch(SwatchColor=RGB(0, 0, 0)))
shortest_list = ShortestList(ListListA=yz_plane, ListListB=surface_frames.Frames, TrimMode=2)  # -> ListListA, ListListB
custom_preview_3 = CustomPreview(Geometry=results_1, Material=ColourSwatch(SwatchColor=RGB(95, 66, 255)))
custom_preview_4 = CustomPreview(Geometry=brep_edges.Interior, Material=ColourSwatch(SwatchColor=RGB(0, 0, 0)))
results_2 = Orient(Geometry=cull_pattern_2, Source=yz_plane, Target=shortest_list.ListListB)  # -> Geometry, Transform

move_x = Slider(5.36, range=0..10)
move_y = Slider(-4.25, range=-30..30)

area = Area(Geometry=results_2.Geometry)  # -> Area, Centroid
unit_x_3 = UnitX(Factor=1)
project_point = ProjectPoint(Point=area.Centroid, Direction=unit_x_3, Geometry=results_2.Geometry)  # -> Point, Index
unit_y_2 = UnitY(Factor=move_y)
unit_x_4 = UnitX(Factor=move_x)
text_rotate = Slider(-90, range=-90..90)
addition = Addition(A=unit_x_4, B=unit_y_2)
move_2 = Move(Geometry=project_point.Point, Motion=expr("-x", addition))  # -> Geometry, Transform
list_length_2 = ListLength(List=move_2.Geometry)
text_size = Slider(1.28, range=0..10)
xy_plane = XYPlane(Origin=move_2.Geometry)
series = Series(Start=0, Step=1, Count=list_length_2)
rotate_plane = RotatePlane(Plane=xy_plane, Angle=expr("-x", degrees(text_rotate)))
integer_4 = Integer(series)
results_3 = TextTag3D(Location=rotate_plane, Text=integer_4, Size=text_size, Justification=5)
