# Grasshopper definition Tesselation-03.gh (Grasshopper 1.0.7)

number_slider = Slider(10, range=0..10)
subtraction = Subtraction(A=number_slider, B=Slider(0.5, range=0..1))
series = Series(Start=0, Step=number_slider, Count="3")
vec = VectorXYZ(XComponent=graft(series), YComponent=series, ZComponent=0)  # -> Vector, Length
cir = Circle(Plane=PlaneXY(0, 0, 0), Radius=subtraction)
move = Move(Geometry=cir, Motion=vec.Vector)  # -> Geometry, Transform
flatten = FlattenTree(Tree=move.Geometry, Path="{0}")
neg = Negative(Value=Slider(2.1, range=0..10))
offset = Offset(Curve=flatten, Distance=neg, Plane=PlaneXY(0, 0, 0), Corners=1)
lng = ListLength(List=flatten)
graft = GraftTree(Tree=flatten, IncludeEmptyLists=True, IncludeNullItems=True)  # -> simplify(Tree)
graft_2 = GraftTree(Tree=offset, IncludeEmptyLists=True, IncludeNullItems=True)  # -> simplify(Tree)
division = Division(A=lng, B=2)
merge = Merge(Data1=graft, Data2=graft_2)
round = Round(Number=division)  # -> Nearest, Floor, Ceiling
boundary = BoundarySurfaces(Edges=merge)  # -> flatten(Surfaces)
dispatch = Dispatch(List=boundary, DispatchPattern=[True, False])  # -> ListA, ListB
item = ListItem(List=flatten, Index=round.Floor, Wrap=True)
srf = Surface(dispatch.ListA)
lng_2 = ListLength(List=srf)
division_2 = Division(A=lng_2, B=2)
round_2 = Round(Number=division_2)  # -> Nearest, Floor, Ceiling
item_2 = ListItem(List=srf, Index=round_2.Floor, Wrap=True)
cull_i = CullIndex(List=srf, Indices=round_2.Floor, Wrap=True)
srf_2 = Surface(dispatch.ListB)
bbx = BrepBrep(BrepA=item_2, BrepB=srf_2)  # -> simplify(Curves), Points
bbx_2 = BrepBrep(BrepA=item_2, BrepB=cull_i)  # -> Curves, Points
flatten_2 = FlattenTree(Tree=bbx_2.Curves, Path="{0}")
flatten_3 = FlattenTree(Tree=bbx.Curves, Path="{0}")
boundary_2 = BoundarySurfaces(Edges=flatten_2)
boundary_3 = BoundarySurfaces(Edges=flatten_3)
area = Area(Geometry=boundary_2)  # -> Area, Centroid
area_2 = Area(Geometry=boundary_3)  # -> Area, Centroid
crv = Curve(reparameterize(item))
crv_cp = CurveClosestPoint(Point=area.Centroid, Curve=crv)  # -> Point, Parameter, Distance
crv_cp_2 = CurveClosestPoint(Point=area_2.Centroid, Curve=crv)  # -> Point, Parameter, Distance
sort = SortList(Keys=crv_cp_2.Parameter, ValuesA=flatten_3)  # -> Keys, ValuesA
sort_2 = SortList(Keys=crv_cp.Parameter, ValuesA=flatten_2)  # -> Keys, ValuesA
dispatch_2 = Dispatch(List=sort.ValuesA, DispatchPattern=[True, False])  # -> ListA, ListB
dispatch_3 = Dispatch(List=sort_2.ValuesA, DispatchPattern=[True, False])  # -> ListA, ListB
crv_2 = Curve(dispatch_3.ListB)
crv_3 = Curve(dispatch_2.ListA)
merge_2 = Merge(Data1=crv_2, Data2=crv_3)
srfsplit = SurfaceSplit(Surface=item_2, Curves=merge_2)
area_3 = Area(Geometry=srfsplit)  # -> Area, Centroid
sort_3 = SortList(Keys=area_3.Area, ValuesA=srfsplit)  # -> Keys, ValuesA
lng_3 = ListLength(List=sort_3.ValuesA)
division_3 = Division(A=lng_3, B=2)
split = SplitList(List=sort_3.ValuesA, Index=division_3)  # -> ListA, ListB
num = Number(number_slider)
series_2 = Series(Start=0, Step=num, Count=Slider(13, range=0..20))
srf_3 = Surface(split.ListB)
group = Group(Objects=srf_3)
vec_2 = VectorXYZ(XComponent=graft(series_2), YComponent=series_2, ZComponent=0)  # -> Vector, Length
move_2 = Move(Geometry=group, Motion=vec_2.Vector)  # -> Geometry, Transform
bbox = BoundingBox(Content=move_2.Geometry, Plane=PlaneXY(0, 0, 0))  # -> Box, Box_2
pt = ConstructPoint(XCoordinate=0, YCoordinate=0, ZCoordinate=0)
area_4 = Area(Geometry=bbox.Box)  # -> Area, Centroid
dist = Distance(PointA=pt, PointB=area_4.Centroid)
bnd = Bounds(Numbers=flatten(dist))
remap = RemapNumbers(Value=dist, Source=bnd, Target=Domain(0, 1))  # -> Mapped, Clipped
gradient = Gradient(LowerLimit=0, UpperLimit=1, Parameter=remap.Mapped, stops=[0: RGB(152, 168, 5), 1: RGB(196, 0, 0)])
preview = CustomPreview(Geometry=move_2.Geometry, Shader=gradient)
