# Grasshopper definition Tesselation_04.gh (Grasshopper 1.0.7)
# plug-ins: Heteroptera

polygon = Polygon(Plane=PlaneXY(0, 0, 0), Radius=3, Segments="6", FilletRadius=0)  # -> Polygon, Length
explode = Explode(Curve=polygon.Polygon, Recursive=True)  # -> Segments, Vertices
item = ListItem(List=explode.Segments, Index=0, Wrap=True)  # -> Item, Item1
eval = EvaluateCurve(Curve=reparameterize([item.Item, item.Item1]), Parameter="0.5")  # -> Point, Tangent, Angle
Z = UnitZ(Factor=1)
pl = ConstructPlane(Origin=eval.Point, XAxis=eval.Tangent, YAxis=Z)
mirror = Mirror(Geometry=polygon.Polygon, Plane=pl)  # -> Geometry, Transform
merge = Merge(Data1=mirror.Geometry, Data2=polygon.Polygon)  # -> flatten(Result)
runion = RegionUnion(Curves=merge)
hexgrid = Hexagonal(Plane=PlaneXY(0, 0, 0), Size="7", ExtentX=Slider(6, range=0..10), ExtentY=Slider(6, range=0..10))  # -> Cells, Points
area = Area(Geometry=runion)  # -> Area, Centroid
explode_2 = Explode(Curve=flatten(hexgrid.Cells), Recursive=True)  # -> Segments, Vertices
cull_i = CullIndex(List=explode_2.Vertices, Indices="-1", Wrap=True)
cullpt = CullDuplicates(Points=flatten(cull_i), Tolerance=0.1, CullMode=3)  # -> Points, Indices, Valence
vec2pt = Vector2Pt(PointA=area.Centroid, PointB=flatten(cullpt.Points), Unitize=False)  # -> Vector, Length
move = Move(Geometry=runion, Motion=vec2pt.Vector)  # -> Geometry, Transform
georegion = GeometricRegion(Curves=move.Geometry)
genes = GenePool(Decimals=0, Maximum=10, Minimum=0, Value=[2.25, 1.25, 2, 2])
lng = ListLength(List=georegion)
boundary = BoundarySurfaces(Edges=georegion)
dom = ConstructDomain(DomainStart=0, DomainEnd="255")
random = Random(Range=dom, Number=lng, Seed=graft(genes))
bang = ExplodeTree(Data=random)  # -> Branch0, Branch1, Branch2, Branch3
rgb = ColourRGB(Alpha=bang.Branch0, Red=bang.Branch1, Green=bang.Branch2, Blue=bang.Branch3)
preview = CustomPreview(Geometry=boundary, Material=rgb)
