# Grasshopper definition Tesselation_05.gh (Grasshopper 1.0.7)

md_slider = MDSlider(
    SliderMode=0,
    slider_value=Point(0.4235369927, 0.7095167214, 0.5),
    x_domain=Domain(0, 1),
    y_domain=Domain(0, 1),
    z_domain=Domain(0, 1))
md_slider_2 = MDSlider(
    SliderMode=0,
    slider_value=Point(0.6255611994, 0.4363279967, 0.5),
    x_domain=Domain(0, 1),
    y_domain=Domain(0, 1),
    z_domain=Domain(0, 1))
python = GhPythonScript(
    att_point=[md_slider, md_slider_2],
    Domain_start=Slider(0.745, range=0..2),
    Domain_end=Slider(0.284, range=0..2),
    R=Slider(4, range=0..10),
    ex=Slider(5, range=0..10),
    ey=Slider(4, range=0..10))  # -> out, p1, p2, p3, p4; inputs att_point: list of Point3d, ex: Int32, ey: Int32
# ---------- python: Python ----------
import rhinoscriptsyntax as rs
import Rhino.Geometry as rg
import ghpythonlib.components as gh
import Grasshopper as ghr
import math as m
#=======================================generating base array=====================
hexagon = gh.Polygon(gh.XYPlane(gh.ConstructPoint(0,0,0)) , R , 8,0)[0]
hex = gh.Rotate(hexagon , m.radians(22.5),gh.XYPlane(gh.ConstructPoint(0,0,0)))[0]
edges = gh.Explode(hex , 0)[0]
square1 = gh.Extrude(edges[7] , gh.UnitX(gh.Length(edges[7])))
squarecurve1 =gh.BrepEdges(square1)[0]
squarecurve1 =gh.JoinCurves(squarecurve1, False)
square2 = gh.Extrude(edges[1] , gh.UnitY(gh.Length(edges[1])))
squarecurve2 =gh.BrepEdges(square2)[0]
squarecurve2 =gh.JoinCurves(squarecurve2, False)
hex2 = gh.Move(hex , gh.Vector2Pt(gh.Area(hex)[1] , gh.CurveMiddle(edges[0]) , False)[0]*2)[0]

elements=[squarecurve2, squarecurve1 , hex ]


#==========================================
unionBox2 = rg.BoundingBox.Unset


for i in range(len(elements)):
    bBox2 = elements[i].GetBoundingBox(rs.WorldXYPlane())
    unionBox2.Union(bBox2)
min2 = unionBox2.Min

max2 = unionBox2.Max
rec2 = gh.Rectangle2Pt(rs.WorldXYPlane() , min2, max2 , 0)[0]

#=============================================
curve1 =gh.RectangularArray(hex , rec2 , ex ,ey)[0]
curve2 =gh.RectangularArray(squarecurve1 , rec2 , ex-1,ey)[0]
curve3 =gh.RectangularArray(squarecurve2 , rec2 , ex ,ey-1)[0]
curve4 =gh.RectangularArray(hex2 , rec2 , ex-1 ,ey-1)[0]
curves=[curve1 , curve2 , curve3, curve4]



#========================================================


a =[]

for curve in curves:
    #+++++++++++++++++++++++++++++++++++++++++++++++++++FIRST PART
    #=========Generating surface from curve==========
    unionBox = rg.BoundingBox.Unset
    
    
    for i in range(len(curve)):
        bBox = curve[i].GetBoundingBox(rs.WorldXYPlane())
        unionBox.Union(bBox)
    min = unionBox.Min
    max = unionBox.Max
    rec = gh.Rectangle2Pt(rs.WorldXYPlane() , min, max , 0)[0]
    brep = gh.BoundarySurfaces(rec)
    
    
    #================Evaluate Surface====================
    
    interval_u = rg.Interval(0.0, 1)
    interval_v = rg.Interval(0.0, 1)
    
    brep.Faces[0].SetDomain(0, interval_u)
    brep.Faces[0].SetDomain(1, interval_v)
    
    attract_points = []
    for i in range(len(att_point)):
        eval = gh.EvaluateSurface(brep , att_point[i])[0]
        attract_points.append(eval)
        
    #================distance to it nearest point====================
    centers = []
    all_vertices =[]
    all_segments=[]
    for polygon in curve:
        centers.append(gh.Area(polygon)[1])
        all_vertices.append(gh.Explode(polygon,1)[1])
        all_segments.append(gh.Explode(polygon,1)[0])
    
    distances = []
    for center in centers:
        min_dist = 100000000000000000000
        for attractor in attract_points:
            distance = center.DistanceTo(attractor)
            if distance<min_dist:
                min_dist = distance
        distances.append(min_dist)
    #===================reparametrize distances =============
    new_distances = gh.RemapNumbers(distances , gh.Bounds(distances),gh.ConstructDomain(Domain_start , Domain_end))[0]
    
    #===================create center lines=================
    all_inside_lines = []
    for i in range(len(all_vertices)):
        inside_lines = []
        for vertex in all_vertices[i]:
            inside_lines.append(gh.Line(vertex , centers[i]))
        all_inside_lines.append(inside_lines)
        
    #=======================evaluate all_inside_lines with new_distances===========
    all_eval_points=[]
    for i in range(len(all_inside_lines)):
        eval_points=[]
        for lines in all_inside_lines[i]:
            eval_points.append(gh.EvaluateCurve(lines , new_distances[i])[0])
        all_eval_points.append(eval_points)
        
    all_eval_point2 =[]
    for segments in all_segments:
        eval_point2 = []
        for segment in segments:
            segment.Domain = rg.Interval(0,1)
            eval_point2.append(gh.EvaluateCurve(segment ,0.5)[0])
            
        all_eval_point2.append(eval_point2)
    
    #+++++++++++++++++++++++++++++++++++++++++++++++++++++++++
    
    plines=[]
    
    for i in range(len(all_eval_point2)):
        plinepoint=[]
        for j in range(len(all_eval_point2[i])):
            plinepoint.append(all_eval_points[i][j])
            plinepoint.append(all_eval_point2[i][j])
        plinepoint.append(all_eval_points[i][-1])
    
        plines.append(gh.PolyLine(plinepoint,True))
    a.append(plines)
p1 = a[0]
p2 = a[3]
p3 = a[1]
p4 = a[2]
# ---------- end python ----------
