# Grasshopper definition Tesselation_07.gh (Grasshopper 1.0.7)

number_slider = Slider(30, range=0..100)
pt = ConstructPoint(XCoordinate=0, YCoordinate=0, ZCoordinate=0)
number_slider_2 = Slider(100, range=0..100)
rad = Radians(Degrees=number_slider)
multiplication = Multiplication(A=number_slider, B=2)
Y = UnitY(Factor=1)
rad_2 = Radians(Degrees="180")
addition = Addition(A="180", B=multiplication)
line = LineSDL(Start=pt, Direction=Y, Length=number_slider_2)
subtraction = Subtraction(A="0", B=rad)
addition_2 = Addition(A=rad, B=rad_2)
division = Division(A=number_slider, B=addition)
dom = ConstructDomain(DomainStart=subtraction, DomainEnd=addition_2)
divide = DivideCurve(Curve=reparameterize(line), Count=Slider(20, range=0..100), Kinks=False)  # -> Points, Tangents, Parameters
multiplication_2 = Multiplication(A=division, B=number_slider_2)
number_slider_3 = Slider(18, range=0..100)
remap = RemapNumbers(Value=divide.Parameters, Source=Domain(0, 1), Target=dom)  # -> Mapped, Clipped
Y_2 = UnitY(Factor=multiplication_2)
remap_2 = RemapNumbers(Value=divide.Parameters, Source=Domain(0, 1), Target="Rad(180)")  # -> Mapped, Clipped
cos = Cosine(Value=remap.Mapped)
neg = Negative(Value=Y_2)
sin = Sine(Value=remap_2.Mapped)
multiplication_3 = Multiplication(A=cos, B=number_slider_3)
multiplication_4 = Multiplication(A=sin, B=Slider(11.9, range=0..100))
X = UnitX(Factor=multiplication_3)
move = Move(Geometry=divide.Points, Motion=X)  # -> Geometry, Transform
intcrv = Interpolate(Vertices=move.Geometry, Degree=3, Periodic=False, KnotStyle=1)  # -> reparameterize(Curve), Length, Domain
crv_cp = CurveClosestPoint(Point=move.Geometry, Curve=intcrv.Curve)  # -> Point, Parameter, Distance
eval = EvaluateCurve(Curve=intcrv.Curve, Parameter=crv_cp.Parameter)  # -> Point, Tangent, Angle
Z = UnitZ(Factor=1)
vrot = Rotate(Vector=eval.Tangent, Axis=Z, Angle="Rad(90)")
amp = Amplitude(Vector=vrot, Amplitude=multiplication_4)
neg_2 = Negative(Value=amp)
move_2 = Move(Geometry=move.Geometry, Motion=amp)  # -> Geometry, Transform
move_3 = Move(Geometry=move.Geometry, Motion=neg_2)  # -> Geometry, Transform
move_4 = Move(Geometry=line, Motion=neg)  # -> Geometry, Transform
num = Number(multiplication_2)
intcrv_2 = Interpolate(Vertices=move_2.Geometry, Degree=3, Periodic=False, KnotStyle=1)  # -> Curve, Length, Domain
intcrv_3 = Interpolate(Vertices=move_3.Geometry, Degree=3, Periodic=False, KnotStyle=1)  # -> Curve, Length, Domain
multiplication_5 = Multiplication(A=num, B=Slider(1, range=0..2))
len = Length(Curve=move_4.Geometry)
merge = Merge(Data1=intcrv_2.Curve, Data2=intcrv.Curve, Data3=intcrv_3.Curve)
neg_3 = Negative(Value=multiplication_5)
subtraction_2 = Subtraction(A=num, B=multiplication_5)
multiplication_6 = Multiplication(A=subtraction_2, B=3)
ext = ExtendCurve(Curve=move_4.Geometry, Type=0, Start=neg_3, End=neg_3)
move_5 = Move(Geometry=merge, Motion=neg)  # -> Geometry, Transform
end = EndPoints(Curve=ext)  # -> Start, End
num_2 = Number(len)
num_3 = Number(number_slider_3)
yz = YZPlane(Origin=end.End)
rotate = Rotate(Geometry=move_5.Geometry, Angle="Rad(180)", Plane=end.End)  # -> Geometry, Transform
multiplication_7 = Multiplication(A=num_2, B="1.5")
X_2 = UnitX(Factor=num_3)
mirror = Mirror(Geometry=rotate.Geometry, Plane=yz)  # -> Geometry, Transform
addition_3 = Addition(A=multiplication_6, B=multiplication_7)
move_6 = Move(Geometry=mirror.Geometry, Motion=X_2)  # -> Geometry, Transform
multiplication_8 = Multiplication(A=num_3, B="2")
group = Group(Objects=move_5.Geometry)
group_2 = Group(Objects=move_6.Geometry)
merge_2 = Merge(Data1=group, Data2=group_2)  # -> graft(Result)
series = Series(Start=0, Step=multiplication_8, Count=Slider(27, range=0..100))
series_2 = Series(Start=0, Step=addition_3, Count=Slider(7, range=0..15))
X_3 = UnitX(Factor=series)
Y_3 = UnitY(Factor=series_2)
move_7 = Move(Geometry=merge_2, Motion=X_3)  # -> simplify(Geometry), Transform
graft = GraftTree(Tree=move_7.Geometry, IncludeEmptyLists=True, IncludeNullItems=True)
move_8 = Move(Geometry=graft, Motion=Y_3)  # -> Geometry, Transform
ungroup = Ungroup(Group=move_8.Geometry)  # -> simplify(Objects)
dispatch = Dispatch(List=ungroup, DispatchPattern=[True, False])  # -> ListA, ListB
divide_2 = DivideCurve(Curve=reparameterize(dispatch.ListB), Count=10, Kinks=False)  # -> Points, Tangents, Parameters
remap_3 = RemapNumbers(Value=divide_2.Parameters, Source=Domain(0, 1), Target="Rad(180)")  # -> Mapped, Clipped
sin_2 = Sine(Value=remap_3.Mapped)
multiplication_9 = Multiplication(A=sin_2, B=Slider(20, range=0..100))
Z_2 = UnitZ(Factor=multiplication_9)
move_9 = Move(Geometry=divide_2.Points, Motion=Z_2)  # -> Geometry, Transform
intcrv_4 = Interpolate(Vertices=move_9.Geometry, Degree=3, Periodic=False, KnotStyle=1)  # -> Curve, Length, Domain
weave = Weave(Pattern=[0, 1], Stream0=dispatch.ListA, Stream1=intcrv_4.Curve, NullGaps=False)  # -> simplify(Weave)
loft = Loft(Curves=weave, Options={Adjust=False, Closed=False, LoftEnds=0, LoftSimp=0, LoftType=3, Rebuild=10, Refit=0.01})
bbox = BoundingBox(Content=loft, Plane=PlaneXY(0, 0, 0))  # -> Box, Box_2
centerpoint = CenterPoint(B=bbox.Box)
pdecon = Deconstruct(Point=centerpoint)  # -> XComponent, YComponent, ZComponent
number_slider_4 = Slider(0.1, range=0..1)
bnd = Bounds(Numbers=flatten(pdecon.YComponent))
bnd_2 = Bounds(Numbers=flatten(pdecon.XComponent))
remap_4 = RemapNumbers(Value=pdecon.YComponent, Source=bnd, Target=number_slider_4)  # -> Mapped, Clipped
remap_5 = RemapNumbers(Value=pdecon.XComponent, Source=bnd_2, Target=number_slider_4)  # -> Mapped, Clipped
addition_4 = Addition(A=remap_5.Mapped, B=remap_4.Mapped)  # -> simplify(Result)
hsl = ColourHSL(Alpha=1, Hue=addition_4, Saturation=1, Luminance=0.5)
preview = CustomPreview(Geometry=loft, Shader=hsl)

# ==== cluster CenterPoint
B = ClusterInput()
box_corners = BoxCorners(Box=B)  # -> CornerA, CornerB, CornerC, CornerD, CornerE, CornerF, CornerG, CornerH
ln = Line(PointA=box_corners.CornerA, PointB=box_corners.CornerG)
eval = EvaluateCurve(Curve=ln, Parameter=0.5)  # -> Point, Tangent, Angle
P = ClusterOutput(eval.Point)
