# Grasshopper definition Tesselation_09.gh (Grasshopper 1.0.7)

# ----
# Helix curve creation
# Spiral creation
# In order to create a helix we must construct
# a spiral which is a flat helix , of course this is not
# the only way to construct a helix but the spiral
# itself is needed to complete this whole definition
# first a line is needed to generate a series of points
# on itself so we construct a point and a vector on the
# x axis (or the y axis) and use line dsl component to
# construct the line from the center of cplane along
# an axis which in this case is the x axis
# *as we want a reslut on the cplane we use either
# y or x axis but z axis is usable as well as long as
# you pay attention and change the other axis inputs
# further in the definition accordingly
# Divide curve is used to create a series of points
# *the count is used on the range step and lenght on line
# too so it will produce a more consistance change in
# the spiral by moving the slider
construct_point = ConstructPoint(XCoordinate=0, YCoordinate=0, ZCoordinate=0)
unit_x = UnitX(Factor=1)
number_slider = Slider(100, range=0..1000)
line_sdl = LineSDL(Start=construct_point, Direction=unit_x, Length=number_slider)
divide_curve = DivideCurve(Curve=line_sdl, Count=number_slider, Kinks=False)  # -> Points, Tangents, Parameters

# ----
# After that we need to create a range in order to rotate
# the series of points one by one
# for the result puposes we have used pi component
# which gives out an output of domain starting from zero to
#  the factor multipated in the number pi
# the step needs to be the same amount as the number
# of points so each point rotates individually
# then the result is interpolated to create a curve (spiral)
number_slider_2 = Slider(0, range=0..100)
construct_domain = ConstructDomain(DomainStart=number_slider_2, DomainEnd=Slider(12.56, range=0..100))
pi = Pi(Factor=Slider(4, range=0..10))
range = Range(Domain=pi, Steps=number_slider)
rotate = Rotate(Geometry=divide_curve.Points, Angle=range, Plane=PlaneXY(0, 0, 0))  # -> Geometry, Transform
interpolate = Interpolate(Vertices=rotate.Geometry, Degree=3, Periodic=False, KnotStyle=1)  # -> Curve, Length, Domain

# ----
# If we want the series of points to move individually
# we again need to create a range but this time we
# use a graph mapper to do so
# and also a domain is constructed which defines the
# start and also the limitation of the move
# the numbers then need to be remapped in order for
# them to be recognizable by the move component
# then an interpolation is used to create a curve
number_slider_3 = Slider(0, range=0..100)
# Helix creation
# In order to create the helix the series of points
# generated by the divide curve component needs to be
# moved one by one along the z axis to create an interpolation
# which is the helix
graph_mapper = GraphMapper(
    divide_curve.Parameters,
    x0=0,
    x1=1,
    y0=0,
    y1=1,
    container_name="Bezier",
    cpx=[0, 0.4985510707, 1, 1],
    cpy=[0, 0, 0.4837584496, 1])
construct_domain_2 = ConstructDomain(DomainStart=Slider(66, range=0..100), DomainEnd=number_slider_3)
remap_numbers = RemapNumbers(Value=graph_mapper, Source=Domain(0, 1), Target=construct_domain_2)  # -> Mapped, Clipped
unit_z = UnitZ(Factor=remap_numbers.Mapped)
move = Move(Geometry=rotate.Geometry, Motion=unit_z)  # -> Geometry, Transform
# Extrusions (spikes) setting up
# Merging the spiral and helix
# In order to create the triangle shaped surfaces
# which then will be extruded to create the solid spike
# shaped solids we need to create three different
# sets of points movinge along the spirals and the
# helix so first we need to somehow merge them
interpolate_2 = Interpolate(Vertices=move.Geometry, Degree=3, Periodic=False, KnotStyle=1)  # -> Curve, Length, Domain

# ----
# At first we create another spiral by rotating the
# original one from its start , in order to do so we use
# pi again but this time we dont need a domain
# so first we set its factor to 2 and then divide it by
# a number on a slider this number can change
# but for the result we were looking for 5 is the
# best option however feel free to change and see the results
# then we divide the result by 2 this timeand create
# a negative version of the number by a negative
# component and then we merge the data recieved
# from the two divisions and use them as rotation
# angles to recieve two curves
number_slider_4 = Slider(5, range=0..10)
pi_2 = Pi(Factor="2")
division = Division(A=pi_2, B=number_slider_4)
division_2 = Division(A=division, B="2")
negative = Negative(Value=division_2)
merge = Merge(Data1=negative, Data2=division_2)
rotate_2 = Rotate(Geometry=interpolate.Curve, Angle=merge, Plane=PlaneXY(0, 0, 0))  # -> Geometry, Transform

# ----
# Then we use a weave component so that the
# data recieved from the three curves which are the
# two spirals and the helix can be recognized as one
# and in order to make the final result changable
# we use extend curve so that we can have the option
# to find the form that pleases us the data for the
# start can be recieved form a simple number slider
# but for the end we are going to need a 0 and a negative
# number so that our curves dont extend into eachother
# so we use a data merge to merge the data created
# from a number , its negative counter part and a panel
# that is set to 0 so now we have a changable
# number which affects the final form
number_slider_5 = Slider(58.56, range=0..100)
negative_2 = Negative(Value=number_slider_5)
multiplication = Multiplication(A=negative_2, B="2")
weave = Weave(Pattern=[0, 1], Stream0=rotate_2.Geometry, Stream1=interpolate_2.Curve, NullGaps=False)
merge_2 = Merge(Data1="0", Data2=negative_2, Data3=multiplication)
extend_curve = ExtendCurve(Curve=weave, Type=0, Start=Slider(0, range=0..1), End=merge_2)  # -> reparameterize(Curve)

# ----
# Point Generation
# We use the data provided in the previous section
# to generate a series of points
# In order to generate these three series of points
# we use the evaluate curve component and for its
# psrameter we use a graph mapper to generate
# a series a number fro a range
# *the stepsnumber used in this value is used later
# as well
number_slider_6 = Slider(60, range=0..100)
range_2 = Range(Domain=Domain(0, 1), Steps=number_slider_6)
graph_mapper_2 = GraphMapper(
    range_2,
    x0=0,
    x1=1,
    y0=0,
    y1=1,
    container_name="Bezier",
    cpx=[0, 0.6242180467, 0.7573666573, 1],
    cpy=[0, 0.1622310281, 0.561679244, 1])
evaluate_curve = EvaluateCurve(Curve=graft(extend_curve), Parameter=graph_mapper_2)  # -> simplify(Point), Tangent, Angle

# ----
# We are going to use the points generated to create a series of
#  triangles useing polyline component
# but if we use them as is they will generate curves along
# the spiral and the helix because that is their
# direction , to solve this problem we use a flip matrix
# component
flip_matrix = FlipMatrix(Data=evaluate_curve.Point)

# ----
# Extrusion construction
# Spike surface construction
# Now we need to generate boundry polylines of the
# triangular surfaces that we want to construct by
# a series of points
# And then rotated
# We use the pionts to generate polylines and then
# use boundry surface component to create the surfaces
boolean_toggle = BooleanToggle(True)
polyline = PolyLine(Vertices=flip_matrix, Closed=boolean_toggle)  # -> flatten(Polyline)
boundary_surfaces = BoundarySurfaces(Edges=polyline)

# ----
# also to generate the axis of rotation we use the points
param_viewer = ParamViewer(evaluate_curve.Tangent)
list_item = ListItem(List=param_viewer, Index=0, Wrap=Toggle(False))
tree_branch = TreeBranch(Tree=evaluate_curve.Tangent, Path=list_item, MaintainPaths=True)
cull_index = CullIndex(List=tree_branch, Indices="0", Wrap=True)

# ----
# Now we use a series of list components to only
# choose the points generated on spirals and then
# use a line component on the result so that by evaluating
# the lines we can generate a point on each one so
# that they are the centers for the surface rotation
boolean_toggle_2 = BooleanToggle(False)
list_length = ListLength(List=flip_matrix)  # -> expr("x-1", Length)
# Spike surface rotations
panel = Panel("0")
list_item_2 = ListItem(List=flip_matrix, Index=panel, Wrap=boolean_toggle_2)  # -> simplify(Item)
list_item_3 = ListItem(List=flip_matrix, Index=list_length, Wrap=boolean_toggle_2)  # -> simplify(Item)
line = Line(StartPoint=list_item_2, EndPoint=list_item_3)
evaluate_length = EvaluateLength(Curve=line, Length="0.5", Normalized=True)  # -> flatten(Point), Tangent, Parameter
cull_index_2 = CullIndex(List=evaluate_length.Point, Indices="1", Wrap=True)

# ----
# To rotate the surfaces outwards we use a rotate 3d
# component and for the angle a domain which the steps
# of its range is the same of evaluating spirals before
# then we use a radian component so the angle is in radians
number_slider_7 = Slider(60, range=-100..100)
construct_domain_3 = ConstructDomain(DomainStart=Slider(0, range=0..100), DomainEnd=number_slider_7)
range_3 = Range(Domain=construct_domain_3, Steps=expr("x-1", number_slider_6))
radians = Radians(Degrees=range_3)
rotate_3d = Rotate3D(Geometry=boundary_surfaces, Angle=radians, Center=cull_index_2, Axis=cull_index)  # -> Geometry, Transform

# ----
# Then we rotate the surfaces tht are already rotated 3d
# and for its angle we use the same pi method as before
number_slider_8 = Slider(5, range=0..10)
pi_3 = Pi(Factor="2")
range_4 = Range(Domain=pi_3, Steps=number_slider_8)  # -> reverse(Range)
cull_index_3 = CullIndex(List=range_4, Indices="0", Wrap=True)  # -> reverse(simplify(graft(List)))
rotate_3 = Rotate(Geometry=rotate_3d.Geometry, Angle=cull_index_3, Plane=PlaneXY(0, 0, 0))  # -> simplify(Geometry), Transform

# ----
# Spike surface extrusion
# In order to extrude the surfaces we need a direction
# and that direction is defined using surface evaluation
# and an MD slider so that the surface would be evaluated
# on itself
md_slider = MDSlider(SliderMode=0, slider_value=Point(0.5, 0.5, 0.5), x_domain=Domain(0, 1), y_domain=Domain(0, 1), z_domain=Domain(0, 1))
evaluate_surface = EvaluateSurface(Surface=reparameterize(rotate_3.Geometry), Point=md_slider)  # -> Point, Normal, UDirection, VDirection, Frame
range_5 = Range(Domain=Domain(0, 1), Steps=expr("x-1", number_slider_6))
amplitude = Amplitude(Vector=evaluate_surface.Point, Amplitude=Slider(1, range=0..10))
gradient = Gradient(LowerLimit=0, UpperLimit=1, Parameter=range_5, stops=[0: RGB(255, 255, 0), 1: RGB(255, 0, 0)])
extrude = Extrude(Base=rotate_3.Geometry, Direction=amplitude)
custom_preview = CustomPreview(Geometry=extrude, Material=gradient)
