# Grasshopper definition Tesselation_10.gh (Grasshopper 1.0.7)
# plug-ins: Anemone

# ----
# Iteration count
number_slider = Slider(5, range=0..10)

# ----
# Initiation rectangle
rectangle = Rectangle(Plane=PlaneXY(0, 0, 0), XSize=Domain(-1, 1), YSize=Domain(-2, 2), Radius=0)  # -> Rectangle, Length

# ----
# LO O P
loop_start = LoopStart(Repeat=number_slider, Trigger=Button(), Data=rectangle.Rectangle)  # -> port, Counter, simplify(graft(Data))

crv = Curve(loop_start.Data)

# ----
# Picking random point
offset = Slider(0.292, range=0..1)
lng = ListLength(List=flatten(loop_start.Data))
subtraction = Subtraction(A="1", B=offset)
series = Series(Start=0, Step=1, Count=lng)
addition = Addition(A=offset, B="0")
dom = ConstructDomain(DomainStart=addition, DomainEnd=subtraction)
random = Random(Range=dom, Number=1, Seed=expr("x+100", series))
random_2 = Random(Range=dom, Number=1, Seed=series)
pt = ConstructPoint(XCoordinate=random_2, YCoordinate=random, ZCoordinate=0)
evalsrf = EvaluateSurface(Surface=reparameterize(crv), Point=pt)  # -> Point, Normal, UDirection, VDirection, Frame

explode = Explode(Curve=crv, Recursive=True)  # -> Segments, Vertices
item = ListItem(List=explode.Vertices, Index=0, Wrap=True)  # -> Item, Item1, Item2, Item3

# ----
# Horizantal cuting
rec_3pt = Rectangle3Pt(PointA=item.Item, PointB=item.Item1, PointC=evalsrf.Point)  # -> Rectangle, Length
rec_3pt_2 = Rectangle3Pt(PointA=item.Item2, PointB=item.Item3, PointC=evalsrf.Point)  # -> Rectangle, Length
merge = Merge(Data1=rec_3pt.Rectangle, Data2=rec_3pt_2.Rectangle)

# ----
# Vertical cuting
rec_3pt_3 = Rectangle3Pt(PointA=item.Item3, PointB=item.Item, PointC=evalsrf.Point)  # -> Rectangle, Length
rec_3pt_4 = Rectangle3Pt(PointA=item.Item2, PointB=item.Item1, PointC=evalsrf.Point)  # -> Rectangle, Length
merge_2 = Merge(Data1=rec_3pt_4.Rectangle, Data2=rec_3pt_3.Rectangle)

# ----
# switching between 0 and 1
# from iteration number
panel = Panel("2")
mod = Modulus(A=loop_start.Counter, B=panel)

# ----
# switching between horizantal
# and vertical cutting
filter = StreamFilter(Gate=mod, Stream0=merge, Stream1=merge_2)

loop_end = LoopEnd(port=loop_start.port, Exit=False, Data=filter, TimeOutVal=0, pausedState=False, state="Constant output")  # -> flatten(Data)

area = Area(Geometry=loop_end)  # -> Area, Centroid
bnd = Bounds(Numbers=area.Area)
dom_2 = ConstructDomain(DomainStart=Slider(0.1, range=0..1), DomainEnd=Slider(0.9, range=0..1))
remap = RemapNumbers(Value=area.Area, Source=bnd, Target=dom_2)  # -> Mapped, Clipped
Z = UnitZ(Factor=remap.Mapped)
extr = Extrude(Base=loop_end, Direction=Z)
cap = CapHoles(Brep=extr)
preview = CustomPreview(Geometry=cap, Material=ColourSwatch(SwatchColor=RGB(189, 72, 72)))
