# Grasshopper definition Tesselation_12.gh (Grasshopper 1.0.7)
# plug-ins: Bifocals

hexagonal = Hexagonal(Plane=PlaneXY(0, 0, 0), Size=Slider(12.1, range=0..100), ExtentX=Slider(5, range=2..12), ExtentY=Slider(4, range=2..12))  # -> flatten(Cells), Points
curve = Curve(hexagonal.Cells)
explode = Explode(Curve=curve, Recursive=True)  # -> Segments, Vertices
area = Area(Geometry=curve)  # -> Area, graft(Centroid)
point_on_curve = PointOnCurve(explode.Segments, parameter=0.5)
bounding_box = BoundingBox(Content=flatten(area.Centroid), Plane=PlaneXY(0, 0, 0), UnionBox=True)  # -> Box, Box_2
line = Line(StartPoint=point_on_curve, EndPoint=area.Centroid)
surface = Surface(bounding_box.Box)
perp_frame = PerpFrame(Curve=reparameterize(line), Parameter=Slider(0.5, range=0..1))
deconstruct_plane = DeconstructPlane(Plane=perp_frame)  # -> Origin, XAxis, YAxis, ZAxis
multiplication = Multiplication(A=deconstruct_plane.YAxis, B=Slider(2.2, range=0..7))
move = Move(Geometry=deconstruct_plane.Origin, Motion=multiplication)  # -> Geometry, Transform
arc_3pt = Arc3Pt(PointA=area.Centroid, PointB=move.Geometry, PointC=point_on_curve)  # -> flatten(Arc), Plane, Radius
number_slider = Slider(2, range=0..10)
curve_2 = Curve(surface)
curve_3 = Curve(arc_3pt.Arc)
offset_curve = OffsetCurve(Curve=curve_3, Distance=expr("-x/2", number_slider), Plane=PlaneXY(0, 0, 0), Corners=1)
offset_curve_2 = OffsetCurve(Curve=curve_3, Distance=expr("x/2", number_slider), Plane=PlaneXY(0, 0, 0), Corners=1)
offset_curve_3 = OffsetCurve(Curve=curve_2, Distance=expr("-x", number_slider), Plane=PlaneXY(0, 0, 0), Corners=1)
loft = Loft(
    Curves=[offset_curve_2, offset_curve],
    Options={Adjust=False, Closed=False, LoftEnds=0, LoftSimp=0, LoftType=0, Rebuild=10, Refit=0.01})
curve_4 = Curve(flatten(loft))
loft_2 = Loft(
    Curves=flatten([curve_2, offset_curve_3]),
    Options={Adjust=False, Closed=False, LoftEnds=0, LoftSimp=0, LoftType=0, Rebuild=10, Refit=0.01})
region_union = RegionUnion(Curves=curve_4)
surface_2 = Surface(curve_2)
boundary_surfaces = BoundarySurfaces(Edges=region_union)
unit_z = UnitZ(Factor=1)
unit_z_2 = UnitZ(Factor=Slider(0.5, range=0..1))
extrude = Extrude(Base=boundary_surfaces, Direction=unit_z)
extrude_2 = Extrude(Base=loft_2, Direction=unit_z)
move_2 = Move(Geometry=surface_2, Motion=unit_z_2)  # -> Geometry, Transform
solid_union = SolidUnion(Breps=flatten([extrude, extrude_2]))
brep_brep = BrepBrep(BrepA=solid_union, BrepB=move_2.Geometry)  # -> Curves, Points
closed = Closed(Curve=brep_brep.Curves)  # -> Closed, Periodic
dispatch = Dispatch(List=brep_brep.Curves, DispatchPattern=closed.Closed)  # -> ListA, ListB
curve_5 = Curve(curve_2)
curve_6 = Curve(dispatch.ListA)
surface_3 = Surface(curve_5)
surface_split = SurfaceSplit(Surface=surface_3, Curves=curve_6)
unit_z_3 = UnitZ(Factor=1)
cull_index = CullIndex(List=surface_split, Indices=Slider(0, range=0..100), Wrap=True)
list_item = ListItem(List=surface_split, Index=0, Wrap=True)
extrude_3 = Extrude(Base=list_item, Direction=unit_z_3)
