# Grasshopper definition Tesslation_14.gh (Grasshopper 1.0.7)

number_slider = Slider(8, range=0..10)
number_slider_2 = Slider(1, range=0..100)
pt = ConstructPoint(XCoordinate=0, YCoordinate=0, ZCoordinate=0)
X = UnitX(Factor=1)
line = LineSDL(Start=pt, Direction=X, Length=number_slider)
rad = Radians(Degrees="30")
sin = Sine(Value=rad)
multiplication = Multiplication(A=sin, B=number_slider)
rotate = Rotate(Geometry=line, Angle=rad, Plane=PlaneXY(0, 0, 0))  # -> Geometry, Transform
multiplication_2 = Multiplication(A=multiplication, B="2")
addition = Addition(A="30", B="90")
crv = Curve(rotate.Geometry)
end = EndPoints(Curve=crv)  # -> Start, End
addition_2 = Addition(A=multiplication_2, B=number_slider)
rad_2 = Radians(Degrees=addition)
Z = UnitZ(Factor=number_slider_2)
pt_2 = Point(end.Start)
neg = Negative(Value=rad_2)
move = Move(Geometry=pt_2, Motion=Z)  # -> Geometry, Transform
Y = UnitY(Factor=1)
multiplication_3 = Multiplication(A=number_slider_2, B="2")
pt_3 = Point(end.End)
pt_4 = Point(move.Geometry)
line_2 = LineSDL(Start=pt_4, Direction=Y, Length=addition_2)
Z_2 = UnitZ(Factor=multiplication_3)
ln = Line(StartPoint=pt_4, EndPoint=pt_3)
rotate_2 = Rotate(Geometry=ln, Angle=neg, Plane=pt_3)  # -> Geometry, Transform
end_2 = EndPoints(Curve=rotate_2.Geometry)  # -> Start, End
end_3 = EndPoints(Curve=line_2)  # -> Start, End
move_2 = Move(Geometry=end_3.End, Motion=Z_2)  # -> Geometry, Transform
pt_5 = Point(end_2.Start)
ln_2 = Line(StartPoint=end_3.Start, EndPoint=move_2.Geometry)
crv_2 = Curve(ln_2)
pt_6 = Point(move_2.Geometry)
merge = Merge(Data1=crv_2, Data2=ln, Data3=rotate_2.Geometry)
number_slider_3 = Slider(20, range=0..100)
vec2pt = Vector2Pt(PointA=pt_5, PointB=pt_6, Unitize=False)  # -> Vector, Length
Z_3 = UnitZ(Factor=1)
len = Length(Curve=line_2)
join = JoinCurves(Curves=merge, Preserve=False)
pl = ConstructPlane(Origin=pt_5, XAxis=vec2pt.Vector, YAxis=Z_3)
multiplication_4 = Multiplication(A=len, B="1.5")
division = Division(A=number_slider_3, B=2)
series = Series(Start=0, Step="120", Count=Slider(3, range=0..10))
mirror = Mirror(Geometry=join, Plane=pl)  # -> Geometry, Transform
rad_3 = Radians(Degrees=series)
merge_2 = Merge(Data1=join, Data2=mirror.Geometry)
series_2 = Series(Start=0, Step=multiplication_4, Count=division)
series_3 = Series(Start=0, Step=multiplication_4, Count=Slider(16, range=0..100))
vec2pt_2 = Vector2Pt(PointA=end.Start, PointB=end.End, Unitize=False)  # -> Vector, Length
series_4 = Series(Start=0, Step=multiplication_4, Count=number_slider_3)
join_2 = JoinCurves(Curves=merge_2, Preserve=False)
weave = Weave(Pattern=[0, 1], Stream0=series_2, Stream1=series_2, NullGaps=False)
rotate_3 = Rotate(Geometry=join_2, Angle=rad_3, Plane=pt_6)  # -> Geometry, Transform
Y_2 = UnitY(Factor=series_3)
neg_2 = Negative(Value=weave)
amp = Amplitude(Vector=vec2pt_2.Vector, Amplitude=series_4)
boundary = BoundarySurfaces(Edges=rotate_3.Geometry)
mesh = Mesh(boundary)
group = Group(Objects=mesh)
move_3 = Move(Geometry=group, Motion=Y_2)  # -> Geometry, Transform
Y_3 = UnitY(Factor=neg_2)  # -> simplify(UnitVector)
graft = GraftTree(Tree=move_3.Geometry, IncludeEmptyLists=True, IncludeNullItems=True)
graft_2 = GraftTree(Tree=Y_3, IncludeEmptyLists=True, IncludeNullItems=True)  # -> simplify(Tree)
move_4 = Move(Geometry=graft, Motion=amp)  # -> simplify(Geometry), Transform
flip = FlipMatrix(Data=move_4.Geometry)
move_5 = Move(Geometry=flip, Motion=graft_2)  # -> Geometry, Transform
ungroup = Ungroup(Group=move_5.Geometry)
mjoin = MeshJoin(Meshes=ungroup)
meshnormalize = MeshNormalize(mesh=mjoin)  # -> out, A; inputs mesh: Mesh
# ---------- meshnormalize: C# ----------
    if(mesh != null){
      mesh.Normals.ComputeNormals();

      A = mesh;
    }
# ---------- end meshnormalize ----------
flatten = FlattenTree(Tree=meshnormalize.A, Path="{0}")
centerpoint = CenterPoint(B=flatten)
pdecon = Deconstruct(Point=centerpoint)  # -> XComponent, YComponent, ZComponent
addition_3 = Addition(A=pdecon.XComponent, B=pdecon.YComponent)
bnd = Bounds(Numbers=pdecon.YComponent)
bnd_2 = Bounds(Numbers=pdecon.XComponent)
bnd_3 = Bounds(Numbers=addition_3)
dom = ConstructDomain(DomainStart=Slider(0.8, range=0..1), DomainEnd=1)
remap = RemapNumbers(Value=pdecon.XComponent, Source=bnd_2, Target=Domain(0, 1))  # -> Mapped, Clipped
remap_2 = RemapNumbers(Value=pdecon.YComponent, Source=bnd, Target=Domain(0, 1))  # -> Mapped, Clipped
remap_3 = RemapNumbers(Value=pdecon.YComponent, Source=bnd_3, Target=dom)  # -> Mapped, Clipped
frgb = ColourRGBF(Alpha=1, Red=remap.Mapped, Green=remap_2.Mapped, Blue=remap_3.Mapped)
preview = CustomPreview(Geometry=flatten, Shader=frgb)

# ==== cluster CenterPoint
B = ClusterInput()
box_corners = BoxCorners(Box=B)  # -> CornerA, CornerB, CornerC, CornerD, CornerE, CornerF, CornerG, CornerH
ln = Line(PointA=box_corners.CornerA, PointB=box_corners.CornerG)
eval = EvaluateCurve(Curve=ln, Parameter=0.5)  # -> Point, Tangent, Angle
P = ClusterOutput(eval.Point)
