# Grasshopper definition TilingOverASurface.ghx (Grasshopper 1.0.7)

animation = Slider(18.85, range=0..18.85)
size = Slider(0.20807, range=0..0.5)
numb = Slider(10, range=2..20)
numb_2 = Slider(14, range=2..40)
hexgrid = Hexagonal(Plane=PlaneXY(0, 0, 0), Size=size, ExtentX=numb_2, ExtentY=numb)  # -> Cells, graft(Points)
explode = BrepComponents(Brep=hexgrid.Cells)  # -> Faces, Edges, Vertices
pcomp = Decompose(Point=[explode.Vertices, hexgrid.Points], System=PlaneXY(0, 0, 0))  # -> XComponent, YComponent, ZComponent
addition = Addition(A=animation, B=pcomp.XComponent)
panel = Panel("(cos(x) + sin(x-y)) / 3")
eval = Evaluate(F="(cos(x) + sin(x-y)) / 2", x=addition, y=pcomp.YComponent)
pt = PointXYZ(XComponent=pcomp.XComponent, YComponent=pcomp.YComponent, ZComponent=eval, System=PlaneXY(0, 0, 0))
_0_6_1_2 = ListItem(List=pt, Index=[0, 6, 1, 2], Wrap=False)
_2_6_3_4 = ListItem(List=pt, Index=[2, 6, 3, 4], Wrap=False)
_0_6_1_2_2 = ListItem(List=pt, Index=[4, 6, 5, 0], Wrap=False)
srfgrid = SurfaceFromPoints(Points=_0_6_1_2, UCount=2, Interpolate=False)
srfgrid_2 = SurfaceFromPoints(Points=_2_6_3_4, UCount=2, Interpolate=False)
srfgrid_3 = SurfaceFromPoints(Points=_0_6_1_2_2, UCount=2, Interpolate=False)
col = Colour(RGB(167, 19, 29))
preview = CustomPreview(
    Geometry=_0_6_1_2_2,
    Shader={diffuse=RGB(0, 0, 0), emission=RGB(76, 32, 54), shine=0.5, specular=RGB(255, 255, 255), transparency=0})
preview_2 = CustomPreview(Geometry=srfgrid, Shader=col)
