# Grasshopper definition TilingOverSurface-02.gh (Grasshopper 1.0.7)
# plug-ins: Weaverbird

# ---- group: a group of curves
hexgrid = Hexagonal(Plane=PlaneXY(-10.55213976, 5.665637213, 0), Size=2, ExtentX=9, ExtentY=16)  # -> Cells, Points
arc = CircularArc([{Angle=0, Angle=3.08734986, Plane=Plane(origin=(0, -12.87936404, 0.1365836204), x=(0.9999775253, 0, -0.006704395413), y=(0.006704395413, 0, 0.9999775253)), Radius=28.95298645}, {Angle=0, Angle=3.028209025, Plane=Plane(origin=(-0.4569871354, 16.87870354, 0), x=(0.9997330863, 0, 0.02310316181), y=(-0.02310316181, 0, 0.9997330863)), Radius=14.60370525}, {Angle=0, Angle=2.907187234, Plane=Plane(origin=(9.118104545, 29.47828606, 0), x=(0.9987275845, 0, 0.05043026813), y=(-0.05043026813, 0, 0.9987275845)), Radius=14.5212827}, {Angle=0, Angle=2.899501929, Plane=Plane(origin=(4.504817082, 62.81561779, 0), x=(0.9995247492, 0, 0.03082654193), y=(-0.03082654193, 0, 0.9995247492)), Radius=35.99093035}])
loft = Loft(Section=arc, Options={Adjust=False, Closed=False, LoftEnds=0, LoftSimp=1, LoftType=1, Rebuild=10, Refit=0.01})
project = Project(Curve=hexgrid.Cells, Brep=loft, Direction=Vector(0, 0, 1))
flatten = FlattenTree(Data=project, Path="{0}")

# ---- group: find discontinuities
disc = Discontinuity(Curve=flatten, Level=1)  # -> Points, Parameters

# ---- group: make polylines
pline = PolyLine(Vertices=disc.Points, Closed=False)

# ----
# From this version of Wb, most subdivision
# components accept polylines as inputs.
# They automatically convert them into meshes.
# Here how we could smoothen an hexagonal mesh.
wbcatmullclark = CatmullClarkSubdivision(MeshCurves=flatten(pline), Level=1, SmoothNakedEdges=1)
