# Grasshopper definition TilingOverSurfaces_03.gh (Grasshopper 1.0.7)
# plug-ins: LunchBox, Weaverbird, MeshEdit Components

number_slider = Slider(10, range=0..10)
platoicosa = PlatonicIcosahedron(Plane=PlaneXY(0, 0, 0), Radius=number_slider, Truncation=0.38198)
smesh = SimpleMesh(Brep=platoicosa)
wbtriangles = WeaverbirdsSplitTrianglesSubdivision(Level=1)
wbloop = WeaverbirdsLoopSubdivision(MeshCurves=smesh, Level=Slider(1, range=0..10), SmoothNakedEdges=1)
explode = MeshExplode(Mesh=wbloop, Interpolate=False)
medges = MeshEdges(Mesh=explode)  # -> NakedEdges, InteriorEdges, NonManifoldEdges
join = JoinCurves(Curves=medges.NakedEdges, Preserve=False)
explode_2 = Explode(Curve=join, Recursive=True)  # -> Segments, Vertices
midpoint = MidPoint(crv=explode_2.Segments)
pt = ConstructPoint(XCoordinate=0, YCoordinate=0, ZCoordinate=0)
division = Division(A="1", B="3")
scale = Scale(Geometry=explode_2.Segments, Center=midpoint, Factor=division)  # -> simplify(Geometry), Transform
end = EndPoints(Curve=scale.Geometry)  # -> Start, End
sph = Sphere(Base=pt, Radius=number_slider)
weave = Weave(Pattern=[0, 1], Stream0=end.Start, Stream1=end.End, NullGaps=False)
brep_cp = BrepClosestPoint(Point=weave, Brep=sph)  # -> Point, Distance
pline = PolyLine(Vertices=brep_cp.Point, Closed=True)
explode_3 = Explode(Curve=pline, Recursive=True)  # -> Segments, Vertices
dispatch = Dispatch(List=explode_3.Segments, DispatchPattern=[True, False])  # -> ListA, ListB
crv = Curve(flatten(dispatch.ListB))
join_2 = JoinCurves(Curves=crv, Preserve=False)
merge = Merge(Data1=flatten(join_2), Data2=flatten(pline))
graft = GraftTree(Tree=merge, IncludeEmptyLists=True, IncludeNullItems=True)
range = Range(Domain=Domain(0, 1), Steps=Slider(8, range=0..10))
centerpoint = CenterPoint(B=graft)  # -> simplify(P)
cull_i = CullIndex(List=range, Indices=0, Wrap=True)  # -> reverse(List)
scale_2 = Scale(Geometry=graft, Center=centerpoint, Factor=cull_i)  # -> simplify(Geometry), Transform
lng = ListLength(List=cull_i)  # -> expr("x-1", Length)
explode_4 = Explode(Curve=scale_2.Geometry, Recursive=True)  # -> Segments, Vertices
range_2 = Range(Domain=Domain(0, 1), Steps=lng)
vec2pt = Vector2Pt(PointA=pt, PointB=centerpoint, Unitize=False)  # -> Vector, Length
group = Group(Objects=explode_4.Segments)
pi = Pi(Factor=Slider(0.6, range=0..1))
pl = PlaneNormal(Origin=centerpoint, ZAxis=vec2pt.Vector)
pshift = ShiftPaths(Data=group, Offset=-1)
remap = RemapNumbers(Value=range_2, Source=Domain(0, 1), Target=pi)  # -> Mapped, Clipped
rotate = Rotate(Geometry=pshift, Angle=remap.Mapped, Plane=pl)  # -> simplify(Geometry), Transform
ungroup = Ungroup(Group=rotate.Geometry)
path_mapper = PathMapper(ungroup, source="{A;B}(i)", target="{A;i}(B)")
crv_2 = Curve(path_mapper)
shift = ShiftList(List=crv_2, Shift=-1, Wrap=False)  # -> simplify(graft(List))
shift_2 = ShiftList(List=crv_2, Shift=1, Wrap=False)  # -> simplify(graft(List))
merge_2 = Merge(Data1=shift, Data2=shift_2)
lng_2 = ListLength(List=cull_i)  # -> expr("x-2", Length)
loft = Loft(Curves=merge_2, Options={Adjust=False, Closed=False, LoftEnds=0, LoftSimp=0, LoftType=0, Rebuild=10, Refit=0.01})
range_3 = Range(Domain=Domain(0, 1), Steps=lng_2)
pshift_2 = ShiftPaths(Data=loft, Offset=-1)
gradient = Gradient(LowerLimit=0, UpperLimit=1, Parameter=range_3, stops=[0.15: RGB(55, 0, 255), 0.85: RGB(0, 172, 219)])
preview = CustomPreview(Geometry=pshift_2, Shader=gradient)

# ==== cluster MidPoint: Middle Point of Curve
crv = ClusterInput()
num = Number(0.5)
eval = EvaluateLength(Curve=crv, Length=num, Normalized=True)  # -> Point, Tangent, Parameter
pt = ClusterOutput(eval.Point)

# ==== cluster CenterPoint
B = ClusterInput()
box_corners = BoxCorners(Box=B)  # -> CornerA, CornerB, CornerC, CornerD, CornerE, CornerF, CornerG, CornerH
ln = Line(PointA=box_corners.CornerA, PointB=box_corners.CornerG)
eval = EvaluateCurve(Curve=ln, Parameter=0.5)  # -> Point, Tangent, Angle
P = ClusterOutput(eval.Point)
