# Grasshopper definition TreeFractal.gh (Grasshopper 1.0.7)

repeat = Slider(5, range=0..5)
divide = Slider(3, range=1..4)
angle = Slider(13.5, range=0.1..100)
a_change = Slider(1.59, range=0.01..2)
length = Slider(19.91, range=2..20)
l_change = Slider(0.36, range=0.1..1)
thickness = BooleanToggle(False)
python = GhPythonScript(
    repeat=repeat,
    Trunk_Length=Slider(3, range=2..85.6),
    division=divide,
    angle=angle,
    angle_multi=a_change,
    length=length,
    length_multi=l_change,
    Thickened_Lines=thickness,
    Thickness=Slider(0.131, range=0..1))  # -> Base_Lines, Thickness_Lines; inputs repeat: Int32, division: Int32, Thickened_Lines: Boolean
# ---------- python: Python ----------
import ghpythonlib.components as gh
import math as m
from System import Object
from Grasshopper import DataTree
from Grasshopper.Kernel.Data import GH_Path
import Rhino.Geometry as rg


def raggedListToDataTree(nestedlist):
    rl = nestedlist
    result = DataTree[object]()
    for i in range(len(nestedlist)):
        temp = []
        for j in range(len(nestedlist[i])):
            temp.append(nestedlist[i][j])
        #print i, " - ",temp
        path = GH_Path(i)
        result.AddRange(temp, path)
    return result



branch = gh.LineSDL(gh.ConstructPoint(0,0,0) , gh.UnitZ(1) , Trunk_Length)


live_branches = [branch]
dead_branches = []
for _ in range(repeat):
    anglesmultipication = angle*angle_multi
    domain = gh.ConstructDomain(m.radians(anglesmultipication)+m.pi*0.5 ,1.5*m.pi -m.radians(anglesmultipication))
    
    new_branches = []
    for i in range(len(live_branches)):
        pp = gh.EndPoints(live_branches[i])
        vect = gh.Vector2Pt(pp[1], pp[0], False)[0]
        plane = gh.ConstructPlane(gh.EndPoints(live_branches[i])[1] , vect , gh.UnitY(1))
        arc= gh.Arc(plane , length*length_multi , domain)[0]
        divided = gh.DivideCurve(arc , division , True)[0]
        for point in divided:
            line = gh.Line(plane , point)
            new_branches.append(line)
    dead_branches.append(live_branches)
    live_branches =new_branches
    angle *= angle_multi
    length*= length_multi
baseLine = dead_branches
baseLine.append(live_branches)
print(len(baseLine))
Base_Lines = raggedListToDataTree(baseLine)

if(Thickened_Lines):
    breps= []
    for i in range(len(baseLine)):
        for j in range(len(baseLine[i])):
            breps.append(gh.Pipe(baseLine[i][j] , gh.Length(baseLine[i][j])*Thickness , 1))
            
    brep = gh.BrepJoin(breps)[0]

    Thickness_Lines_ =rg.Intersect.Intersection.BrepPlane(gh.SolidUnion(brep) , rg.Plane.WorldYZ , 0.01)[1]
# ---------- end python ----------
join_curves = JoinCurves(Curves=python.Thickness_Lines, Preserve=False)
surface = Surface(join_curves)
custom_preview = CustomPreview(Geometry=surface, Material=ColourSwatch(SwatchColor=RGB(255, 255, 0)))
custom_preview_2 = CustomPreview(Geometry=python.Base_Lines, Material=ColourSwatch(SwatchColor=RGB(0, 0, 0)))
