# Grasshopper definition Weaving-02.gh (Grasshopper 1.0.7)
# plug-ins: Weaverbird

crv = Curve(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)
number_of_arches = Slider(3, range=0..10)
neg = Negative(Value=Slider(0, range=0..10))
offset = OffsetCurve(Curve=crv, Distance=neg, Plane=PlaneXY(0, 0, 0), Corners=1)
multiplication = Multiplication(A=number_of_arches, B=2)
divide = DivideCurve(Curve=crv, Count=number_of_arches, Kinks=False)  # -> Points, Tangents, Parameters
divide_2 = DivideCurve(Curve=offset, Count=multiplication, Kinks=False)  # -> Points, Tangents, Parameters
cull = CullPattern(List=divide_2.Points, CullPattern=[False, True])
Z = UnitZ(Factor=1)

Y = UnitY(Factor=1)
rotate = Rotate(Geometry=Y, Angle=degrees(Slider(42, range=0..100)), Plane=PlaneXY(0, 0, 0))  # -> Geometry, Transform
line = LineSDL(Start=divide.Points, Direction=rotate.Geometry, Length=Slider(5, range=0..10))
cull_i = CullIndex(List=line, Indices="-1", Wrap=True)
end = EndPoints(Curve=cull_i)  # -> Start, End
cat = Catenary(PointA=end.Start, PointB=end.End, Length=Slider(12, range=0..20), Gravity=Z)

Y_2 = UnitY(Factor=1)
rotate_2 = Rotate(Geometry=Y_2, Angle=degrees(Slider(29, range=0..100)), Plane=PlaneXY(0, 0, 0))  # -> Geometry, Transform
line_2 = LineSDL(Start=cull, Direction=rotate_2.Geometry, Length=Slider(8, range=0..10))
end_2 = EndPoints(Curve=line_2)  # -> Start, End
cat_2 = Catenary(PointA=end_2.Start, PointB=end_2.End, Length=Slider(9, range=0..20), Gravity=Z)

weave = Weave(Pattern=[0, 1], Stream0=cat, Stream1=cat_2, NullGaps=False)
loft = Loft(Curves=weave, Options={Adjust=True, Closed=False, LoftEnds=0, LoftSimp=1, LoftType=5, Rebuild=10, Refit=0.01})
mesh_uv = MeshSurface(Surface=loft, UCount=Slider(43, range=0..100), VCount=Slider(11, range=0..100), Overhang=True, Equalize=False)
m_thatch = Thatch(G=mesh_uv, T0=Slider(0.449, range=0..1), D=Slider(0.339, range=0..1))  # -> out, A; inputs G: GeometryBase, I: list, T0: list, D: list, clr: list of Color
# ---------- m_thatch: VB ----------
    Component.Params.Input(0).Name = "Mesh or Curve"
    Component.Params.Input(0).Description = "Open or closed mesh or curve"
    Component.Params.Input(1).Name = "Index [Face]"
    Component.Params.Input(1).Description = "An optional integer or list of integers which specify the faces to be modified if the input is a mesh. If no value is supplied then all faces will be modified"
    Component.Params.Input(2).Name = "Width [Vertex]"
    Component.Params.Input(2).Description = "Width of face from the evaluation of the vertex to edge midpoint"
    Component.Params.Input(3).Name = "Distance [Vertex]"
    Component.Params.Input(3).Description = "An optional number or list of numbers for the offset value from the existing face"
    Component.Params.Input(4).Name = "Colors [Vertex]"
    Component.Params.Input(4).Description = "(If applied to a mesh a list of colors corresponding to each mesh vertex, if applied to a curve, a list of colors corresponding to each control point plus an additonal color value for the new averaged center"

    Component.Params.Output(1).Name = "Mesh"
    Component.Params.Output(1).Description = "If successful, a valid mesh"

    If g IsNot Nothing Then
      Dim j,k,kk,n,t,v,w,cnt As Integer
      Dim u() As Integer = Nothing
      Dim tint() As Integer = Nothing
      Dim mo As New mesh
      Dim ov,cv As New list(Of Point3d)
      Dim ofc As New list(Of meshface)
      Dim oc,oca As New list(Of color)

      Dim blnM, blnC As Boolean

      Dim cen As point3d
      Dim vec As Vector3d
      Dim clrB As Boolean
      Dim avgClr,avgClrC As color

      blnM = g.ObjectType = ObjectType.Mesh
      blnC = g.ObjectType = ObjectType.Curve

      'Declare Mesh Variables
      Dim m As mesh
      Dim mf As Rhino.Geometry.Collections.MeshFaceList = Nothing
      Dim mv As Rhino.Geometry.Collections.MeshVertexList = Nothing
      Dim mtv As Rhino.Geometry.Collections.MeshTopologyVertexList = Nothing
      Dim mn As Rhino.Geometry.Collections.MeshFaceNormalList = Nothing
      Dim mc As Rhino.Geometry.Collections.MeshVertexColorList

      'Declare Curve Variables
      Dim crv As curve
      Dim ncrv As nurbsCurve
      Dim npts As rhino.Geometry.Collections.NurbsCurvePointList
      Dim vs() As vector3f

      If (blnM Or blnC) Then

        If blnM Then
          'Start Deconstruct if Mesh
          m = g
          m.Normals.ComputeNormals()
          m.FaceNormals.ComputeFaceNormals()
          mf = m.Faces
          mv = m.Vertices
          mtv = m.TopologyVertices
          mn = m.FaceNormals
          mc = m.VertexColors

          'Check Mesh Color Status
          If ((m.VertexColors.count() <> 0) Or (clr.count() <> 0)) Then clrB = True
          If ((m.VertexColors.count() = 0) And (clr.count() <> 0)) Then mc.CreateMonotoneMesh(color.LightGray)

          'Populate Vertex/ Color Lists
          oc = mc.ToArray().ToList()
        Else
          'Start Deconstruct if Curve
          crv = g
          ncrv = crv.ToNurbsCurve()
          npts = ncrv.Points
          Dim pline As Polyline = ncrv.Points.ControlPolygon
          Dim cmsh As New mesh
          cmsh.Vertices.AddVertices(pline.ToArray())
          cmsh.faces.addfaces(pline.TriangulateClosedPolyline())
          cmsh.Normals.ComputeNormals()
          cmsh.Normals.UnitizeNormals

          cv = pline.ToArray().ToList()
          If crv.IsClosed() Then cv.RemoveAt(pline.count() - 1)

          v = cv.Count() - 1
          If Not crv.IsClosed() Then v += 1
          u = appendprepend(v)
          w = -1
          vs = cmsh.Normals.ToArray()

          For j = 0 To v Step 1
            vec += vs(u(j))
            If (clr.count() > 0) Then If j > (clr.count() - 1) Then oc.add(clr.item(clr.count() - 1)) Else oc.add(clr.item(j))
          Next
          vec /= v
          vec.Unitize
          cen = pline.CenterPoint
        End If

        'Check clr input status
        If clr.count() <> 0 Then clrB = True

      End If

      If blnM Then If i.count() > 0 Then cnt = i.count() Else cnt = mf.count() Else cnt = 1
      For n = 0 To cnt - 1 Step 1
        If blnM Then
          If i.count() > 0 Then j = i.item(n) Else j = n

          tint = mf.GetTopologicalVertices(j)
          cen = mf.GetFaceCenter(j)
          vec = mn.item(j)

          If mf(j).isquad() Then v = 3 Else v = 2
          u = appendprepend(v)
          w = ov.count() - 1
        Else
          j = n
        End If
        vec.Unitize()

        t = 14
        Dim clB As Boolean
        If clrB Then
          clB = (blnC And ((clr.count() - 1) > v))
          Dim tt As Integer
          Dim aR,aG,aB,bR,bG,bB As New Double
          For k = 0 To v Step 1
            If blnM Then tt = mtv.MeshVertexIndices(tint(k))(0) Else tt = k
            aR += oc.item(tt).R
            aG += oc.item(tt).G
            aB += oc.item(tt).B
            If clr.count() > 0 Then
              If tt > (clr.count() - 1) Then tt = clr.count() - 1
              bR += clr.item(tt).R
              bG += clr.item(tt).G
              bB += clr.item(tt).B
            End If
          Next

          If (blnM Or ((clr.count() - 1) <= v)) Then avgClr = avgC(aR, aG, aB, v + 1) Else avgClr = clr.item(clr.count() - 1)
          If (blnM Or ((clr.count() - 1) <= v)) Then avgClrC = avgC(bR, bG, bB, v + 1) Else avgClrC = clr.item(clr.count() - 1)
        End If

        For k = 1 To v + 1  Step 1
          'Keep distance and t values from exceeding list lengths
          Dim p(3) As point3d
          Dim tv(3) As Integer
          Dim da(3),ta0(3) As Double
          Dim tc(3) As color

          For kk = 0 To 3 Step 1
            If blnM Then
              tv(kk) = mtv.MeshVertexIndices(tint(u(k + kk - 1)))(0)
              p(kk) = New point3d(mv(tv(kk)))
            Else
              tv(kk) = u(k + kk - 1)
              p(kk) = New point3d(cv(tv(kk)))
            End If

            If tv(kk) > (d.count() - 1) Then da(kk) = d.item(d.count() - 1) Else da(kk) = d.item(tv(kk))
            If tv(kk) > (t0.count() - 1) Then ta0(kk) = t0.item(t0.count() - 1) Else ta0(kk) = t0.item(tv(kk))
            If clr.count() > 0 Then If tv(kk) > (clr.count() - 1) Then tc(kk) = clr.item(clr.count() - 1) Else tc(kk) = clr.item(tv(kk))

          Next

          'Define Vertices
          Dim pA(1),pB(1),pC(1),pD(1),pE(1),pF(1),pH(1) As point3d
          Dim vA(1) As Vector3d

          pA(0) = (p(0) + p(1)) / 2
          pA(1) = (p(2) + p(3)) / 2
          For kk = 0 To 1 Step 1
            pB(kk) = (pA(kk) + p(kk + 1)) / 2
            pC(kk) = evalP(pA(kk), pB(kk), ta0(kk + 1))
            pD(kk) = evalP(p(kk + 1), pB(kk), ta0(kk + 1))
          Next

          pE(0) = (pC(0) + pC(1)) / 2
          pE(1) = (pD(0) + pD(1)) / 2

          ov.add(pC(0))
          ov.add(pD(0))

          ov.add(evalP(pC(0), pE(0), ta0(1) / 2) + New point3d(vec * da(1)))
          ov.add(evalP(pD(0), pE(1), ta0(1) / 2) + New point3d(vec * da(1)))

          ov.add(evalP(pE(0), pC(0), ta0(1) / 2) + New point3d(vec * da(1)))
          ov.add(evalP(pE(1), pD(0), ta0(1) / 2) + New point3d(vec * da(1)))

          ov.add(pE(0))
          ov.add(pE(1))

          ov.add(evalP(pC(1), pE(0), ta0(2) / 2) + New point3d(vec * -da(2)))
          ov.add(evalP(pD(1), pE(1), ta0(2) / 2) + New point3d(vec * -da(2)))

          ov.add(evalP(pE(0), pC(1), ta0(2) / 2) + New point3d(vec * -da(2)))
          ov.add(evalP(pE(1), pD(1), ta0(2) / 2) + New point3d(vec * -da(2)))

          ov.add(pC(1))
          ov.add(pD(1))

          'Define Faces
          ofc.Add(New meshface(w + u(k) * t + 1, w + u(k) * t + 2, w + u(k) * t + 4, w + u(k) * t + 3))
          ofc.Add(New meshface(w + u(k) * t + 3, w + u(k) * t + 4, w + u(k) * t + 6, w + u(k) * t + 5))
          ofc.Add(New meshface(w + u(k) * t + 5, w + u(k) * t + 6, w + u(k) * t + 8, w + u(k) * t + 7))
          ofc.Add(New meshface(w + u(k) * t + 7, w + u(k) * t + 8, w + u(k) * t + 12, w + u(k) * t + 11))
          ofc.Add(New meshface(w + u(k) * t + 11, w + u(k) * t + 12, w + u(k) * t + 10, w + u(k) * t + 9))
          ofc.Add(New meshface(w + u(k) * t + 9, w + u(k) * t + 10, w + u(k) * t + 14, w + u(k) * t + 13))

          'Define Vertex Colors
          If clrB Then
            Dim xa, xb As Integer
            xa = 1
            xb = 2
            Dim tclr(2) As color
            tclr(0) = evalC(oc.item(tv(xa)), oc.item(tv(xb)), 0.25)
            tclr(1) = evalC(oc.item(tv(xa)), oc.item(tv(xb)), 0.5)
            tclr(2) = evalC(oc.item(tv(xa)), oc.item(tv(xb)), 0.75)


            Dim blCa As Boolean = False
            Dim blCb As Boolean = False

            If clr.count() > 0 Then
              If (clB Or blnM) Then blCa = True Else blCa = False
              If ((tv(xa) > (clr.count() - 1)) Or (tv(xb) > (clr.count() - 1))) Then blCb = True
            End If
            If blCa Then If (blCb Or clB) Then oca.add(clr.item(clr.count() - 1)) Else oca.add(clr.item(tv(xa))) Else oca.add(oc.item(tv(xa)))
            oca.add(oc.item(tv(xa)))

            If blCa Then If (blCb Or clB) Then oca.add(clr.item(clr.count() - 1)) Else oca.add(evalC(clr.item(tv(xa)), clr.item(tv(xb)), ta0(xa))) Else oca.add(evalC(oc.item(tv(xa)), tclr(0), ta0(xa)))
            oca.add(evalC(oc.item(tv(xa)), tclr(0), evalT(ta0(xa), ta0(xb), 0.25)))

            If blCa Then If (blCb Or clB) Then oca.add(clr.item(clr.count() - 1)) Else oca.add(evalC(clr.item(tv(xa)), clr.item(tv(xb)), ta0(xa))) Else oca.add(evalC(tclr(1), tclr(0), ta0(xa)))
            oca.add(evalC(tclr(1), tclr(0), evalT(ta0(xa), ta0(xb), 0.5)))

            If blCa Then If (blCb Or clB) Then oca.add(clr.item(clr.count() - 1)) Else oca.add(evalC(clr.item(tv(xa)), clr.item(tv(xb)), 0.5)) Else oca.add(tclr(1))
            oca.add(tclr(1))

            If blCa Then If (blCb Or clB) Then oca.add(clr.item(clr.count() - 1)) Else oca.add(evalC(clr.item(tv(xa)), clr.item(tv(xb)), ta0(xb))) Else oca.add(evalC(oc.item(tv(xb)), tclr(2), ta0(xb)))
            oca.add(evalC(oc.item(tv(xb)), tclr(2), evalT(ta0(xa), ta0(xb), 0.75)))

            If blCa Then If (blCb Or clB) Then oca.add(clr.item(clr.count() - 1)) Else oca.add(evalC(clr.item(tv(xa)), clr.item(tv(xb)), ta0(xb))) Else oca.add(evalC(tclr(1), tclr(2), ta0(xb)))
            oca.add(evalC(tclr(1), tclr(2), evalT(ta0(xa), ta0(xb), 0.75)))

            If blCa Then If (blCb Or clB) Then oca.add(clr.item(clr.count() - 1)) Else oca.add(clr.item(tv(xb))) Else oca.add(oc.item(tv(xb)))
            oca.add(oc.item(tv(xb)))
          End If

        Next
      Next

      mo.Vertices.AddVertices(ov.toarray())
      If clrB Then mo.VertexColors.AppendColors(oca.toarray())
      mo.Faces.AddFaces(ofc.toarray())
      A = mo

    End If
# ---------- m_thatch: VB additional code ----------
  Private Function appendprepend(ByVal i As Integer)
    Dim srsEnum As IEnumerable(Of Integer) = Enumerable.Range(0, i + 1)
    Dim arrVal As New list(Of Integer)
    arrVal = srsEnum.tolist()
    arrVal.add(0)
    arrVal.add(1)
    arrVal.insert(0, i)
    Return arrVal.toarray()
  End Function

  Private Function evalP(ByVal op As point3d, ByVal tp As Point3d, ByVal t As Double)
    Return New point3d(op + (tp - op) * t)
  End Function

  Private Function evalC(ByVal oc As color, ByVal tc As color, ByVal t As Double)
    Dim r,g,b As Integer
    r = CInt(CInt(oc.R) + (CInt(tc.R) - CInt(oc.R)) * t)
    g = CInt(CInt(oc.G) + (CInt(tc.G) - CInt(oc.G)) * t)
    b = CInt(CInt(oc.B) + (CInt(tc.B) - CInt(oc.B)) * t)

    If r > 255 Then r = 255 Else If r < 0 Then r = 0
    If g > 255 Then g = 255 Else If g < 0 Then g = 0
    If b > 255 Then b = 255 Else If b < 0 Then b = 0

    Return color.FromArgb(r, g, b)
  End Function

  Private Function evalT(ByVal ta As Double, ByVal tb As Double, ByVal t As Double)
    Return ta + (tb - ta) * t
  End Function

  Private Function avgC(ByVal R As Double, ByVal G As Double, ByVal B As Double, ByVal T As Integer)

    R /= t
    G /= t
    B /= t
    If R > 255 Then R = 255 Else If R < 0 Then R = 0
    If G > 255 Then G = 255 Else If G < 0 Then G = 0
    If B > 255 Then B = 255 Else If B < 0 Then B = 0

    Return color.FromArgb(CInt(R), CInt(G), CInt(B))
  End Function
# ---------- end m_thatch ----------
wbthicken = WeaverbirdsMeshThicken(MeshCurves=m_thatch.A, Distance=Slider(0.07, range=0..1), OffsetType=0)
preview = CustomPreview(
    Geometry=wbthicken,
    Material={diffuse=RGB(221, 160, 221), emission=RGB(66, 48, 66), shine=0.5, specular=RGB(255, 255, 255), transparency=0})
