# Grasshopper definition Weaving-03.gh (Grasshopper 1.0.7)
# plug-ins: Weaverbird

closed = BooleanToggle(False)
flip = BooleanToggle(False)
distance = Slider(0.07, range=0..2)
A = Slider(0.9, range=0.1..0.9)
B = Slider(0.14, range=0.1..0.9)
C = Slider(0.35, range=0.1..0.9)
number_slider = Slider(10, range=0..100)
xz_plane = XZPlane(Origin=Point(0, 0, 0))
rectangle = Rectangle(Plane=xz_plane, XSize=number_slider, YSize=number_slider, Radius=0)  # -> Rectangle, Length
criss_cross = CrissCross(G=rectangle.Rectangle, T0=A, T1=B, T2=C, D=distance, C=closed, F=flip)  # -> out, A; inputs G: GeometryBase, I: list, T0: list, T1: list, T2: list, D: list, C: list, F: list, clr: list of Color
# ---------- criss_cross: VB ----------
    Component.Params.Input(0).Name = "Mesh or Curve"
    Component.Params.Input(0).Description = "Open or closed mesh or curve"
    Component.Params.Input(1).Name = "Index [Face]"
    Component.Params.Input(1).Description = "An optional integer or list of integers which specify the faces to be modified if the input is a mesh. If no value is supplied then all faces will be modified"
    Component.Params.Input(2).Name = "Gap Width [Vertex]"
    Component.Params.Input(2).Description = "Sets the face width from edge midpoint to face vertex that defines the gap between faces"
    Component.Params.Input(3).Name = "Corner Pinch [Vertex]"
    Component.Params.Input(3).Description = "Pinches the corner vertex"
    Component.Params.Input(4).Name = "Band Width [Vertex]"
    Component.Params.Input(4).Description = "Sets the width of the band relative to the edge and gap"
    Component.Params.Input(5).Name = "Distance [Vertex]"
    Component.Params.Input(5).Description = "An optional number or list of numbers for the offset value from the existing face"
    Component.Params.Input(6).Name = "Closed [Vertex]"
    Component.Params.Input(6).Description = "An optional boolean or list of boolean values which if true will close the edge faces"
    Component.Params.Input(7).Name = "Flip [Vertex]"
    Component.Params.Input(7).Description = "An optional boolean or list of boolean values which if true will flip up and down directions "
    Component.Params.Input(8).Name = "Colors [Vertex]"
    Component.Params.Input(8).Description = "(If applied to a mesh a list of colors corresponding to each mesh vertex, if applied to a curve, a list of colors corresponding to each control point plus an additonal color value for the new averaged center"

    Component.Params.Output(1).Name = "Mesh"
    Component.Params.Output(1).Description = "If successful, a valid mesh"

    If g IsNot Nothing Then
      Dim j,k,kk,n,t,v,w,cnt As Integer
      Dim u() As Integer = Nothing
      Dim tint() As Integer = Nothing
      Dim mo As New mesh
      Dim ov,cv As New list(Of Point3d)
      Dim ofc As New list(Of meshface)
      Dim oc As New list(Of color)

      Dim blnM, blnC As Boolean

      Dim cen As point3d
      Dim vec As Vector3d
      Dim clrB As Boolean
      Dim avgClr,avgClrC As color

      blnM = g.ObjectType = ObjectType.Mesh
      blnC = g.ObjectType = ObjectType.Curve

      'Declare Mesh Variables
      Dim m As mesh
      Dim mf As Rhino.Geometry.Collections.MeshFaceList = Nothing
      Dim mv As Rhino.Geometry.Collections.MeshVertexList = Nothing
      Dim mtv As Rhino.Geometry.Collections.MeshTopologyVertexList = Nothing
      Dim mn As Rhino.Geometry.Collections.MeshFaceNormalList = Nothing
      Dim mc As Rhino.Geometry.Collections.MeshVertexColorList

      'Declare Curve Variables
      Dim crv As curve
      Dim ncrv As nurbsCurve
      Dim npts As rhino.Geometry.Collections.NurbsCurvePointList
      Dim vs() As vector3d

      If (blnM Or blnC) Then

        If blnM Then
          'Start Deconstruct if Mesh
          m = g
          
          If m.Faces.TriangleCount() > 0 Then Exit Sub
          m.Normals.ComputeNormals()
          m.FaceNormals.ComputeFaceNormals()
          mf = m.Faces
          mv = m.Vertices
          mtv = m.TopologyVertices
          mn = m.FaceNormals
          mc = m.VertexColors

          'Check Mesh Color Status
          If ((m.VertexColors.count() <> 0) Or (clr.count() <> 0)) Then clrB = True
          If ((m.VertexColors.count() = 0) And (clr.count() <> 0)) Then mc.CreateMonotoneMesh(color.LightGray)

          'Populate Vertex/ Color Lists
          ov = mv.ToPoint3dArray().ToList()
          oc = mc.ToArray().ToList()
        Else
          'Start Deconstruct if Curve
          crv = g
          ncrv = crv.ToNurbsCurve()
          npts = ncrv.Points

          v = npts.Count() - 2
          If Not crv.IsClosed() Then v += 1
          u = appendprepend(v)
          w = v

          If v <> 3 Then Exit Sub
          
          ReDim vs(v)
          For j = 1 To v + 1 Step 1
            Dim pln As New plane(New point3d(npts.item(u(j)).location), New point3d(npts.item(u(j + 1)).location), New point3d(npts.item(u(j - 1)).location))
            vs(u(j)) = pln.ZAxis
            vs(u(j)).Unitize()
            vec += vs(u(j))
            cen += New point3d(npts.item(u(j)).location)
            ov.add(New point3d(npts.item(u(j)).location))
            cv.add(New point3d(npts.item(u(j)).location))
            If (clr.count() > 0) Then If u(j) > (clr.count() - 1) Then oc.add(clr.item(clr.count() - 1)) Else oc.add(clr.item(u(j)))
          Next
        End If
        vec /= (v + 1)
        cen /= (v + 1)

        'Check clr input status
        If clr.count() <> 0 Then clrB = True

      End If

      If blnM Then If i.count() > 0 Then cnt = i.count() Else cnt = mf.count() Else cnt = 1
      For n = 0 To cnt - 1 Step 1
        If blnM Then
          If i.count() > 0 Then j = i.item(n) Else j = n

          tint = mf.GetTopologicalVertices(j)
          cen = mf.GetFaceCenter(j)
          vec = mn.item(j)

          If mf(j).isquad() Then v = 3 Else v = 2
          u = appendprepend(v)
          w = ov.count() - 1
        Else
          j = n
        End If
        vec.Unitize()

        If v = 3 Then
          Dim ca As Double
          Dim fa As Boolean
          If j > (c.count() - 1) Then ca = c.item(c.count() - 1) Else ca = c.item(j)
          If j > (f.count() - 1) Then fa = f.item(f.count() - 1) Else fa = f.item(j)

          t = 19

          Dim tt As Integer
          Dim aR,aG,aB,bR,bG,bB As New Double
          Dim avgT As Double = 0
          For k = 0 To v Step 1
            If blnM Then tt = mtv.MeshVertexIndices(tint(k))(0) Else tt = k
            If tt > (t2.count() - 1) Then avgT += t2.item(t2.count() - 1) Else avgT += t2.item(tt)
            If clrB Then
              aR += oc.item(tt).R
              aG += oc.item(tt).G
              aB += oc.item(tt).B
              If clr.count() > 0 Then
                If tt > (clr.count() - 1) Then tt = clr.count() - 1
                bR += clr.item(tt).R
                bG += clr.item(tt).G
                bB += clr.item(tt).B
              End If
            End If
          Next

          avgT /= (v + 1)
          If clrB Then
            If (blnM Or ((clr.count() - 1) <= v)) Then avgClr = avgC(aR, aG, aB, v + 1) Else avgClr = clr.item(clr.count() - 1)
            If (blnM Or ((clr.count() - 1) <= v)) Then avgClrC = avgC(bR, bG, bB, v + 1) Else avgClrC = clr.item(clr.count() - 1)
          End If

          For k = 1 To v + 1  Step 1
            'Keep distance and t values from exceeding list lengths
            Dim p(1) As point3d
            Dim tcx(1) As color
            Dim da(1),ta0(1),ta1(1),ta2(1) As Double
            Dim tv(1) As Integer
            Dim tc(1) As color

            For kk = 0 To 1 Step 1
              If blnM Then
                tv(kk) = mtv.MeshVertexIndices(tint(u(k + kk)))(0)
                p(kk) = New point3d(mv(tv(kk)))
              Else
                tv(kk) = u(k + kk)
                p(kk) = New point3d(cv(tv(kk)))
              End If
              If clrB Then tcx(kk) = oc.item(tv(kk))

              If tv(kk) > (d.count() - 1) Then da(kk) = d.item(d.count() - 1) Else da(kk) = d.item(tv(kk))
              If tv(kk) > (t0.count() - 1) Then ta0(kk) = t0.item(t0.count() - 1) Else ta0(kk) = t0.item(tv(kk))
              If tv(kk) > (t1.count() - 1) Then ta1(kk) = t1.item(t1.count() - 1) Else ta1(kk) = t1.item(tv(kk))
              If tv(kk) > (t2.count() - 1) Then ta2(kk) = t2.item(t2.count() - 1) Else ta2(kk) = t2.item(tv(kk))
              If clr.count() > 0 Then If tv(kk) > (clr.count() - 1) Then tc(kk) = clr.item(clr.count() - 1) Else tc(kk) = clr.item(tv(kk))

            Next

            'Define Vertices
            Dim pB(1),pC,pD(1),pE(1),pF(1),pG(1) As point3d
            Dim clB(1),clC,clD(1),clE(1),clF(1),clG(1) As color
            Dim tpt As point3d
            pC = (p(0) + p(1)) / 2
            If clrB Then clC = evalC(tcx(0), tcx(1), 0.5)

            For kk = 0 To 1 Step 1
              pD(kk) = evalP(p(kk), pC, ta0(kk))
              pB(kk) = (pD(kk) + p(kk)) / 2
              pE(kk) = evalP(p(kk), cen, ta0(kk))
              pF(kk) = (pE(kk) + p(kk)) / 2
              pG(kk) = (pD(kk) + pE(kk)) / 2
              If clrB Then
                If clr.count() > 0 Then clD(kk) = evalC(tcx(kk), evalC(tc(0), tc(1), 0.5), ta0(kk)) Else clD(kk) = evalC(tcx(kk), clC, ta0(kk))
                clB(kk) = evalC(clD(kk), tcx(kk), 0.5)
                If clr.count() > 0 Then  clE(kk) = evalC(tcx(kk), avgClrC, ta0(kk)) Else clE(kk) = evalC(tcx(kk), avgClr, ta0(kk))
                clF(kk) = evalC(clE(kk), tcx(kk), 0.5)
                clG(kk) = evalC(clD(kk), clE(kk), 0.5)
              End If
            Next

            ov.add(evalP(p(0), pB(0), ta1(0))) '4
            ov.add(evalP(pD(0), pB(0), evalT(ta2(0), (ta2(0) + ta2(1)) / 2, ta0(0)))) '5
            ov.Add(pD(0)) '6
            ov.add(evalP(pD(0), pG(0), evalT(ta2(0), (ta2(0) + ta2(1)) / 2, ta0(0)))) '7
            tpt = evalP(pE(0), pG(0), evalT(ta2(0), avgT, ta0(0)))
            ov.add(tpt + (vec * da(0))) '8
            ov.add(tpt + (vec * -da(0))) '9
            tpt = pE(0)
            ov.add(tpt + (vec * da(0))) '10
            ov.add(tpt + (vec * -da(0))) '11
            ov.add(evalP(p(0), pF(0), ta1(0))) '12
            ov.add(evalP(pD(0), pF(0), evalT(ta2(0), (ta2(0) + ta2(1)) / 2, ta0(0)))) '13
            tpt = evalP(pE(0), pF(0), evalT(ta2(0), avgT, ta0(0)))
            ov.add(tpt + (vec * da(0))) '14
            ov.add(tpt + (vec * -da(0))) '15

            ov.add(evalP(p(1), pB(1), ta1(1))) '16
            ov.add(evalP(pD(1), pB(1), evalT(ta2(1), (ta2(0) + ta2(1)) / 2, ta0(1)))) '17
            ov.add(pD(1)) '18
            ov.add(evalP(pD(1), pG(1), evalT(ta2(1), (ta2(0) + ta2(1)) / 2, ta0(1)))) '19
            tpt = evalP(pE(1), pG(1), evalT(ta2(1), avgT, ta0(1)))
            ov.add(tpt + (vec * da(1))) '20
            ov.add(tpt + (vec * -da(1))) '21
            ov.add(evalP(pD(1), pF(1), evalT(ta2(1), (ta2(0) + ta2(1)) / 2, ta0(1)))) '22

            'Define Vertex Colors
            If clrB Then
              Dim clxB As Boolean = (blnC And ((clr.count() - 1) > v))
              oc.add(evalC(tcx(0), clB(0), ta1(0))) '4
              oc.add(evalC(clD(0), clB(0), evalT(ta2(0), (ta2(0) + ta2(1)) / 2, ta0(0)))) '5
              oc.add(clD(0)) '6
              oc.add(evalC(clD(0), clG(0), evalT(ta2(0), (ta2(0) + ta2(1)) / 2, ta0(0)))) '7
              oc.add(evalC(clE(0), clG(0), evalT(ta2(0), avgT, ta0(0)))) '8
              oc.add(evalC(clE(0), clG(0), evalT(ta2(0), avgT, ta0(0)))) '9
              oc.add(clE(0)) '10
              oc.add(clE(0)) '11
              oc.add(evalC(tcx(0), clF(0), ta1(0))) '12
              oc.add(evalC(clD(0), clF(0), evalT(ta2(0), (ta2(0) + ta2(1)) / 2, ta0(0)))) '13
              oc.add(evalC(clE(0), clF(0), evalT(ta2(0), avgT, ta0(0)))) '14
              oc.add(evalC(clE(0), clF(0), evalT(ta2(0), avgT, ta0(0)))) '15

              oc.add(evalC(tcx(1), clB(1), ta1(1))) '16
              oc.add(evalC(clD(1), clB(1), evalT(ta2(1), (ta2(0) + ta2(1)) / 2, ta0(1)))) '17
              oc.add(clD(1)) '18
              oc.add(evalC(clD(1), clG(1), evalT(ta2(1), (ta2(0) + ta2(1)) / 2, ta0(1)))) '19
              oc.add(evalC(clE(1), clG(1), evalT(ta2(1), avgT, ta0(1)))) '20
              oc.add(evalC(clE(1), clG(1), evalT(ta2(1), avgT, ta0(1)))) '21
              oc.add(evalC(clD(1), clF(1), evalT(ta2(1), (ta2(0) + ta2(1)) / 2, ta0(1)))) '22

            End If

            'Define Faces
            ofc.Add(New meshface(tv(0), w + u(k) * t + 1, w + u(k) * t + 9, w + u(k - 1) * t + 13))
            ofc.Add(New meshface(w + u(k) * t + 1, w + u(k) * t + 2, w + u(k) * t + 10, w + u(k) * t + 9))
            ofc.Add(New meshface(w + u(k) * t + 2, w + u(k) * t + 3, w + u(k) * t + 4, w + u(k) * t + 10))
            ofc.Add(New meshface(w + u(k) * t + 14, w + u(k) * t + 13, w + u(k + 1) * t + 9, w + u(k) * t + 19))
            ofc.Add(New meshface(w + u(k) * t + 15, w + u(k) * t + 14, w + u(k) * t + 19, w + u(k) * t + 16))

            If ca Then
              ofc.Add(New meshface(w + u(k) * t + 3, w + u(k) * t + 15, w + u(k) * t + 16, w + u(k) * t + 4))
              If k = 1 Then
                ofc.Add(New meshface(w + u(k) * t + 8, w + u(k + 1) * t + 8, w + u(k + 2) * t + 8, w + u(k + 3) * t + 8))
                ofc.Add(New meshface(w + u(k) * t + 7, w + u(k + 1) * t + 7, w + u(k + 2) * t + 7, w + u(k + 3) * t + 7))
              End If
            End If

            If fa Then
              If k Mod 2 Then
                ofc.Add(New meshface(w + u(k) * t + 10, w + u(k) * t + 4, w + u(k) * t + 5, w + u(k) * t + 11))
                ofc.Add(New meshface(w + u(k) * t + 11, w + u(k) * t + 5, w + u(k) * t + 7, w + u(k - 1) * t + 17))
                ofc.Add(New meshface(w + u(k) * t + 16, w + u(k) * t + 19, w + u(k + 1) * t + 11, w + u(k) * t + 17))
                ofc.Add(New meshface(w + u(k) * t + 17, w + u(k + 1) * t + 11, w + u(k + 1) * t + 5, w + u(k + 1) * t + 7))
                ofc.Add(New meshface(w + u(k) * t + 6, w + u(k) * t + 18, w + u(k + 1) * t + 8, w + u(k) * t + 8))
                If ca Then
                  ofc.Add(New meshface(w + u(k) * t + 4, w + u(k) * t + 16, w + u(k) * t + 17, w + u(k) * t + 5))
                  ofc.Add(New meshface(w + u(k) * t + 5, w + u(k) * t + 17, w + u(k + 1) * t + 7, w + u(k) * t + 7))
                End If
              Else
                ofc.Add(New meshface(w + u(k) * t + 10, w + u(k) * t + 4, w + u(k) * t + 6, w + u(k) * t + 12))
                ofc.Add(New meshface(w + u(k) * t + 16, w + u(k) * t + 19, w + u(k + 1) * t + 12, w + u(k) * t + 18))
                ofc.Add(New meshface(w + u(k) * t + 12, w + u(k) * t + 6, w + u(k) * t + 8, w + u(k - 1) * t + 18))
                ofc.Add(New meshface(w + u(k) * t + 18, w + u(k + 1) * t + 12, w + u(k + 1) * t + 6, w + u(k + 1) * t + 8))
                ofc.Add(New meshface(w + u(k) * t + 5, w + u(k) * t + 17, w + u(k + 1) * t + 7, w + u(k) * t + 7))
                If ca Then
                  ofc.Add(New meshface(w + u(k) * t + 4, w + u(k) * t + 16, w + u(k) * t + 18, w + u(k) * t + 6))
                  ofc.Add(New meshface(w + u(k) * t + 6, w + u(k) * t + 18, w + u(k + 1) * t + 8, w + u(k) * t + 8))
                End If
              End If
            Else
              If k Mod 2 Then
                ofc.Add(New meshface(w + u(k) * t + 10, w + u(k) * t + 4, w + u(k) * t + 6, w + u(k) * t + 12))
                ofc.Add(New meshface(w + u(k) * t + 12, w + u(k) * t + 6, w + u(k) * t + 8, w + u(k - 1) * t + 18))
                ofc.Add(New meshface(w + u(k) * t + 16, w + u(k) * t + 19, w + u(k + 1) * t + 12, w + u(k) * t + 18))
                ofc.Add(New meshface(w + u(k) * t + 18, w + u(k + 1) * t + 12, w + u(k + 1) * t + 6, w + u(k + 1) * t + 8))
                ofc.Add(New meshface(w + u(k) * t + 5, w + u(k) * t + 17, w + u(k + 1) * t + 7, w + u(k) * t + 7))
                If ca Then
                  ofc.Add(New meshface(w + u(k) * t + 4, w + u(k) * t + 16, w + u(k) * t + 18, w + u(k) * t + 6))
                  ofc.Add(New meshface(w + u(k) * t + 6, w + u(k) * t + 18, w + u(k + 1) * t + 8, w + u(k) * t + 8))
                End If
              Else
                ofc.Add(New meshface(w + u(k) * t + 10, w + u(k) * t + 4, w + u(k) * t + 5, w + u(k) * t + 11))
                ofc.Add(New meshface(w + u(k) * t + 16, w + u(k) * t + 19, w + u(k + 1) * t + 11, w + u(k) * t + 17))
                ofc.Add(New meshface(w + u(k) * t + 11, w + u(k) * t + 5, w + u(k) * t + 7, w + u(k - 1) * t + 17))
                ofc.Add(New meshface(w + u(k) * t + 17, w + u(k + 1) * t + 11, w + u(k + 1) * t + 5, w + u(k + 1) * t + 7))
                ofc.Add(New meshface(w + u(k) * t + 6, w + u(k) * t + 18, w + u(k + 1) * t + 8, w + u(k) * t + 8))
                If ca Then
                  ofc.Add(New meshface(w + u(k) * t + 4, w + u(k) * t + 16, w + u(k) * t + 17, w + u(k) * t + 5))
                  ofc.Add(New meshface(w + u(k) * t + 5, w + u(k) * t + 17, w + u(k + 1) * t + 7, w + u(k) * t + 7))
                End If
              End If
            End If

          Next
        End If
      Next

      mo.Vertices.AddVertices(ov.toarray())
      If clrB Then mo.VertexColors.AppendColors(oc.toarray())
      mo.Faces.AddFaces(ofc.toarray())
      A = mo

    End If
# ---------- criss_cross: VB additional code ----------
  Private Function appendprepend(ByVal i As Integer)
    Dim srsEnum As IEnumerable(Of Integer) = Enumerable.Range(0, i + 1)
    Dim arrVal As New list(Of Integer)
    arrVal = srsEnum.tolist()
    arrVal.add(0)
    arrVal.insert(0, i)
    Return arrVal.toarray()
  End Function

  Private Function evalT(ByVal da As Double, ByVal db As Double, ByVal t As Double)
    Return (da + (db - da) * t)
  End Function

  Private Function evalP(ByVal op As point3d, ByVal tp As Point3d, ByVal t As Double)
    Return New point3d(op + (tp - op) * t)
  End Function

  Private Function evalC(ByVal oc As color, ByVal tcx As color, ByVal t As Double)
    Dim r,g,b As Integer
    r = CInt(CInt(oc.R) + (CInt(tcx.R) - CInt(oc.R)) * t)
    g = CInt(CInt(oc.G) + (CInt(tcx.G) - CInt(oc.G)) * t)
    b = CInt(CInt(oc.B) + (CInt(tcx.B) - CInt(oc.B)) * t)

    If r > 255 Then r = 255 Else If r < 0 Then r = 0
    If g > 255 Then g = 255 Else If g < 0 Then g = 0
    If b > 255 Then b = 255 Else If b < 0 Then b = 0

    Return color.FromArgb(r, g, b)
  End Function

  Private Function avgC(ByVal R As Double, ByVal G As Double, ByVal B As Double, ByVal T As Integer)

    R /= t
    G /= t
    B /= t
    If R > 255 Then R = 255 Else If R < 0 Then R = 0
    If G > 255 Then G = 255 Else If G < 0 Then G = 0
    If B > 255 Then B = 255 Else If B < 0 Then B = 0

    Return color.FromArgb(CInt(R), CInt(G), CInt(B))
  End Function
# ---------- end criss_cross ----------
weaverbird_s_catmull_clark_subdivision = WeaverbirdsCatmullClarkSubdivision(MeshCurves=flatten(criss_cross.A), Level="3", SmoothNakedEdges=2)
X = Slider(3, range=0..10)
Y = Slider(3, range=0..10)
rectangular_array = RectangularArray(Geometry=weaverbird_s_catmull_clark_subdivision, Cell=rectangle.Rectangle, XCount=X, YCount=Y)  # -> Geometry, Transform
weaverbird_s_join_meshes_and_weld = WeaverbirdsJoinMeshesAndWeld(Mesh=rectangular_array.Geometry, Weld=True)
custom_preview = CustomPreview(Geometry=weaverbird_s_join_meshes_and_weld, Material=ColourSwatch(SwatchColor=RGB(217, 255, 0)))
weaverbird_s_naked_boundary = WeaverbirdsNakedBoundary(MeshClosedPolylines=weaverbird_s_join_meshes_and_weld)
# With Thickness
weaverbird_s_mesh_thicken = WeaverbirdsMeshThicken(MeshCurves=weaverbird_s_join_meshes_and_weld, Distance=Slider(1.3, range=0.1..3.5), OffsetType=0)  # disabled
custom_preview_2 = CustomPreview(Geometry=weaverbird_s_naked_boundary, Material=ColourSwatch(SwatchColor=RGB(0, 0, 0)))
