# Grasshopper definition Weaving-05.gh (Grasshopper 1.0.7)
# plug-ins: Bifocals

depth = Slider(1.89, range=0..10)

size = Slider(10.59, range=0..100)
# First we start with a Hexagonal Grid
Y = Slider(3, range=3..12)
X = Slider(6, range=3..12)
hexagonal = Hexagonal(Plane=PlaneXY(0, 0, 0), Size=size, ExtentX=X, ExtentY=Y)  # -> flatten(Cells), flatten(Points)
point = Point(hexagonal.Points)
curve = Curve(hexagonal.Cells)

number = Number(expr("-x", depth))
number_2 = Number(depth)
repeat_data = RepeatData(Data=[number_2, number], Length="7")
data = Data(repeat_data)

thickness = Slider(0.5, range=0..10)
scale = Slider(0.766346, range=0.666666..1)

explode = Explode(Curve=curve, Recursive=True)  # -> Segments, Vertices
list_item = ListItem(List=explode.Vertices, Index="0", Wrap=True)  # -> flatten(Item)
vector_2pt = Vector2Pt(PointA=point, PointB=list_item, Unitize=False)  # -> Vector, Length
unit_z = UnitZ(Factor=data)
move = Move(Geometry=explode.Vertices, Motion=unit_z)  # -> Geometry, Transform
polyline = PolyLine(Vertices=move.Geometry, Closed=False)
curve_2 = Curve(polyline)
polygon_center = PolygonCenter(Polyline=curve_2)  # -> CenterV, CenterE, CenterA
scale_2 = Scale(Geometry=curve_2, Center=polygon_center.CenterV, Factor=scale)  # -> Geometry, Transform
loft = Loft(
    Curves=[curve_2, scale_2.Geometry],
    Options={Adjust=False, Closed=False, LoftEnds=0, LoftSimp=0, LoftType=0, Rebuild=10, Refit=0.01})

explode_2 = Explode(Curve=curve, Recursive=True)  # -> Segments, Vertices
list_item_2 = ListItem(List=explode_2.Vertices, Index="1", Wrap=True)  # -> flatten(Item)
vector_2pt_2 = Vector2Pt(PointA=point, PointB=list_item_2, Unitize=False)  # -> Vector, Length
move_2 = Move(Geometry=curve, Motion=vector_2pt_2.Vector)  # -> Geometry, Transform
explode_3 = Explode(Curve=move_2.Geometry, Recursive=True)  # -> Segments, Vertices
repeat_data_2 = RepeatData(Data=data, Length="7")
# Part1
unit_z_2 = UnitZ(Factor=repeat_data_2)
move_3 = Move(Geometry=explode_3.Vertices, Motion=unit_z_2)  # -> Geometry, Transform
polyline_2 = PolyLine(Vertices=move_3.Geometry, Closed=False)
curve_3 = Curve(polyline_2)
polygon_center_2 = PolygonCenter(Polyline=curve_3)  # -> CenterV, CenterE, CenterA
scale_3 = Scale(Geometry=curve_3, Center=polygon_center_2.CenterV, Factor=scale)  # -> Geometry, Transform
loft_2 = Loft(
    Curves=[curve_3, scale_3.Geometry],
    Options={Adjust=False, Closed=False, LoftEnds=0, LoftSimp=0, LoftType=0, Rebuild=10, Refit=0.01})

# ----
# Model a bounding box for trimming
move_4 = Move(Geometry=curve, Motion=vector_2pt.Vector)  # -> Geometry, Transform
list_item_3 = ListItem(List=move_2.Geometry, Index=0, Wrap=True)
list_item_4 = ListItem(List=reverse(move_4.Geometry), Index=0, Wrap=True)
explode_4 = Explode(Curve=list_item_3, Recursive=True)  # -> Segments, Vertices
# Part 2
explode_5 = Explode(Curve=list_item_4, Recursive=True)  # -> Segments, Vertices
list_item_5 = ListItem(List=explode_4.Vertices, Index=0, Wrap=True)
list_item_6 = ListItem(List=explode_5.Vertices, Index="3", Wrap=True)
rectangle_2pt = Rectangle2Pt(Plane=PlaneXY(0, 0, 0), PointA=list_item_6, PointB=list_item_5, Radius=0)  # -> Rectangle, Length
unit_z_3 = UnitZ(Factor=expr("-x", thickness))
curve_4 = Curve(rectangle_2pt.Rectangle)
number_3 = Number(number_2)
unit_z_4 = UnitZ(Factor=expr("1.5*x", number_3))
move_5 = Move(Geometry=curve_4, Motion=unit_z_4)  # -> Geometry, Transform
surface = Surface(move_5.Geometry)
extrude = Extrude(Base=surface, Direction=expr("-3*x", unit_z_4))
brep = Brep(extrude)

explode_6 = Explode(Curve=curve, Recursive=True)  # -> Segments, Vertices
list_item_7 = ListItem(List=explode_6.Vertices, Index="0", Wrap=True)  # -> flatten(Item)
vector_2pt_3 = Vector2Pt(PointA=point, PointB=list_item_7, Unitize=False)  # -> Vector, Length
move_6 = Move(Geometry=curve, Motion=vector_2pt_3.Vector)  # -> Geometry, Transform
explode_7 = Explode(Curve=move_6.Geometry, Recursive=True)  # -> Segments, Vertices
unit_z_5 = UnitZ(Factor=data)
# Part 3
move_7 = Move(Geometry=explode_7.Vertices, Motion=unit_z_5)  # -> Geometry, Transform
polyline_3 = PolyLine(Vertices=move_7.Geometry, Closed=False)
curve_5 = Curve(polyline_3)
polygon_center_3 = PolygonCenter(Polyline=curve_5)  # -> CenterV, CenterE, CenterA
scale_4 = Scale(Geometry=curve_5, Center=polygon_center_3.CenterV, Factor=scale)  # -> Geometry, Transform
loft_3 = Loft(
    Curves=[curve_5, scale_4.Geometry],
    Options={Adjust=False, Closed=False, LoftEnds=0, LoftSimp=0, LoftType=0, Rebuild=10, Refit=0.01})
extrude_2 = Extrude(Base=loft_3, Direction=unit_z_3)
solid_intersection = SolidIntersection(BrepsA=flatten(extrude_2), BrepsB=brep)
brep_edges = BrepEdges(Brep=solid_intersection)  # -> Naked, Interior, NonManifold
custom_preview = CustomPreview(Geometry=solid_intersection, Material=ColourSwatch(SwatchColor=RGB(219, 249, 0)))

extrude_3 = Extrude(Base=loft, Direction=unit_z_3)
solid_intersection_2 = SolidIntersection(BrepsA=flatten(extrude_3), BrepsB=brep)
brep_edges_2 = BrepEdges(Brep=solid_intersection_2)  # -> Naked, Interior, NonManifold
custom_preview_2 = CustomPreview(Geometry=solid_intersection_2, Material=ColourSwatch(SwatchColor=RGB(199, 33, 0)))

extrude_4 = Extrude(Base=loft_2, Direction=unit_z_3)
solid_intersection_3 = SolidIntersection(BrepsA=flatten(extrude_4), BrepsB=brep)
brep_edges_3 = BrepEdges(Brep=solid_intersection_3)  # -> Naked, Interior, NonManifold
custom_preview_3 = CustomPreview(Geometry=solid_intersection_3, Material=ColourSwatch(SwatchColor=RGB(15, 45, 255)))
