# Grasshopper definition e5 sirepinski triangle.gh (Grasshopper 1.0.7)

polygon = Polygon(Plane=PlaneXY(0, 0, 0), Radius=3, Segments=Slider(3, range=0..10), FilletRadius=0)  # -> Polygon, Length
python = GhPythonScript(triangle=polygon.Polygon, y=Slider(6, range=0..10))  # -> out, a; inputs triangle: Curve, y: Int32
# ---------- python: Python ----------
import ghpythonlib.components as gh
main_triangles = [triangle]
for time in range(y):
    subtriangle = []
    for i in range(len(main_triangles)):
        corners = gh.Explode(triangle , True )[1]
        a  = corners
        corners.remove(corners[-1])
        
        for corner in range(len(corners)):
            subtriangle.append(gh.Scale(main_triangles[i] , corners[corner] , 0.5)[0])
    main_triangles = subtriangle
a = main_triangles
# ---------- end python ----------
panel = Panel(python.a)
boundary = BoundarySurfaces(Edges=python.a)
