# Grasshopper definition image-example-1.gh (Grasshopper 1.0.7)
# plug-ins: Bifocals, MeshEdit Components

surface = Surface(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)
mesh_surface = MeshSurface(Surface=surface, UCount=Slider(344, range=0..1000), VCount=Slider(258, range=0..1000), Overhang=True, Equalize=False)
mesh_explode = MeshExplode(Mesh=mesh_surface, Interpolate=False)
mesh_area = MeshArea(Mesh=mesh_explode)  # -> Area, Centroid
surface_closest_point = SurfaceClosestPoint(Point=mesh_area.Centroid, Surface=reparameterize(surface))  # -> Point, UVPoint, Distance
image_sampler = ImageSampler(surface_closest_point.UVPoint, Filter="Value", Interpolate=False, Umax=1, Umin=0, Vmax=1, Vmin=0, Wrap=1)
smaller_than = SmallerThan(FirstNumber=image_sampler, SecondNumber=Slider(0.125, range=0..1))  # -> SmallerThan, OrEqualTo
dispatch = Dispatch(List=mesh_explode, DispatchPattern=smaller_than.SmallerThan)  # -> ListA, ListB
mesh = Mesh(dispatch.ListA)
mesh_2 = Mesh(dispatch.ListB)
mesh_colours = MeshColours(Mesh=mesh, Colours=ColourSwatch(SwatchColor=RGB(255, 255, 255)))
mesh_colours_2 = MeshColours(Mesh=mesh_2, Colours=ColourSwatch(SwatchColor=RGB(0, 0, 0)))
mesh_join = MeshJoin(Meshes=mesh_colours)
mesh_join_2 = MeshJoin(Meshes=mesh_colours_2)
