# Grasshopper definition image-example-2.gh (Grasshopper 0.9.76)
# plug-ins: MeshEdit Components, Bifocals, LunchBox

# www.parametrichouse.com
number_slider = Slider(200, range=0..200)
surface = Surface(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)
mesh_surface = MeshSurface(Surface=surface, UCount=number_slider, VCount=number_slider, Overhang=True, Equalize=False)
mesh_explode = MeshExplode(Mesh=mesh_surface, Interpolate=False)  # disabled
mesh_area = MeshArea(Mesh=mesh_explode)  # -> Area, Centroid
surface_closest_point = SurfaceClosestPoint(Point=mesh_area.Centroid, Surface=reparameterize(surface))  # -> Point, UVPoint, Distance
image_sampler = ImageSampler(
    surface_closest_point.UVPoint,
    FilePath="C:\Users\HP\Desktop\Software\Examples\10.jpg",
    Filter="Colour",
    Interpolate=False,
    Umax=1,
    Umin=0,
    Vmax=1,
    Vmin=0,
    Wrap=1)
text_split = TextSplit(Text=image_sampler, Separators=",")
list_item = ListItem(List=text_split, Index=0, Wrap=True)  # -> Item, Item1, Item2
construct_point = ConstructPoint(XCoordinate=list_item.Item, YCoordinate=list_item.Item1, ZCoordinate=list_item.Item2)  # -> flatten(Point)
cull_duplicates = CullDuplicates(Points=construct_point, Tolerance=Slider(120, range=0..300), CullMode=3)  # -> Points, Indices, Valence
closest_point = ClosestPoint(Point=construct_point, Cloud=cull_duplicates.Points)  # -> ClosestPoint, CPIndex, Distance
deconstruct = Deconstruct(Point=closest_point.ClosestPoint)  # -> XComponent, YComponent, ZComponent
colour_rgb = ColourRGB(Alpha=255, Red=deconstruct.XComponent, Green=deconstruct.YComponent, Blue=deconstruct.ZComponent)
mesh_colours = MeshColours(Mesh=graft(mesh_explode), Colours=graft(colour_rgb))  # -> flatten(Mesh)
sort_duplicate_values = SortDuplicateValues(ValueList=colour_rgb)  # -> UniqueValues, Indices
list_item_2 = ListItem(List=mesh_colours, Index=sort_duplicate_values.Indices, Wrap=True)
mesh_join = MeshJoin(Meshes=list_item_2)
