# Grasshopper definition maps-TYAGER-LTA.gh (Grasshopper 1.0.7)
# plug-ins: ElkGHComponents

path = FilePath("C:\Users\cforneri\Armstrong World Industries\TURF - Documents\LIBRARY\RHINO\TRAINING\jiminy-cricket\scripts\map.osm")
loc = Location(FilePathText=path)  # -> OSMPointData, OSMFile, LongitudeDomain, LatitudeDomain
osm = OSMData(OSMPointData=loc.OSMPointData, OSMFilePath=loc.OSMFile, Feature="power", Generate3d=False, IndividualOutputs=False)  # -> Ways, FeatureKey
pline = PolyLine(Vertices=osm.Ways, Closed=True)
osm_2 = OSMData(OSMPointData=loc.OSMPointData, OSMFilePath=loc.OSMFile, Feature="waterway", Generate3d=False, IndividualOutputs=False)  # -> Ways, FeatureKey
topo = Topography()  # -> FileInfo, Points, Curves, Surface
osm_3 = OSMData(OSMPointData=loc.OSMPointData, OSMFilePath=loc.OSMFile, Feature="route", Generate3d=False, IndividualOutputs=False)  # -> Ways, FeatureKey
osm_4 = OSMData(OSMPointData=loc.OSMPointData, OSMFilePath=loc.OSMFile, Feature="building", Generate3d=True, IndividualOutputs=False)  # -> Ways, Buildings, FeatureKey
osm_5 = OSMData(OSMPointData=loc.OSMPointData, OSMFilePath=loc.OSMFile, Feature="railway", Generate3d=False, IndividualOutputs=False)  # -> Ways, FeatureKey
osm_6 = OSMData(
    OSMPointData=loc.OSMPointData,
    OSMFilePath=loc.OSMFile,
    Feature="public_transport",
    Generate3d=False,
    IndividualOutputs=False)  # -> Ways, FeatureKey
pline_2 = PolyLine(Vertices=osm_4.Ways, Closed=True)
pline_3 = PolyLine(Vertices=osm_2.Ways, Closed=True)
pline_4 = PolyLine(Vertices=osm_5.Ways, Closed=True)
pline_5 = PolyLine(Vertices=osm_3.Ways, Closed=True)
pline_6 = PolyLine(Vertices=osm_6.Ways, Closed=True)
