# Grasshopper definition remap+graphmap_re.gh (Grasshopper 1.0.7)

rectangle = Rectangle(Plane=PlaneXY(0, 0, 0), XSize=Slider(1500, range=0..10000), YSize=Slider(1500, range=0..10000), Radius=0)  # -> Rectangle, Length
pt = Point(Point(1455.364574, 41.89367252, 0))
sdivide = DivideSurface(Surface=rectangle.Rectangle, UCount=Slider(30, range=0..100), VCount=Slider(30, range=0..100))  # -> flatten(Points), Normals, Parameters
dist = Distance(PointA=pt, PointB=sdivide.Points)

bnd = Bounds(Numbers=dist)
remap = RemapNumbers(Value=dist, Source=bnd, Target=Domain(0, 1))  # -> Mapped, Clipped
graph = GraphMapper(
    remap.Mapped,
    x0=0,
    x1=1,
    y0=0,
    y1=1,
    container_name="Sine Summation",
    Equation0_px=[0, 0.2432118356],
    Equation0_py=[0.2388861775, 0.6205210686],
    Equation1_px=[0.4657208025, 0.8751375675],
    Equation1_py=[0.1292210221, 0.703866601])

bnd_2 = Bounds(Numbers=graph)
dom = ConstructDomain(DomainStart=Slider(19.992, range=0..25), DomainEnd=Slider(0, range=0..32))
remap_2 = RemapNumbers(Value=graph, Source=bnd_2, Target=dom)  # -> Mapped, Clipped
cir = Circle(Plane=sdivide.Points, Radius=remap_2.Mapped)
