# Grasshopper definition squiggler.gh (Grasshopper 0.9.76)
# plug-ins: Kangaroo2 Components

msphere = MeshSphere(Base=PlaneXY(0, 0, 0), Radius=10, UCount=20, VCount=50)
crv = Curve(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)
divide = DivideCurve(Curve=crv, Count=500, Kinks=False)  # -> Points, Tangents, Parameters
mesh = Mesh(msphere)
pline = PolyLine(Vertices=divide.Points, Closed=False)
onmesh = OnMesh(Points=divide.Points, Mesh=mesh, Strength=100)
explode = Explode(Curve=pline, Recursive=True)  # -> Segments, Vertices
len = Length(Curve=explode.Segments)
item = ListItem(List=len, Index=0, Wrap=True)
num = Number(0.5)
multiplication = Multiplication(A=Slider(1, range=1..50), B=item)
multiplication_2 = Multiplication(A=num, B=multiplication)
length_line = LengthLine(Line=explode.Segments, Length=multiplication, Strength=1)
sc = SphereCollide(Points=divide.Points, Radius=multiplication_2, Strength=10)
reset = Button()
on = BooleanToggle(True)
solver = Solver(
    GoalObjects=[sc, length_line, onmesh],
    Reset=reset,
    Restart=False,
    Parallel=True,
    Threshold=1e-15,
    Tolerance=0.0001,
    AddCurrent=False,
    On=on)  # -> V, O
pline_2 = PolyLine(Vertices=solver.V, Closed=False)
