# Grasshopper definition swarms.gh (Grasshopper 1.0.7)
# plug-ins: Anemone, Noise 4D

number_slider = Slider(100, range=0..100)

# ----
# Initiation particles
number_slider_2 = Slider(5, range=0..10)
yz = YZPlane(Origin=Point(0, 0, 0))
cir = Circle(Plane=yz, Radius=number_slider_2)
popgeo = PopulateGeometry(Geometry=cir, Count=number_slider, Seed=1)

# ----
# attractive points
number_slider_3 = Slider(6, range=0..10)
series = Series(Start=Slider(3, range=0..10), Step=Slider(7, range=0..10), Count=number_slider_3)
genes = GenePool(Decimals=2, Maximum=3, Minimum=0, Value=[1.5, 0.37, 1.5, 1.97, 1.5, 0.88])
X = UnitX(Factor=series)
move = Move(Geometry=popgeo, Motion=graft(X))  # -> Geometry, Transform
scale = Scale(Geometry=move.Geometry, Center=Point(0, 0, 0), Factor=graft(genes))  # -> Geometry, Transform
lng = ListLength(List=flatten(scale.Geometry))
subtraction = Subtraction(A=lng, B=number_slider)
reduce = RandomReduce(List=flatten(scale.Geometry), Reduction=subtraction, Seed=1)

vec = VectorXYZ(XComponent=Slider(0.806, range=0..5), YComponent=0, ZComponent=0)  # -> Vector, Length

# ----
# True to pause iteration
# L O O P
loop_start = LoopStart(Repeat=Slider(125, range=0..1000), Trigger=Button(), Data=popgeo)  # -> port, Counter, Data

data = Data(loop_start.Data)
vec2pt = Vector2Pt(PointA=data, PointB=reduce, Unitize=False)  # -> Vector, Length

# ----
# Counter of loop as timer
division = Division(A=loop_start.Counter, B=5)
data_2 = Data(division)

# ----
# noise generator
pt = Point(data)
number_slider_4 = Slider(0.252, range=0..1)
perlin = PerlinNoise(Values=pt, Time=expr("x+1", data_2), Scale=number_slider_4)
perlin_2 = PerlinNoise(Values=pt, Time=expr("x+2", data_2), Scale=number_slider_4)
perlin_3 = PerlinNoise(Values=pt, Time=data_2, Scale=number_slider_4)

amp = Amplitude(Vector=vec2pt.Vector, Amplitude=Slider(0.127, range=0..1))
vec_2 = VectorXYZ(XComponent=perlin_3, YComponent=perlin, ZComponent=perlin_2)  # -> Vector, Length

# ----
# Combining forces together
addition = Addition(A=flatten(vec.Vector), B=flatten(amp), C=flatten(vec_2.Vector))

# ----
# Apply forces to our points
move_2 = Move(Geometry=data, Motion=addition)  # -> Geometry, Transform

running = Running(
    port=loop_start.port,
    Exit=Toggle(False),
    Data=move_2.Geometry,
    TimeOutVal=0,
    pausedState=False,
    state="Constant & Record")

flip = FlipMatrix(Data=running)
intcrv = Interpolate(Vertices=flip, Degree=3, Periodic=False, KnotStyle=1)  # -> Curve, Length, Domain

# ----
# Caution!
# This process is Slow!
intcrv_2 = Interpolate(Vertices=flip, Degree=3, Periodic=False, KnotStyle=1)  # -> Curve, Length, Domain; disabled
divide = DivideCurve(Curve=intcrv_2.Curve, Count=Slider(2, range=0..10), Kinks=False)  # -> Points, Tangents, Parameters
genes_2 = GenePool(Decimals=2, Maximum=1, Minimum=0, Value=[0.5, 0.33, 0.12])
vpipe = PipeVariable(Curve=intcrv_2.Curve, Parameters=divide.Parameters, Radii=genes_2, Caps=0)
preview = CustomPreview(Geometry=vpipe, Material=ColourSwatch(SwatchColor=RGB(0, 0, 0)))
