# Grasshopper definition tessellation-01.gh (Grasshopper 1.0.7)
# plug-ins: Weaverbird

T = Slider(0.66, range=0.1..0.9)
surface = Surface(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)
cairo_tiling = CairoTiling(S=surface, U=Slider(3, range=1..3), V=Slider(2, range=1..3), T=T)  # -> out, M; inputs S: Surface
# ---------- cairo_tiling: VB ----------
    Component.Params.Input(0).Name = "Surface"
    Component.Params.Input(0).Description = "The base surface to mesh"
    Component.Params.Input(1).Name = "U Count"
    Component.Params.Input(1).Description = "The number of quads in the U direction"
    Component.Params.Input(2).Name = "V Count"
    Component.Params.Input(2).Description = "The number of quads in the V direction"
    Component.Params.Input(3).Name = "Evaluate"
    Component.Params.Input(3).Description = "A unitized value which symmetrically shifts the location of internal vertices within each new quad"

    Component.Params.Output(1).Name = "Mesh"
    Component.Params.Output(1).Description = "If successful, the resulting mesh"
    
    If s IsNot Nothing Then
      Dim i,j,k As Integer
      Dim wu,wv As New list(Of Integer)
      Dim bu, bv As Boolean
      Dim cu, cv,au,av As Integer
      Dim arrPts As New list(Of point3d)
      Dim arrFaces As New list(Of MeshFace)
      Dim mo As New mesh
      Dim mv As New list(Of point3d)
      Dim mf As New list(Of meshface)
      Dim uva(,) As Integer
      Dim uvb(,) As Integer
      Dim uvc(,) As Integer

      U += 1
      V += 1
      bu = s.IsClosed(0)
      bv = s.IsClosed(1)

      S.SetDomain(0, New interval(0, 1))
      S.SetDomain(1, New interval(0, 1))

      If (bu And (u Mod 2)) Then
        wu = appendprepend(U)
        cu = u - 1
        au = 1
      Else
        wu = series(U)
        cu = u
        au = 0
      end if

      If (bv And (v Mod 2)) Then
        wv = appendprepend(V)
        cv = v - 1
        av = 1
      Else
        wv = series(V)
        cV = v
        av = 0
      End If

      ReDim uva(cu - 1, cv - 1)
      ReDim uvb(cu - 1, cv - 1)
      ReDim uvc(cu - 1, cv - 1)

      For i = 0 To cu - 1 Step 1
        For j = 0 To cv - 1 Step 1
          mv.add(S.PointAt(i * (1 / (U - 1)), j * (1 / (V - 1))))
          uva(i, j) = k
          k += 1
        Next
      Next

      For i = 0 To cu - 1 Step 1
        For j = 0 To cv - 1 Step 1
          Dim pt(1) As point3d

          pt(0) = S.PointAt(i * (1 / (U - 1)), j * (1 / (V - 1)))
          pt(1) = S.PointAt(i * (1 / (U - 1)), (j + 1) * (1 / (V - 1)))

          mv.add(evalP(pt((i + j) Mod 2), pt((i + j + 1) Mod 2), t))
          uvb(i, j) = k
          k += 1
        Next
      Next

      For i = 0 To u - 2 Step 1
        For j = 0 To cv - 1 Step 1
          Dim pt(1) As point3d

          pt(0) = S.PointAt((i + 1) * (1 / (U - 1)), j * (1 / (V - 1)))
          pt(1) = S.PointAt(i * (1 / (U - 1)), j * (1 / (V - 1)))

          mv.add(evalP(pt((i + j) Mod 2), pt((i + j + 1) Mod 2), t))
          uvc(i, j) = k
          k += 1
        Next
      Next

      For i = 0 To cu - 1 Step 1
        For j = 0 To v - 2 Step 1
          mv.add(S.PointAt((1 / (U - 1)) / 2 + i * (1 / (U - 1)), (1 / (V - 1)) / 2 + j * (1 / (V - 1))))
        Next
      Next

      For i = 0 To u - 2 Step 1
        For j = 0 To v - 2 Step 1
          mf.add(New MeshFace(uvc(i, j), k, uvb(wu(i), j), uva(wu(i), j)))
          mf.add(New MeshFace(uvb(wu(i), j), k, uvc(i, wv(j + 1)), uva(wu(i), wv(j + 1))))
          mf.add(New MeshFace(uvc(i, wv(j + 1)), k, uvb(wu(i + 1), j), uva(wu(i + 1), wv(j + 1))))
          mf.add(New MeshFace(uvb(wu(i + 1), j), k, uvc(i, j), uva(wu(i + 1), j)))
          k += 1
        Next
      Next
      mo.Vertices.AddVertices(mv.toarray())
      mo.Faces.AddFaces(mf.toarray())

      M = mo
    End If
# ---------- cairo_tiling: VB additional code ----------
  Private Function appendprepend(ByVal i As Integer)
    Dim srsEnum As IEnumerable(Of Integer) = Enumerable.Range(0, i - 1)
    Dim arrVal As New list(Of Integer)
    arrVal = srsEnum.tolist()
    arrVal.add(0)
    Return arrVal
  End Function

  Private Function series(ByVal i As Integer)
    Dim srsEnum As IEnumerable(Of Integer) = Enumerable.Range(0, i)
    Dim arrVal As New list(Of Integer)
    arrVal = srsEnum.tolist()
    Return arrVal
  End Function

  Private Function evalP(ByVal op As point3d, ByVal tp As Point3d, ByVal t As Double)
    Return New point3d(op + (tp - op) * t)
  End Function
# ---------- end cairo_tiling ----------
D = Slider(13, range=0..13)
mesh = Mesh(cairo_tiling.M)
t2 = Slider(14.69, range=0..20)
weaverbird_s_mesh_window = WeaverbirdsMeshWindow(MeshPolylines=mesh, Distance=D, InsetType=1)
weaverbird_s_picture_frame = WeaverbirdsPictureFrame(MeshPolylines=mesh, Distance=D, InsetType=1)
weaverbird_s_mesh_thicken = WeaverbirdsMeshThicken(MeshCurves=weaverbird_s_picture_frame, Distance=t2, OffsetType=0)
custom_preview = CustomPreview(Geometry=weaverbird_s_mesh_thicken, Material=ColourSwatch(SwatchColor=RGB(194, 194, 194)))
custom_preview_2 = CustomPreview(Geometry=weaverbird_s_mesh_window, Material=ColourSwatch(SwatchColor=RGB(255, 255, 255)))
